# Grasshopper definition relifecycle_example_script_galapagos_integration.gh (Grasshopper 1.0.8)
# plug-ins: ReLifeCycleGHPlugin

# ---- group: Parameters
load_bearing_direction = ValueList({"X-Direction": 0, "Y-Direction": 1}, selected="X-Direction")
# Example File - Galapagos Integration
# Developed by Pim van Rijsbergen
# Step 0: Read Me First!
# Welcome to the ReLifeCycle Demo! This plugin helps you enhance the responsible material use of your parametric building design with environmental impact,
# circularity and financial impact assessments. This demo explains the steps for integrating ReLifeCycle with the Galapagos plugin to perform a single-objective
# optimisation to optimise your materialisation!
# 
# If there are any questions, unclarities or if you have feedback you can always reach me on pvanrijsbergen@gmail.com :)
# Step 1: Standard ReLifeCycle workflow
# To find a detailed explanation of this workflow, please refer to the "relifecycle_example_script_getting_started" example script.
# Step 1.1: Create a parametric building script
# PARAMETERS
building_width_m = Slider(4, range=1..10, expression="x*8.4")
building_length_m = Slider(5, range=1..10, expression="x*7.2")
storey_height_m = Slider(3.2, range=2.4..8)
number_of_floors = Slider(6, range=1..50)
window_to_wall_ratio = Slider(0.7, range=0.01..0.98)
column_width_m = Slider(0.3, range=0..1)
beam_height_m = Slider(0.4, range=0..1)

# ---- group: Base surface creation
# CREATE STRUCTURAL GRID
plane_surface = PlaneSurface(Plane=PlaneXY(0, 0, 0), XSize=building_width_m, YSize=building_length_m)
base_surface = Surface(plane_surface)

# ---- group: Create General Grid
unit_x = UnitX(Factor=1)
unit_y = UnitY(Factor=1)
edges_from_directions = EdgesFromDirections(Brep=base_surface, Directions=unit_x, Reflex=True, Angle=0)  # -> simplify(graft(Edges)), Indices, Map
edges_from_directions_2 = EdgesFromDirections(Brep=base_surface, Directions=unit_y, Reflex=True, Angle=0)  # -> simplify(graft(Edges)), Indices, Map
divide_distance = DivideDistance(Curve=edges_from_directions.Edges, Distance=8.4)  # -> simplify(Points), Tangents, Parameters
divide_distance_2 = DivideDistance(Curve=edges_from_directions_2.Edges, Distance=7.2)  # -> simplify(Points), Tangents, Parameters
explode_tree = ExplodeTree(Data=divide_distance.Points)  # -> Branch0, reverse(Branch1)
explode_tree_2 = ExplodeTree(Data=divide_distance_2.Points)  # -> Branch0, reverse(Branch1)
line = Line(StartPoint=explode_tree.Branch0, EndPoint=explode_tree.Branch1)
line_2 = Line(StartPoint=explode_tree_2.Branch0, EndPoint=explode_tree_2.Branch1)

# ---- group: Create Structural Grid
subtraction = Subtraction(StoreyHeight=storey_height_m, BeamHeight=beam_height_m)
multiple_curves = MultipleCurves(Curves=[line, line_2])  # -> Points, IndexA, IndexB, ParamA, ParamB
stream_filter = StreamFilter(Gate=load_bearing_direction, Stream0=line_2, Stream1=line)
unit_z = UnitZ(Factor=subtraction)
move = Move(Geometry=stream_filter, Motion=unit_z)  # -> Geometry, Transform
move_2 = Move(Geometry=multiple_curves.Points, Motion=unit_z)  # -> Geometry, Transform
line_3 = Line(StartPoint=multiple_curves.Points, EndPoint=move_2.Geometry)
load_bearing_vert_lines = Curve(line_3)
load_bearing_hor_lines = Curve(move.Geometry)

# ---- group: Create beams
division = Division(ColumnWidth=column_width_m, B=2)
beam_lines = Line(load_bearing_hor_lines)
extend_curve = ExtendCurve(Curve=beam_lines, Type=0, Start=division, End=division)
column_width = Number(column_width_m)
beam_height = Number(beam_height_m)
perp_frames = PerpFrames(Curve=extend_curve, Count=10, Align=True)  # -> Frames, Parameters
construct_domain = Domain(DomainStart=expr("-x/2", column_width), DomainEnd=expr("x/2", column_width))
negative = Negative(Value=beam_height)
rectangle = Rectangle(Plane=perp_frames.Frames, XSize=negative, YSize=construct_domain, Radius=0)  # -> Rectangle, Length
unit_z_2 = UnitZ(Factor=beam_height_m)
move_3 = Move(Geometry=rectangle.Rectangle, Motion=unit_z_2)  # -> Geometry, Transform
loft = Loft(Curves=move_3.Geometry, Options={Adjust=False, Closed=False, LoftEnds=0, LoftSimp=0, LoftType=0, Rebuild=10, Refit=0.01})
cap_holes = CapHoles(Brep=loft)  # -> flatten(Brep)
beams = Mesh(cap_holes)

# ---- group: Create columns
# CREATE STRUCTURE
column_lines = Line(load_bearing_vert_lines)
column_width_2 = Number(column_width_m)
perp_frames_2 = PerpFrames(Curve=column_lines, Count=10, Align=True)  # -> Frames, Parameters
construct_domain_2 = Domain(DomainStart=expr("-x/2", column_width_2), DomainEnd=expr("x/2", column_width_2))
construct_domain_3 = Domain(DomainStart=expr("-x/2", column_width_2), DomainEnd=expr("x/2", column_width_2))
rectangle_2 = Rectangle(Plane=perp_frames_2.Frames, XSize=construct_domain_2, YSize=construct_domain_3, Radius=0)  # -> Rectangle, Length
loft_2 = Loft(
    Curves=rectangle_2.Rectangle,
    Options={Adjust=False, Closed=False, LoftEnds=0, LoftSimp=0, LoftType=0, Rebuild=10, Refit=0.01})
cap_holes_2 = CapHoles(Brep=loft_2)  # -> flatten(Brep)
columns = Mesh(cap_holes_2)

# ---- group: Create floor
# CREATE FLOORS, ROOF, FACADE AND WINDOWS
columns_2 = Geometry(columns)
bounding_box = BoundingBox(Content=columns_2, Plane=PlaneXY(0, 0, 0), UnionBox=True)  # -> Box, Box_2
deconstruct_brep = DeconstructBrep(Brep=bounding_box.Box)  # -> Faces, Edges, Vertices
list_item = ListItem(List=deconstruct_brep.Faces, Index=4, Wrap=True)  # -> simplify(Item)

# ---- group: Create Multiple Storeys
# Create multiple storeys
length = Length(Curve=load_bearing_vert_lines)
list_item_2 = ListItem(List=length, Index=0, Wrap=True)
addition = Addition(ColumnHeight=list_item_2, BeamHeight=beam_height_m)
series = Series(Start=0, Step=addition, Count=number_of_floors)
unit_z_3 = UnitZ(Factor=series)
beams_2 = Geometry(beams)
move_4 = Move(Geometry=graft(list_item), Motion=unit_z_3)  # -> simplify(Geometry), Transform
move_5 = Move(Geometry=graft(beams_2), Motion=unit_z_3)  # -> simplify(Geometry), Transform
move_6 = Move(Geometry=graft(columns_2), Motion=unit_z_3)  # -> simplify(Geometry), Transform
columns_3 = Geometry(move_6.Geometry)
floor_slabs = Geometry(move_4.Geometry)
beams_3 = Geometry(move_5.Geometry)

# ---- group: Create roof
unit_z_4 = UnitZ(Factor=addition)
list_item_3 = ListItem(List=reverse(floor_slabs), Index=0, Wrap=True)
move_7 = Move(Geometry=list_item_3, Motion=unit_z_4)  # -> simplify(Geometry), Transform
roof_slab = Geometry(move_7.Geometry)

# ---- group: Create facade walls and windows
bounding_box_2 = BoundingBox(Content=flatten([floor_slabs, roof_slab]), Plane=PlaneXY(0, 0, 0), UnionBox=True)  # -> Box, Box_2
deconstruct_brep_2 = DeconstructBrep(Brep=bounding_box_2.Box)  # -> Faces, Edges, Vertices
project = Project(Geometry=flatten(deconstruct_brep_2.Faces), Plane=PlaneXY(0, 0, 0))  # -> Geometry, Transform
area = Area(Geometry=flatten(project.Geometry))  # -> Area, Centroid
equality = Equality(FirstNumber=area.Area, SecondNumber=0)  # -> Equality, Inequality
maximum = Maximum(BuildingWidth=building_width_m, BuildingLength=building_length_m)
cull_pattern = CullPattern(List=deconstruct_brep_2.Faces, CullPattern=equality.Equality)
merge = Merge(Data1=floor_slabs, Data2=roof_slab)  # -> flatten(FloorAndRoofSlabs)
addition_2 = Addition(A=maximum, B=200)
closed_facade_walls = Geometry(cull_pattern)
construct_domain_4 = Domain(DomainStart=expr("-x/2", addition_2), DomainEnd=expr("x/2", addition_2))
construct_domain_5 = Domain(DomainStart=expr("-x/2", addition_2), DomainEnd=expr("x/2", addition_2))
area_2 = Area(Geometry=merge)  # -> Area, Centroid
mesh_brep = MeshBrep(
    Brep=closed_facade_walls,
    Settings={GridMaxCount=0, GridMinCount=16, JaggedSeams=False, MaxEdgeLength=0, MinEdgeLength=0.0001, MinTolerance=0, Refine=True, RefineAngle=0, RelativeTolerance=0.65, SimplePlanes=True, Tolerance=0})
plane_surface_2 = PlaneSurface(Plane=area_2.Centroid, XSize=construct_domain_4, YSize=construct_domain_5)
cull_index = CullIndex(List=plane_surface_2, Indices=0, Wrap=True)
mesh_brep_2 = MeshBrep(
    Brep=cull_index,
    Settings={GridMaxCount=0, GridMinCount=16, JaggedSeams=False, MaxEdgeLength=0, MinEdgeLength=0.0001, MinTolerance=0, Refine=True, RefineAngle=0, RelativeTolerance=0.65, SimplePlanes=True, Tolerance=0})
mesh_split = MeshSplit(Mesh=mesh_brep, Splitters=mesh_brep_2)  # -> simplify(Result)
area_3 = Area(Geometry=mesh_split)  # -> Area, Centroid
scale = Scale(Geometry=mesh_split, Center=area_3.Centroid, Factor=window_to_wall_ratio)  # -> simplify(Geometry), Transform
mesh_join = MeshJoin(Meshes=[mesh_split, scale.Geometry])
mesh_edges = MeshEdges(Mesh=mesh_join)  # -> NakedEdges, InteriorEdges, NonManifoldEdges
join_curves = JoinCurves(Curves=mesh_edges.NakedEdges, Preserve=True)
boundary_surfaces = BoundarySurfaces(Edges=join_curves)
windows = Geometry(flatten(scale.Geometry))
facade_walls = Geometry(flatten(boundary_surfaces))

# ----
# FINAL MODEL
# Final building model
entwine = Entwine(
    Branch00=columns_3,
    Branch01=beams_3,
    Branch02=floor_slabs,
    Branch03=roof_slab,
    Branch04=facade_walls,
    Branch05=windows,
    FlattenInputs=True)
building_model = Geometry(entwine)

# ---- group: Extract building elements
# Step 1.2: Extract building elements
# Extracted building elements
explode_tree_3 = ExplodeTree(Data=building_model)  # -> Branch0, Branch1, Branch2, Branch3, Branch4, Branch5
columns_4 = Geometry(explode_tree_3.Branch0)
beams_4 = Geometry(explode_tree_3.Branch1)
floor_slabs_2 = Geometry(explode_tree_3.Branch2)
roof_slabs = Geometry(explode_tree_3.Branch3)
windows_2 = Geometry(explode_tree_3.Branch5)
facade_walls_2 = Geometry(explode_tree_3.Branch4)

# ---- group: Floors / Floor insulation
# Step 1.3: Create building elements
nl_sfb_class = ValueList({"11 Ground": "11", "13A Floors on the ground - Structure": "13A", "13B Floors on the ground - Insulation": "13B", "16 Foundation": "16", "17 Pile foundations": "17", "21A External walls - Structure": "21A", "21B External walls - Insulation": "21B", "22A Internal walls - Structure": "22A", "22B Internal walls - Insulation": "22B", "23A Floors - Structure": "23A"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}, selected="23A Floors - Structure")
create_material_set = CreateMaterialSet(NLSfBClass=nl_sfb_class)  # -> MaterialSetData, MaterialNames
material_index = Slider(1, range=0..2)
select_material = SelectMaterial(MaterialSetData=create_material_set.MaterialSetData, Index=material_index)
create_building_element = CreateBuildingElement(Name="Structural floor slabs", NLSfBClass=nl_sfb_class, MaterialData=select_material, Geometry=flatten(floor_slabs_2))  # -> BuildingElementData, Area_m2, Volume_m3, Mass_kg

# ---- group: Floors
nl_sfb_class_2 = ValueList({"11 Ground": "11", "13A Floors on the ground - Structure": "13A", "13B Floors on the ground - Insulation": "13B", "16 Foundation": "16", "17 Pile foundations": "17", "21A External walls - Structure": "21A", "21B External walls - Insulation": "21B", "22A Internal walls - Structure": "22A", "22B Internal walls - Insulation": "22B", "23A Floors - Structure": "23A"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}, selected="23B Floors - Insulation": "23B")
create_material_set_2 = CreateMaterialSet(NLSfBClass=nl_sfb_class_2)  # -> MaterialSetData, MaterialNames
material_index_2 = Slider(2, range=0..2)
select_material_2 = SelectMaterial(MaterialSetData=create_material_set_2.MaterialSetData, Index=material_index_2)
create_building_element_2 = CreateBuildingElement(Name="Floor insulation", NLSfBClass=nl_sfb_class_2, MaterialData=select_material_2, Geometry=flatten(floor_slabs_2))  # -> BuildingElementData, Area_m2, Volume_m3, Mass_kg

# ---- group: Floors / Floor finishing
nl_sfb_class_3 = ValueList({"11 Ground": "11", "13A Floors on the ground - Structure": "13A", "13B Floors on the ground - Insulation": "13B", "16 Foundation": "16", "17 Pile foundations": "17", "21A External walls - Structure": "21A", "21B External walls - Insulation": "21B", "22A Internal walls - Structure": "22A", "22B Internal walls - Insulation": "22B", "23A Floors - Structure": "23A"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}, selected="43 Floor finishes": "43")
create_material_set_3 = CreateMaterialSet(NLSfBClass=nl_sfb_class_3)  # -> MaterialSetData, MaterialNames
material_index_3 = Slider(0, range=0..2)
select_material_3 = SelectMaterial(MaterialSetData=create_material_set_3.MaterialSetData, Index=material_index_3)
create_building_element_3 = CreateBuildingElement(Name="Floor finishing", NLSfBClass=nl_sfb_class_3, MaterialData=select_material_3, Geometry=flatten(floor_slabs_2))  # -> BuildingElementData, Area_m2, Volume_m3, Mass_kg

# ---- group: Facade walls / Facade walls structure
nl_sfb_class_4 = ValueList({"11 Ground": "11", "13A Floors on the ground - Structure": "13A", "13B Floors on the ground - Insulation": "13B", "16 Foundation": "16", "17 Pile foundations": "17", "21A External walls - Structure": "21A", "21B External walls - Insulation": "21B", "22A Internal walls - Structure": "22A", "22B Internal walls - Insulation": "22B", "23A Floors - Structure": "23A"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}, selected="21A External walls - Structure")
create_material_set_4 = CreateMaterialSet(NLSfBClass=nl_sfb_class_4)  # -> MaterialSetData, MaterialNames
material_index_4 = Slider(2, range=0..2)
select_material_4 = SelectMaterial(MaterialSetData=create_material_set_4.MaterialSetData, Index=material_index_4)
create_building_element_4 = CreateBuildingElement(
    Name="Facade walls structure",
    NLSfBClass=nl_sfb_class_4,
    MaterialData=select_material_4,
    Geometry=flatten(facade_walls_2))  # -> BuildingElementData, Area_m2, Volume_m3, Mass_kg

# ---- group: Facade walls / Facade walls insulation
nl_sfb_class_5 = ValueList({"11 Ground": "11", "13A Floors on the ground - Structure": "13A", "13B Floors on the ground - Insulation": "13B", "16 Foundation": "16", "17 Pile foundations": "17", "21A External walls - Structure": "21A", "21B External walls - Insulation": "21B", "22A Internal walls - Structure": "22A", "22B Internal walls - Insulation": "22B", "23A Floors - Structure": "23A"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}, selected="21B External walls - Insulation")
create_material_set_5 = CreateMaterialSet(NLSfBClass=nl_sfb_class_5)  # -> MaterialSetData, MaterialNames
material_index_5 = Slider(2, range=0..2)
select_material_5 = SelectMaterial(MaterialSetData=create_material_set_5.MaterialSetData, Index=material_index_5)
create_building_element_5 = CreateBuildingElement(
    Name="Facade walls insulation",
    NLSfBClass=nl_sfb_class_5,
    MaterialData=select_material_5,
    Geometry=flatten(facade_walls_2))  # -> BuildingElementData, Area_m2, Volume_m3, Mass_kg

# ---- group: Facade walls / Facade walls cladding
nl_sfb_class_6 = ValueList({"11 Ground": "11", "13A Floors on the ground - Structure": "13A", "13B Floors on the ground - Insulation": "13B", "16 Foundation": "16", "17 Pile foundations": "17", "21A External walls - Structure": "21A", "21B External walls - Insulation": "21B", "22A Internal walls - Structure": "22A", "22B Internal walls - Insulation": "22B", "23A Floors - Structure": "23A"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}, selected="41 External wall finishes": "41")
create_material_set_6 = CreateMaterialSet(NLSfBClass=nl_sfb_class_6)  # -> MaterialSetData, MaterialNames
material_index_6 = Slider(1, range=0..2)
select_material_6 = SelectMaterial(MaterialSetData=create_material_set_6.MaterialSetData, Index=material_index_6)
create_building_element_6 = CreateBuildingElement(
    Name="Facade walls cladding",
    NLSfBClass=nl_sfb_class_6,
    MaterialData=select_material_6,
    Geometry=flatten(facade_walls_2))  # -> BuildingElementData, Area_m2, Volume_m3, Mass_kg

# ---- group: Windows / Window frames
nl_sfb_class_7 = ValueList({"11 Ground": "11", "13A Floors on the ground - Structure": "13A", "13B Floors on the ground - Insulation": "13B", "16 Foundation": "16", "17 Pile foundations": "17", "21A External walls - Structure": "21A", "21B External walls - Insulation": "21B", "22A Internal walls - Structure": "22A", "22B Internal walls - Insulation": "22B", "23A Floors - Structure": "23A"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}, selected="31A External wall openings - Windows (frames)": "31A")
create_material_set_7 = CreateMaterialSet(NLSfBClass=nl_sfb_class_7)  # -> MaterialSetData, MaterialNames
material_index_7 = Slider(1, range=0..2)
select_material_7 = SelectMaterial(MaterialSetData=create_material_set_7.MaterialSetData, Index=material_index_7)
create_building_element_7 = CreateBuildingElement(Name="Window frames", NLSfBClass=nl_sfb_class_7, MaterialData=select_material_7, Geometry=flatten(windows_2))  # -> BuildingElementData, Area_m2, Volume_m3, Mass_kg

# ---- group: Windows / Window glazing
nl_sfb_class_8 = ValueList({"11 Ground": "11", "13A Floors on the ground - Structure": "13A", "13B Floors on the ground - Insulation": "13B", "16 Foundation": "16", "17 Pile foundations": "17", "21A External walls - Structure": "21A", "21B External walls - Insulation": "21B", "22A Internal walls - Structure": "22A", "22B Internal walls - Insulation": "22B", "23A Floors - Structure": "23A"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}, selected="31B External wall openings - Windows (glazing)": "31B")
create_material_set_8 = CreateMaterialSet(NLSfBClass=nl_sfb_class_8)  # -> MaterialSetData, MaterialNames
select_material_8 = SelectMaterial(MaterialSetData=create_material_set_8.MaterialSetData, Index=0)
create_building_element_8 = CreateBuildingElement(Name="Window glazing", NLSfBClass=nl_sfb_class_8, MaterialData=select_material_8, Geometry=flatten(windows_2))  # -> BuildingElementData, Area_m2, Volume_m3, Mass_kg

# ---- group: Roof / Structural roof slabs
nl_sfb_class_9 = ValueList({"11 Ground": "11", "13A Floors on the ground - Structure": "13A", "13B Floors on the ground - Insulation": "13B", "16 Foundation": "16", "17 Pile foundations": "17", "21A External walls - Structure": "21A", "21B External walls - Insulation": "21B", "22A Internal walls - Structure": "22A", "22B Internal walls - Insulation": "22B", "23A Floors - Structure": "23A"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}, selected="27A Roofs - Structure": "27A")
create_material_set_9 = CreateMaterialSet(NLSfBClass=nl_sfb_class_9)  # -> MaterialSetData, MaterialNames
material_index_8 = Slider(1, range=0..2)
select_material_9 = SelectMaterial(MaterialSetData=create_material_set_9.MaterialSetData, Index=material_index_8)
create_building_element_9 = CreateBuildingElement(Name="Structural roof slabs", NLSfBClass=nl_sfb_class_9, MaterialData=select_material_9, Geometry=flatten(roof_slabs))  # -> BuildingElementData, Area_m2, Volume_m3, Mass_kg

# ---- group: Roof / Roof insulation
nl_sfb_class_10 = ValueList({"11 Ground": "11", "13A Floors on the ground - Structure": "13A", "13B Floors on the ground - Insulation": "13B", "16 Foundation": "16", "17 Pile foundations": "17", "21A External walls - Structure": "21A", "21B External walls - Insulation": "21B", "22A Internal walls - Structure": "22A", "22B Internal walls - Insulation": "22B", "23A Floors - Structure": "23A"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}, selected="27B Roofs - Insulation": "27B")
create_material_set_10 = CreateMaterialSet(NLSfBClass=nl_sfb_class_10)  # -> MaterialSetData, MaterialNames
material_index_9 = Slider(2, range=0..2)
select_material_10 = SelectMaterial(MaterialSetData=create_material_set_10.MaterialSetData, Index=material_index_9)
create_building_element_10 = CreateBuildingElement(Name="Roof insulation", NLSfBClass=nl_sfb_class_10, MaterialData=select_material_10, Geometry=flatten(roof_slabs))  # -> BuildingElementData, Area_m2, Volume_m3, Mass_kg

# ---- group: Roof / Roof finishing
nl_sfb_class_11 = ValueList({"11 Ground": "11", "13A Floors on the ground - Structure": "13A", "13B Floors on the ground - Insulation": "13B", "16 Foundation": "16", "17 Pile foundations": "17", "21A External walls - Structure": "21A", "21B External walls - Insulation": "21B", "22A Internal walls - Structure": "22A", "22B Internal walls - Insulation": "22B", "23A Floors - Structure": "23A"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}, selected="47 Roof finishes": "47")
create_material_set_11 = CreateMaterialSet(NLSfBClass=nl_sfb_class_11)  # -> MaterialSetData, MaterialNames
material_index_10 = Slider(2, range=0..2)
select_material_11 = SelectMaterial(MaterialSetData=create_material_set_11.MaterialSetData, Index=material_index_10)
create_building_element_11 = CreateBuildingElement(Name="Roof finishing", NLSfBClass=nl_sfb_class_11, MaterialData=select_material_11, Geometry=flatten(roof_slabs))  # -> BuildingElementData, Area_m2, Volume_m3, Mass_kg

# ---- group: Structural skeleton / Columns and beams
nl_sfb_class_12 = ValueList({"11 Ground": "11", "13A Floors on the ground - Structure": "13A", "13B Floors on the ground - Insulation": "13B", "16 Foundation": "16", "17 Pile foundations": "17", "21A External walls - Structure": "21A", "21B External walls - Insulation": "21B", "22A Internal walls - Structure": "22A", "22B Internal walls - Insulation": "22B", "23A Floors - Structure": "23A"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}, selected="28A Load-bearing structures - General": "28A")
create_material_set_12 = CreateMaterialSet(NLSfBClass=nl_sfb_class_12)  # -> MaterialSetData, MaterialNames
material_index_11 = Slider(1, range=0..2)
select_material_12 = SelectMaterial(MaterialSetData=create_material_set_12.MaterialSetData, Index=material_index_11)
create_building_element_12 = CreateBuildingElement(
    Name="Structural skeleton",
    NLSfBClass=nl_sfb_class_12,
    MaterialData=select_material_12,
    Geometry=flatten([columns_4, beams_4]))  # -> BuildingElementData, Area_m2, Volume_m3, Mass_kg

# ---- group: Structural skeleton / Reinforcement in case of concrete structure
reinforcement_percentage = Slider(1, range=0..10)
nl_sfb_class_13 = ValueList({"11 Ground": "11", "13A Floors on the ground - Structure": "13A", "13B Floors on the ground - Insulation": "13B", "16 Foundation": "16", "17 Pile foundations": "17", "21A External walls - Structure": "21A", "21B External walls - Insulation": "21B", "22A Internal walls - Structure": "22A", "22B Internal walls - Insulation": "22B", "23A Floors - Structure": "23A"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}, selected="28B Load-bearing structures - Reinforcement": "28B")
division_2 = Division(A=reinforcement_percentage, B=100)
division_3 = Division(ConcreteVolume=create_building_element_12.Volume_m3, B=2)
division_4 = Division(A=division_2, B=2)
create_material_set_13 = CreateMaterialSet(NLSfBClass=nl_sfb_class_13)  # -> MaterialSetData, MaterialNames
center_box = CenterBox(Base=PlaneXY(0, 0, 0), X=division_3, Y=0.5, Z=division_4)
unit_y_2 = UnitY(Factor="500")
move_8 = Move(Geometry=center_box, Motion=unit_y_2)  # -> Geometry, Transform
select_material_13 = SelectMaterial(MaterialSetData=create_material_set_13.MaterialSetData, Index=0)
create_building_element_13 = CreateBuildingElement(
    Name="Structural skeleton - concrete reinforcement",
    NLSfBClass=nl_sfb_class_13,
    MaterialData=select_material_13,
    Geometry=flatten(move_8.Geometry))  # -> BuildingElementData, Area_m2, Volume_m3, Mass_kg
stream_filter_2 = StreamFilter(Gate=material_index_11, Stream1=create_building_element_13.BuildingElementData)

# ----
# Step 1.4: Create building
panel = Panel("My Beautiful Building")
lifespan_years = Slider(50, range=0..150)
# Step 1.5: Responsible material use assessment
create_building = CreateBuilding(
    Name=panel,
    BuildingLifespan_years=lifespan_years,
    BuildingFunction=3,
    GrossFloorArea_m2=create_building_element.Area_m2,
    BuildingElementData=[create_building_element.BuildingElementData, create_building_element_3.BuildingElementData, create_building_element_12.BuildingElementData, stream_filter_2, create_building_element_4.BuildingElementData, create_building_element_5.BuildingElementData, create_building_element_6.BuildingElementData, create_building_element_7.BuildingElementData, create_building_element_8.BuildingElementData, create_building_element_9.BuildingElementData, create_building_element_10.BuildingElementData, create_building_element_11.BuildingElementData])  # -> BuildingData, BuildingInformation, BuildingMaterials, BuildingGeometry

# ----
# Step 2: Set up and run Galapagos
# Galapagos is a single-objective built-in optimisation plugin for Grasshopper. To integrate Wallacei with ReLifecycle you can follow these steps:
# 
# 1. Set the genome: These are the decision variables that influence your design and materialisation. You can use the material selection sliders
# from the "Select Material" components for this if you want to optimise on material. However you can include geometry parameters as well.
# 
# 2. Set the fitness objective: This is the thing you want to optimise. You can set one single objective as fitness function. In this example case we try
# to minimise the MPG.
# 
# 3. Set up and run the simulation in Galapagos to try to find a global optimum!
environmental_impact_assessment = EnvironmentalImpactAssessment(BuildingData=create_building.BuildingData)  # -> TotalResults, DetailedResults, MPG_m2_GFA_year, ParisProof_kg_CO2_eq_m2_GFA, CSC_kg_CO2_eq
circularity_assessment = CircularityAssessment(BuildingData=create_building.BuildingData)  # -> TotalResults, DetailedResults, BCI_, DP_, NewInput, BiobasedInput, RecycledInput, ReusedInput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
financial_impact_assessment = FinancialImpactAssessment(BuildingData=create_building.BuildingData)  # -> TotalResults, DetailedResults, DirectCosts_, MaterialCosts_, LabourCosts_, TruePrice_

# ----
# Double click the Galapagos icon
# to set up and run the simulation
# ← Fitness objective
wlc_1_minimise_mpg = Number(environmental_impact_assessment.MPG_m2_GFA_year)
galapagos = Galapagos(
    fitness=wlc_1_minimise_mpg,
    gene=[material_index, material_index_2, material_index_3, material_index_11, material_index_4, material_index_5, material_index_6, material_index_7, material_index_8, material_index_9, material_index_10])
