# Grasshopper definition relifecycle_example_script_interface.gh (Grasshopper 1.0.8)
# plug-ins: RhinoCodePluginGH, Human UI, Pufferfish, MetaHopper, Wallacei, ReLifeCycleGHPlugin

# ---- group: Parameters
load_bearing_direction = ValueList({"X-Direction": 0, "Y-Direction": 1}, selected="X-Direction")
# Example File - Interface
# Developed by Pim van Rijsbergen
# Step 0: Read Me First!
# Welcome to the ReLifeCycle Demo! This plugin helps you enhance the responsible material use of your parametric building design with environmental impact,
# circularity and financial impact assessments. This demo explains how you can visualise the responsible material use assessment results in the ReLifeCycle
# user-friendly interface!
# 
# To use the ReLifeCycle interface, installation of the following Grasshopper plugins is required:
# - Human UI
# - Metahopper
# 
# If there are any questions, unclarities or if you have feedback you can always reach me on pvanrijsbergen@gmail.com :)
# Step 1: Standard ReLifeCycle workflow
# To find a detailed explanation of this workflow, please refer to the "relifecycle_example_script_getting_started" example script.
# Step 1.1: Create a parametric building script
# PARAMETERS
building_width_m = Slider(4, range=1..10, expression="x*8.4")
building_length_m = Slider(5, range=1..10, expression="x*7.2")
storey_height_m = Slider(3.2, range=2.4..8)
number_of_floors = Slider(6, range=1..50)
window_to_wall_ratio = Slider(0.7, range=0.01..0.98)
column_width_m = Slider(0.3, range=0..1)
beam_height_m = Slider(0.4, range=0..1)

# ---- group: Base surface creation
# CREATE STRUCTURAL GRID
plane_surface = PlaneSurface(Plane=PlaneXY(0, 0, 0), XSize=building_width_m, YSize=building_length_m)
base_surface = Surface(plane_surface)

# ---- group: Create General Grid
unit_x = UnitX(Factor=1)
unit_y = UnitY(Factor=1)
edges_from_directions = EdgesFromDirections(Brep=base_surface, Directions=unit_x, Reflex=True, Angle=0)  # -> simplify(graft(Edges)), Indices, Map
edges_from_directions_2 = EdgesFromDirections(Brep=base_surface, Directions=unit_y, Reflex=True, Angle=0)  # -> simplify(graft(Edges)), Indices, Map
divide_distance = DivideDistance(Curve=edges_from_directions.Edges, Distance=8.4)  # -> simplify(Points), Tangents, Parameters
divide_distance_2 = DivideDistance(Curve=edges_from_directions_2.Edges, Distance=7.2)  # -> simplify(Points), Tangents, Parameters
explode_tree = ExplodeTree(Data=divide_distance.Points)  # -> Branch0, reverse(Branch1)
explode_tree_2 = ExplodeTree(Data=divide_distance_2.Points)  # -> Branch0, reverse(Branch1)
line = Line(StartPoint=explode_tree.Branch0, EndPoint=explode_tree.Branch1)
line_2 = Line(StartPoint=explode_tree_2.Branch0, EndPoint=explode_tree_2.Branch1)

# ---- group: Create Structural Grid
subtraction = Subtraction(StoreyHeight=storey_height_m, BeamHeight=beam_height_m)
multiple_curves = MultipleCurves(Curves=[line, line_2])  # -> Points, IndexA, IndexB, ParamA, ParamB
stream_filter = StreamFilter(Gate=load_bearing_direction, Stream0=line_2, Stream1=line)
unit_z = UnitZ(Factor=subtraction)
move = Move(Geometry=stream_filter, Motion=unit_z)  # -> Geometry, Transform
move_2 = Move(Geometry=multiple_curves.Points, Motion=unit_z)  # -> Geometry, Transform
line_3 = Line(StartPoint=multiple_curves.Points, EndPoint=move_2.Geometry)
load_bearing_vert_lines = Curve(line_3)
load_bearing_hor_lines = Curve(move.Geometry)

# ---- group: Create beams
division = Division(ColumnWidth=column_width_m, B=2)
beam_lines = Line(load_bearing_hor_lines)
extend_curve = ExtendCurve(Curve=beam_lines, Type=0, Start=division, End=division)
column_width = Number(column_width_m)
beam_height = Number(beam_height_m)
perp_frames = PerpFrames(Curve=extend_curve, Count=10, Align=True)  # -> Frames, Parameters
construct_domain = Domain(DomainStart=expr("-x/2", column_width), DomainEnd=expr("x/2", column_width))
negative = Negative(Value=beam_height)
rectangle = Rectangle(Plane=perp_frames.Frames, XSize=negative, YSize=construct_domain, Radius=0)  # -> Rectangle, Length
unit_z_2 = UnitZ(Factor=beam_height_m)
move_3 = Move(Geometry=rectangle.Rectangle, Motion=unit_z_2)  # -> Geometry, Transform
loft = Loft(Curves=move_3.Geometry, Options={Adjust=False, Closed=False, LoftEnds=0, LoftSimp=0, LoftType=0, Rebuild=10, Refit=0.01})
cap_holes = CapHoles(Brep=loft)  # -> flatten(Brep)
beams = Mesh(cap_holes)

# ---- group: Create columns
# CREATE STRUCTURE
column_lines = Line(load_bearing_vert_lines)
column_width_2 = Number(column_width_m)
perp_frames_2 = PerpFrames(Curve=column_lines, Count=10, Align=True)  # -> Frames, Parameters
construct_domain_2 = Domain(DomainStart=expr("-x/2", column_width_2), DomainEnd=expr("x/2", column_width_2))
construct_domain_3 = Domain(DomainStart=expr("-x/2", column_width_2), DomainEnd=expr("x/2", column_width_2))
rectangle_2 = Rectangle(Plane=perp_frames_2.Frames, XSize=construct_domain_2, YSize=construct_domain_3, Radius=0)  # -> Rectangle, Length
loft_2 = Loft(
    Curves=rectangle_2.Rectangle,
    Options={Adjust=False, Closed=False, LoftEnds=0, LoftSimp=0, LoftType=0, Rebuild=10, Refit=0.01})
cap_holes_2 = CapHoles(Brep=loft_2)  # -> flatten(Brep)
columns = Mesh(cap_holes_2)

# ---- group: Create floor
# CREATE FLOORS, ROOF, FACADE AND WINDOWS
columns_2 = Geometry(columns)
bounding_box = BoundingBox(Content=columns_2, Plane=PlaneXY(0, 0, 0), UnionBox=True)  # -> Box, Box_2
deconstruct_brep = DeconstructBrep(Brep=bounding_box.Box)  # -> Faces, Edges, Vertices
list_item = ListItem(List=deconstruct_brep.Faces, Index=4, Wrap=True)  # -> simplify(Item)

# ---- group: Create Multiple Storeys
# Create multiple storeys
length = Length(Curve=load_bearing_vert_lines)
list_item_2 = ListItem(List=length, Index=0, Wrap=True)
addition = Addition(ColumnHeight=list_item_2, BeamHeight=beam_height_m)
series = Series(Start=0, Step=addition, Count=number_of_floors)
unit_z_3 = UnitZ(Factor=series)
beams_2 = Geometry(beams)
move_4 = Move(Geometry=graft(list_item), Motion=unit_z_3)  # -> simplify(Geometry), Transform
move_5 = Move(Geometry=graft(beams_2), Motion=unit_z_3)  # -> simplify(Geometry), Transform
move_6 = Move(Geometry=graft(columns_2), Motion=unit_z_3)  # -> simplify(Geometry), Transform
columns_3 = Geometry(move_6.Geometry)
floor_slabs = Geometry(move_4.Geometry)
beams_3 = Geometry(move_5.Geometry)

# ---- group: Create roof
unit_z_4 = UnitZ(Factor=addition)
list_item_3 = ListItem(List=reverse(floor_slabs), Index=0, Wrap=True)
move_7 = Move(Geometry=list_item_3, Motion=unit_z_4)  # -> simplify(Geometry), Transform
roof_slab = Geometry(move_7.Geometry)

# ---- group: Create facade walls and windows
bounding_box_2 = BoundingBox(Content=flatten([floor_slabs, roof_slab]), Plane=PlaneXY(0, 0, 0), UnionBox=True)  # -> Box, Box_2
deconstruct_brep_2 = DeconstructBrep(Brep=bounding_box_2.Box)  # -> Faces, Edges, Vertices
project = Project(Geometry=flatten(deconstruct_brep_2.Faces), Plane=PlaneXY(0, 0, 0))  # -> Geometry, Transform
area = Area(Geometry=flatten(project.Geometry))  # -> Area, Centroid
equality = Equality(FirstNumber=area.Area, SecondNumber=0)  # -> Equality, Inequality
maximum = Maximum(BuildingWidth=building_width_m, BuildingLength=building_length_m)
cull_pattern = CullPattern(List=deconstruct_brep_2.Faces, CullPattern=equality.Equality)
merge = Merge(Data1=floor_slabs, Data2=roof_slab)  # -> flatten(FloorAndRoofSlabs)
addition_2 = Addition(A=maximum, B=200)
closed_facade_walls = Geometry(cull_pattern)
construct_domain_4 = Domain(DomainStart=expr("-x/2", addition_2), DomainEnd=expr("x/2", addition_2))
construct_domain_5 = Domain(DomainStart=expr("-x/2", addition_2), DomainEnd=expr("x/2", addition_2))
area_2 = Area(Geometry=merge)  # -> Area, Centroid
mesh_brep = MeshBrep(
    Brep=closed_facade_walls,
    Settings={GridMaxCount=0, GridMinCount=16, JaggedSeams=False, MaxEdgeLength=0, MinEdgeLength=0.0001, MinTolerance=0, Refine=True, RefineAngle=0, RelativeTolerance=0.65, SimplePlanes=True, Tolerance=0})
plane_surface_2 = PlaneSurface(Plane=area_2.Centroid, XSize=construct_domain_4, YSize=construct_domain_5)
cull_index = CullIndex(List=plane_surface_2, Indices=0, Wrap=True)
mesh_brep_2 = MeshBrep(
    Brep=cull_index,
    Settings={GridMaxCount=0, GridMinCount=16, JaggedSeams=False, MaxEdgeLength=0, MinEdgeLength=0.0001, MinTolerance=0, Refine=True, RefineAngle=0, RelativeTolerance=0.65, SimplePlanes=True, Tolerance=0})
mesh_split = MeshSplit(Mesh=mesh_brep, Splitters=mesh_brep_2)  # -> simplify(Result)
area_3 = Area(Geometry=mesh_split)  # -> Area, Centroid
scale = Scale(Geometry=mesh_split, Center=area_3.Centroid, Factor=window_to_wall_ratio)  # -> simplify(Geometry), Transform
mesh_join = MeshJoin(Meshes=[mesh_split, scale.Geometry])
mesh_edges = MeshEdges(Mesh=mesh_join)  # -> NakedEdges, InteriorEdges, NonManifoldEdges
join_curves = JoinCurves(Curves=mesh_edges.NakedEdges, Preserve=True)
boundary_surfaces = BoundarySurfaces(Edges=join_curves)
windows = Geometry(flatten(scale.Geometry))
facade_walls = Geometry(flatten(boundary_surfaces))

# ----
# FINAL MODEL
# Final building model
entwine = Entwine(
    Branch00=columns_3,
    Branch01=beams_3,
    Branch02=floor_slabs,
    Branch03=roof_slab,
    Branch04=facade_walls,
    Branch05=windows,
    FlattenInputs=True)
building_model = Geometry(entwine)

# ---- group: Extract building elements
# Step 1.2: Extract building elements
# Extracted building elements
explode_tree_3 = ExplodeTree(Data=building_model)  # -> Branch0, Branch1, Branch2, Branch3, Branch4, Branch5
columns_4 = Geometry(explode_tree_3.Branch0)
beams_4 = Geometry(explode_tree_3.Branch1)
floor_slabs_2 = Geometry(explode_tree_3.Branch2)
roof_slabs = Geometry(explode_tree_3.Branch3)
windows_2 = Geometry(explode_tree_3.Branch5)
facade_walls_2 = Geometry(explode_tree_3.Branch4)

# ---- group: Floors / Floor insulation
# Step 1.3: Create building elements
nl_sfb_class = ValueList({"11 Ground": "11", "13A Floors on the ground - Structure": "13A", "13B Floors on the ground - Insulation": "13B", "16 Foundation": "16", "17 Pile foundations": "17", "21A External walls - Structure": "21A", "21B External walls - Insulation": "21B", "22A Internal walls - Structure": "22A", "22B Internal walls - Insulation": "22B", "23A Floors - Structure": "23A"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}, selected="23A Floors - Structure")
create_material_set = CreateMaterialSet(NLSfBClass=nl_sfb_class)  # -> MaterialSetData, MaterialNames
wlc_1 = Slider(1, range=0..2)
select_material = SelectMaterial(MaterialSetData=create_material_set.MaterialSetData, Index=wlc_1)
create_building_element = CreateBuildingElement(Name="Structural floor slabs", NLSfBClass=nl_sfb_class, MaterialData=select_material, Geometry=flatten(floor_slabs_2))  # -> BuildingElementData, Area_m2, Volume_m3, Mass_kg

# ---- group: Floors
nl_sfb_class_2 = ValueList({"11 Ground": "11", "13A Floors on the ground - Structure": "13A", "13B Floors on the ground - Insulation": "13B", "16 Foundation": "16", "17 Pile foundations": "17", "21A External walls - Structure": "21A", "21B External walls - Insulation": "21B", "22A Internal walls - Structure": "22A", "22B Internal walls - Insulation": "22B", "23A Floors - Structure": "23A"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}, selected="23B Floors - Insulation": "23B")
create_material_set_2 = CreateMaterialSet(NLSfBClass=nl_sfb_class_2)  # -> MaterialSetData, MaterialNames
wlc_2 = Slider(2, range=0..2)
select_material_2 = SelectMaterial(MaterialSetData=create_material_set_2.MaterialSetData, Index=wlc_2)
create_building_element_2 = CreateBuildingElement(Name="Floor insulation", NLSfBClass=nl_sfb_class_2, MaterialData=select_material_2, Geometry=flatten(floor_slabs_2))  # -> BuildingElementData, Area_m2, Volume_m3, Mass_kg

# ---- group: Floors / Floor finishing
nl_sfb_class_3 = ValueList({"11 Ground": "11", "13A Floors on the ground - Structure": "13A", "13B Floors on the ground - Insulation": "13B", "16 Foundation": "16", "17 Pile foundations": "17", "21A External walls - Structure": "21A", "21B External walls - Insulation": "21B", "22A Internal walls - Structure": "22A", "22B Internal walls - Insulation": "22B", "23A Floors - Structure": "23A"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}, selected="43 Floor finishes": "43")
create_material_set_3 = CreateMaterialSet(NLSfBClass=nl_sfb_class_3)  # -> MaterialSetData, MaterialNames
wlc_3 = Slider(0, range=0..2)
select_material_3 = SelectMaterial(MaterialSetData=create_material_set_3.MaterialSetData, Index=wlc_3)
create_building_element_3 = CreateBuildingElement(Name="Floor finishing", NLSfBClass=nl_sfb_class_3, MaterialData=select_material_3, Geometry=flatten(floor_slabs_2))  # -> BuildingElementData, Area_m2, Volume_m3, Mass_kg

# ---- group: Facade walls / Facade walls structure
nl_sfb_class_4 = ValueList({"11 Ground": "11", "13A Floors on the ground - Structure": "13A", "13B Floors on the ground - Insulation": "13B", "16 Foundation": "16", "17 Pile foundations": "17", "21A External walls - Structure": "21A", "21B External walls - Insulation": "21B", "22A Internal walls - Structure": "22A", "22B Internal walls - Insulation": "22B", "23A Floors - Structure": "23A"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}, selected="21A External walls - Structure")
create_material_set_4 = CreateMaterialSet(NLSfBClass=nl_sfb_class_4)  # -> MaterialSetData, MaterialNames
wlc_5 = Slider(2, range=0..2)
select_material_4 = SelectMaterial(MaterialSetData=create_material_set_4.MaterialSetData, Index=wlc_5)
create_building_element_4 = CreateBuildingElement(
    Name="Facade walls structure",
    NLSfBClass=nl_sfb_class_4,
    MaterialData=select_material_4,
    Geometry=flatten(facade_walls_2))  # -> BuildingElementData, Area_m2, Volume_m3, Mass_kg

# ---- group: Facade walls / Facade walls insulation
nl_sfb_class_5 = ValueList({"11 Ground": "11", "13A Floors on the ground - Structure": "13A", "13B Floors on the ground - Insulation": "13B", "16 Foundation": "16", "17 Pile foundations": "17", "21A External walls - Structure": "21A", "21B External walls - Insulation": "21B", "22A Internal walls - Structure": "22A", "22B Internal walls - Insulation": "22B", "23A Floors - Structure": "23A"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}, selected="21B External walls - Insulation")
create_material_set_5 = CreateMaterialSet(NLSfBClass=nl_sfb_class_5)  # -> MaterialSetData, MaterialNames
wlc_6 = Slider(2, range=0..2)
select_material_5 = SelectMaterial(MaterialSetData=create_material_set_5.MaterialSetData, Index=wlc_6)
create_building_element_5 = CreateBuildingElement(
    Name="Facade walls insulation",
    NLSfBClass=nl_sfb_class_5,
    MaterialData=select_material_5,
    Geometry=flatten(facade_walls_2))  # -> BuildingElementData, Area_m2, Volume_m3, Mass_kg

# ---- group: Facade walls / Facade walls cladding
nl_sfb_class_6 = ValueList({"11 Ground": "11", "13A Floors on the ground - Structure": "13A", "13B Floors on the ground - Insulation": "13B", "16 Foundation": "16", "17 Pile foundations": "17", "21A External walls - Structure": "21A", "21B External walls - Insulation": "21B", "22A Internal walls - Structure": "22A", "22B Internal walls - Insulation": "22B", "23A Floors - Structure": "23A"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}, selected="41 External wall finishes": "41")
create_material_set_6 = CreateMaterialSet(NLSfBClass=nl_sfb_class_6)  # -> MaterialSetData, MaterialNames
wlc_7 = Slider(1, range=0..2)
select_material_6 = SelectMaterial(MaterialSetData=create_material_set_6.MaterialSetData, Index=wlc_7)
create_building_element_6 = CreateBuildingElement(
    Name="Facade walls cladding",
    NLSfBClass=nl_sfb_class_6,
    MaterialData=select_material_6,
    Geometry=flatten(facade_walls_2))  # -> BuildingElementData, Area_m2, Volume_m3, Mass_kg

# ---- group: Windows / Window frames
nl_sfb_class_7 = ValueList({"11 Ground": "11", "13A Floors on the ground - Structure": "13A", "13B Floors on the ground - Insulation": "13B", "16 Foundation": "16", "17 Pile foundations": "17", "21A External walls - Structure": "21A", "21B External walls - Insulation": "21B", "22A Internal walls - Structure": "22A", "22B Internal walls - Insulation": "22B", "23A Floors - Structure": "23A"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}, selected="31A External wall openings - Windows (frames)": "31A")
create_material_set_7 = CreateMaterialSet(NLSfBClass=nl_sfb_class_7)  # -> MaterialSetData, MaterialNames
wlc_8 = Slider(1, range=0..2)
select_material_7 = SelectMaterial(MaterialSetData=create_material_set_7.MaterialSetData, Index=wlc_8)
create_building_element_7 = CreateBuildingElement(Name="Window frames", NLSfBClass=nl_sfb_class_7, MaterialData=select_material_7, Geometry=flatten(windows_2))  # -> BuildingElementData, Area_m2, Volume_m3, Mass_kg

# ---- group: Windows / Window glazing
nl_sfb_class_8 = ValueList({"11 Ground": "11", "13A Floors on the ground - Structure": "13A", "13B Floors on the ground - Insulation": "13B", "16 Foundation": "16", "17 Pile foundations": "17", "21A External walls - Structure": "21A", "21B External walls - Insulation": "21B", "22A Internal walls - Structure": "22A", "22B Internal walls - Insulation": "22B", "23A Floors - Structure": "23A"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}, selected="31B External wall openings - Windows (glazing)": "31B")
create_material_set_8 = CreateMaterialSet(NLSfBClass=nl_sfb_class_8)  # -> MaterialSetData, MaterialNames
select_material_8 = SelectMaterial(MaterialSetData=create_material_set_8.MaterialSetData, Index=0)
create_building_element_8 = CreateBuildingElement(Name="Window glazing", NLSfBClass=nl_sfb_class_8, MaterialData=select_material_8, Geometry=flatten(windows_2))  # -> BuildingElementData, Area_m2, Volume_m3, Mass_kg

# ---- group: Roof / Structural roof slabs
nl_sfb_class_9 = ValueList({"11 Ground": "11", "13A Floors on the ground - Structure": "13A", "13B Floors on the ground - Insulation": "13B", "16 Foundation": "16", "17 Pile foundations": "17", "21A External walls - Structure": "21A", "21B External walls - Insulation": "21B", "22A Internal walls - Structure": "22A", "22B Internal walls - Insulation": "22B", "23A Floors - Structure": "23A"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}, selected="27A Roofs - Structure": "27A")
create_material_set_9 = CreateMaterialSet(NLSfBClass=nl_sfb_class_9)  # -> MaterialSetData, MaterialNames
wlc_9 = Slider(1, range=0..2)
select_material_9 = SelectMaterial(MaterialSetData=create_material_set_9.MaterialSetData, Index=wlc_9)
create_building_element_9 = CreateBuildingElement(Name="Structural roof slabs", NLSfBClass=nl_sfb_class_9, MaterialData=select_material_9, Geometry=flatten(roof_slabs))  # -> BuildingElementData, Area_m2, Volume_m3, Mass_kg

# ---- group: Roof / Roof insulation
nl_sfb_class_10 = ValueList({"11 Ground": "11", "13A Floors on the ground - Structure": "13A", "13B Floors on the ground - Insulation": "13B", "16 Foundation": "16", "17 Pile foundations": "17", "21A External walls - Structure": "21A", "21B External walls - Insulation": "21B", "22A Internal walls - Structure": "22A", "22B Internal walls - Insulation": "22B", "23A Floors - Structure": "23A"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}, selected="27B Roofs - Insulation": "27B")
create_material_set_10 = CreateMaterialSet(NLSfBClass=nl_sfb_class_10)  # -> MaterialSetData, MaterialNames
wlc_10 = Slider(2, range=0..2)
select_material_10 = SelectMaterial(MaterialSetData=create_material_set_10.MaterialSetData, Index=wlc_10)
create_building_element_10 = CreateBuildingElement(Name="Roof insulation", NLSfBClass=nl_sfb_class_10, MaterialData=select_material_10, Geometry=flatten(roof_slabs))  # -> BuildingElementData, Area_m2, Volume_m3, Mass_kg

# ---- group: Roof / Roof finishing
nl_sfb_class_11 = ValueList({"11 Ground": "11", "13A Floors on the ground - Structure": "13A", "13B Floors on the ground - Insulation": "13B", "16 Foundation": "16", "17 Pile foundations": "17", "21A External walls - Structure": "21A", "21B External walls - Insulation": "21B", "22A Internal walls - Structure": "22A", "22B Internal walls - Insulation": "22B", "23A Floors - Structure": "23A"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}, selected="47 Roof finishes": "47")
create_material_set_11 = CreateMaterialSet(NLSfBClass=nl_sfb_class_11)  # -> MaterialSetData, MaterialNames
wlc_11 = Slider(2, range=0..2)
select_material_11 = SelectMaterial(MaterialSetData=create_material_set_11.MaterialSetData, Index=wlc_11)
create_building_element_11 = CreateBuildingElement(Name="Roof finishing", NLSfBClass=nl_sfb_class_11, MaterialData=select_material_11, Geometry=flatten(roof_slabs))  # -> BuildingElementData, Area_m2, Volume_m3, Mass_kg

# ---- group: Structural skeleton / Columns and beams
nl_sfb_class_12 = ValueList({"11 Ground": "11", "13A Floors on the ground - Structure": "13A", "13B Floors on the ground - Insulation": "13B", "16 Foundation": "16", "17 Pile foundations": "17", "21A External walls - Structure": "21A", "21B External walls - Insulation": "21B", "22A Internal walls - Structure": "22A", "22B Internal walls - Insulation": "22B", "23A Floors - Structure": "23A"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}, selected="28A Load-bearing structures - General": "28A")
create_material_set_12 = CreateMaterialSet(NLSfBClass=nl_sfb_class_12)  # -> MaterialSetData, MaterialNames
wlc_4 = Slider(1, range=0..2)
select_material_12 = SelectMaterial(MaterialSetData=create_material_set_12.MaterialSetData, Index=wlc_4)
create_building_element_12 = CreateBuildingElement(
    Name="Structural skeleton",
    NLSfBClass=nl_sfb_class_12,
    MaterialData=select_material_12,
    Geometry=flatten([columns_4, beams_4]))  # -> BuildingElementData, Area_m2, Volume_m3, Mass_kg

# ---- group: Structural skeleton / Reinforcement in case of concrete structure
reinforcement_percentage = Slider(1, range=0..10)
nl_sfb_class_13 = ValueList({"11 Ground": "11", "13A Floors on the ground - Structure": "13A", "13B Floors on the ground - Insulation": "13B", "16 Foundation": "16", "17 Pile foundations": "17", "21A External walls - Structure": "21A", "21B External walls - Insulation": "21B", "22A Internal walls - Structure": "22A", "22B Internal walls - Insulation": "22B", "23A Floors - Structure": "23A"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}, selected="28B Load-bearing structures - Reinforcement": "28B")
division_2 = Division(A=reinforcement_percentage, B=100)
division_3 = Division(ConcreteVolume=create_building_element_12.Volume_m3, B=2)
division_4 = Division(A=division_2, B=2)
create_material_set_13 = CreateMaterialSet(NLSfBClass=nl_sfb_class_13)  # -> MaterialSetData, MaterialNames
center_box = CenterBox(Base=PlaneXY(0, 0, 0), X=division_3, Y=0.5, Z=division_4)
unit_y_2 = UnitY(Factor="500")
move_8 = Move(Geometry=center_box, Motion=unit_y_2)  # -> Geometry, Transform
select_material_13 = SelectMaterial(MaterialSetData=create_material_set_13.MaterialSetData, Index=0)
create_building_element_13 = CreateBuildingElement(
    Name="Structural skeleton - concrete reinforcement",
    NLSfBClass=nl_sfb_class_13,
    MaterialData=select_material_13,
    Geometry=flatten(move_8.Geometry))  # -> BuildingElementData, Area_m2, Volume_m3, Mass_kg
stream_filter_2 = StreamFilter(Gate=wlc_4, Stream1=create_building_element_13.BuildingElementData)

# ----
# Step 1.4: Create building
panel = Panel("My Beautiful Building")
lifespan_years = Slider(50, range=0..150)
# Step 1.5: Responsible material use assessment
create_building = CreateBuilding(
    Name=panel,
    BuildingLifespan_years=lifespan_years,
    BuildingFunction=3,
    GrossFloorArea_m2=create_building_element.Area_m2,
    BuildingElementData=[create_building_element.BuildingElementData, create_building_element_3.BuildingElementData, create_building_element_12.BuildingElementData, stream_filter_2, create_building_element_4.BuildingElementData, create_building_element_5.BuildingElementData, create_building_element_6.BuildingElementData, create_building_element_7.BuildingElementData, create_building_element_8.BuildingElementData, create_building_element_9.BuildingElementData, create_building_element_10.BuildingElementData, create_building_element_11.BuildingElementData])  # -> BuildingData, BuildingInformation, BuildingMaterials, BuildingGeometry

environmental_impact_assessment = EnvironmentalImpactAssessment(BuildingData=create_building.BuildingData)  # -> TotalResults, DetailedResults, MPG_m2_GFA_year, ParisProof_kg_CO2_eq_m2_GFA, CSC_kg_CO2_eq
circularity_assessment = CircularityAssessment(BuildingData=create_building.BuildingData)  # -> TotalResults, DetailedResults, BCI_, DP_, NewInput, BiobasedInput, RecycledInput, ReusedInput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
financial_impact_assessment = FinancialImpactAssessment(BuildingData=create_building.BuildingData)  # -> TotalResults, DetailedResults, DirectCosts_, MaterialCosts_, LabourCosts_, TruePrice_

# ----
# Wallacei integration
wallacei_genomes = Data()
wallacei_phenotypes = Data()

# ----
# Environmental impact
environmental_impact_total_results = Data(environmental_impact_assessment.TotalResults)
environmental_impact_detailed_results = Data(environmental_impact_assessment.DetailedResults)

# ----
# General info
building_materials = Data(simplify(create_building.BuildingMaterials))
# Step 2: Connect to interface
# If you want to visualise the assessment results in a more efficient way, you can use the ReLifeCycle interface made with Human UI and Metahopper.
# To connect the results to the interface, drag the "Total Results" and "Detailed Results" outputs of the used assessment components to their corresponding
# data items below. If you integrate ReLifeCycle with the Wallacei optimisation plugin, you can also link the Wallacei exported solutions to compare variants
# in the interface. Check the "relifecycle_example_wallacei_integration" file for this. If you've linked everything you want, set the boolean toggle to "True" to run
# the interface!
building_information = Data(simplify(create_building.BuildingInformation))

# ----
# Circularity
circularity_total_results = Data(circularity_assessment.TotalResults)
circularity_detailed_results = Data(circularity_assessment.DetailedResults)

# ----
# Financial impact
financial_impact_total_results = Data(financial_impact_assessment.TotalResults)
financial_impact_detailed_results = Data(financial_impact_assessment.DetailedResults)

# ----
# Set to "True" to run interface!
launch_results_interface = BooleanToggle(False)

# ---- group: Collect wallacei genome
decode_genome = DecodeGenome(WallaceiGenome=wallacei_genomes)  # -> simplify(GeneList)
tree_statistics = TreeStatistics(Tree=wallacei_phenotypes)  # -> Paths, Length, Count
tree_branch = TreeBranch(Tree=decode_genome, Path=tree_statistics.Paths, MaintainPaths=True)  # -> simplify(GeneList)

# ---- group: Top captions
# RELIFECYCLE RESULTS WINDOW
headliner = CreateLabel(LabelText="OVERVIEW RESULTS", LabelSize=24, Justification=0)
label = CreateLabel(LabelText=" ", LabelSize=18, Justification=0)
list_item_4 = ListItem(List=flatten(building_information), Index=1, Wrap=True)
merge_2 = Merge(Data1=headliner, Data2=label)
setlabel = SetLabelContents(LabelToModify=label, NewLabelContents=list_item_4)

# ---- group: General information heading
label_2 = CreateLabel(LabelText="GENERAL INFORMATION", LabelSize=18, Justification=0)
separator = CreateSeparator(Thickness=10, Horizontal=True, Color=RGBA(255, 255, 255, 0))
merge_3 = Merge(Data1=label_2, Data2=separator)

# ---- group: Toggles / HNN toggle
# HNN toggle
create_toggle = CreateToggle(Default=False, Label="Compare with HNN")
separator_2 = CreateSeparator(Thickness=10, Horizontal=True, Color=RGBA(255, 255, 255, 0))
panel_2 = Panel("Set results against the performance levels of Het Nieuwe Normaal (HNN)")
create_stack = CreateStack(UIElements=[separator_2, create_toggle], Horizontal=False)
value_listener = ValueListener(Elements=create_toggle, SomeProperty=True)  # -> Values, Indices
tooltip = AttachTooltipToElement(ElementsToAttachTo=create_toggle, TooltipContent=panel_2, ShowDelay=500, Duration=100000)

# ---- group: Toggles / Live updates toggle
# Live updates toggle
create_toggle_2 = CreateToggle(Default=True, Label="Live updates")
separator_3 = CreateSeparator(Thickness=10, Horizontal=True, Color=RGBA(255, 255, 255, 0))
value_listener_2 = ValueListener(Elements=create_toggle_2, SomeProperty=True)  # -> Values, Indices
create_stack_2 = CreateStack(UIElements=[separator_3, create_toggle_2], Horizontal=False)
tooltip_2 = AttachTooltipToElement(
    ElementsToAttachTo=create_toggle_2,
    TooltipContent="Turn off for faster model transformation",
    ShowDelay=500,
    Duration=100000)

# ---- group: Collect total and detailed assessment results
# Human UI + Metahopper interface script
# RELIFECYCLE INTERFACE SETUP
# Results
entwine_2 = Entwine(
    Branch0X=environmental_impact_total_results,
    Branch1X=circularity_total_results,
    Branch2X=financial_impact_total_results,
    FlattenInputs=False)
entwine_3 = Entwine(
    Branch0X=environmental_impact_detailed_results,
    Branch1X=circularity_detailed_results,
    Branch2X=financial_impact_detailed_results,
    FlattenInputs=False)
stream_gate = StreamGate(Stream=entwine_2, Gate=value_listener_2.Values)  # -> Target0, Target1
stream_gate_2 = StreamGate(Stream=entwine_3, Gate=value_listener_2.Values)  # -> Target0, Target1

# ---- group: Environmental Impact Total Results / Environmental impact heading
# Environmental impact heading
label_3 = CreateLabel(LabelText="ENVIRONMENTAL IMPACT", LabelSize=18, Justification=0)
separator_4 = CreateSeparator(Thickness=10, Horizontal=True, Color=RGBA(255, 255, 255, 0))
separator_5 = CreateSeparator(Thickness=10, Horizontal=True, Color=RGBA(255, 255, 255, 0))
colour_swatch = ColourSwatch(SwatchColor=RGB(42, 91, 115))
adjust_element_appearance = AdjustElementAppearance(
    ElementsToAdjust=label_3,
    Foreground=ColourSwatch(SwatchColor=RGB(255, 255, 255)),
    Background=ColourSwatch(SwatchColor=RGB(42, 91, 115)))
merge_4 = Merge(Data1=separator_4, Data2=label_3, Data3=separator_5)

# ---- group: Total circularity results / Circularity heading
# Circularity heading
label_4 = CreateLabel(LabelText="CIRCULARITY", LabelSize=18, Justification=0)
separator_6 = CreateSeparator(Thickness=4, Horizontal=True, Color=RGBA(255, 255, 255, 0))
separator_7 = CreateSeparator(Thickness=10, Horizontal=True, Color=RGBA(255, 255, 255, 0))
adjust_element_appearance_2 = AdjustElementAppearance(
    ElementsToAdjust=label_4,
    Foreground=ColourSwatch(SwatchColor=RGB(255, 255, 255)),
    Background=ColourSwatch(SwatchColor=RGB(77, 137, 116)))
merge_5 = Merge(Data1=separator_6, Data2=label_4, Data3=separator_7)

# ---- group: Building materials list
building_materials_2 = Data(building_materials)
list_item_5 = ListItem(List=building_materials_2, Index=0, Wrap=True)  # -> Item, Item1, Item2, Item3
panel_3 = Panel("""11 GROUND
13A FLOORS ON THE GROUND - STRUCTURE
13B FLOORS ON THE GROUND - INSULATION
16 FOUNDATION
17 PILE FOUNDATIONS
21A EXTERNAL WALLS - STRUCTURE
21B EXTERNAL WALLS - INSULATION
22A INTERNAL WALLS - STRUCTURE
22B INTERNAL WALLS - INSULATION
23A FLOORS - STRUCTURE
23B FLOORS - INSULATION
24 STAIRS AND RAMPS
27A ROOFS - STRUCTURE
27B ROOFS - INSULATION
28A LOAD-BEARING STRUCTURES - GENERAL
28B LOAD-BEARING STRUCTURES - REINFORCEMENT
31A EXTERNAL WALL OPENINGS - WINDOWS (FRAMES
31B EXTERNAL WALL OPENINGS - WINDOWS (GLAZING
31C EXTERNAL WALL OPENINGS - DOORS
32A INTERNAL WALL OPENINGS - WINDOWS (FRAMES)
32B INTERNAL WALL OPENINGS - WINDOWS (GLAZING)
32C INTERNAL WALL OPENINGS - DOORS
33A FLOOR OPENINGS - WINDOWS (FRAMES)
33B FLOOR OPENINGS - WINDOWS (GLAZING)
34 STAIR BALUSTRADES AND HANDRAILS
37A ROOF OPENINGS - WINDOWS (FRAMES)
37B ROOF OPENINGS - WINDOWS (GLAZING)
41 EXTERNAL WALL FINISHES
42 INTERNAL WALL FINISHES
43 FLOOR FINISHES
44 STAIR AND RAMP FINISHES
45 CEILING FINISHES
47 ROOF FINISHES""")
panel_4 = Panel("""11
13A
13B
16
17
21A
21B
22A
22B
23A
23B
24
27A
27B
28A
28B
31A
31B
31C
32A
32B
32C
33A
33B
34
37A
37B
41
42
43
44
45
47""")
match_text = MatchText(Text=list_item_5.Item, Pattern=panel_4, Case=True)
graft_tree = GraftTree(Tree=panel_3, IncludeEmptyLists=True, IncludeNullItems=True)  # -> simplify(Tree)
label_5 = CreateLabel(LabelText=graft(""), LabelSize=12, Justification=0)  # -> simplify(Label)
label_6 = CreateLabel(LabelText=graft(""), LabelSize=12, Justification=0)  # -> simplify(Material)
concatenate = Concatenate(FragmentA=list_item_5.Item2, FragmentB=":")
flip_matrix = FlipMatrix(Data=match_text)
label_7 = CreateLabel(LabelText=graft_tree, LabelSize=12, Justification=0)
stack = CreateStack(UIElements=[label_5, label_6], Horizontal=True)
cull_pattern_2 = CullPattern(List=flatten(list_item_5.Item3), CullPattern=flip_matrix)
cull_pattern_3 = CullPattern(List=flatten(concatenate), CullPattern=flip_matrix)
text_join = TextJoin(Text=cull_pattern_3)
text_join_2 = TextJoin(Text=cull_pattern_2)
create_stack_3 = CreateStack(UIElements=[label_7, stack], Horizontal=False)  # -> flatten(Stack)
list_length = ListLength(List=cull_pattern_3)
set_label_contents = SetLabelContents(LabelToModify=label_5, NewLabelContents=text_join)
set_label_contents_2 = SetLabelContents(LabelToModify=label_6, NewLabelContents=text_join_2)
equality_2 = Equality(FirstNumber=list_length, SecondNumber=0)  # -> Equality, flatten(Inequality)
hide_show_element = HideShowElement(ElementToHideShow=create_stack_3, Show=equality_2.Inequality, Collapse=True, Disable=False)
separator_8 = CreateSeparator(Thickness=10, Horizontal=True, Color=RGBA(255, 255, 255, 0))
expander = CreateExpander(UIElements=create_stack_3, Header="Building Materials", Open=False)

# ---- group: Total circularity results
total_results = Data(stream_gate.Target1)
split_tree = SplitTree(Data=total_results, Masks=flatten("{1;?}"))  # -> TotalCircularity, Negative
list_item_6 = ListItem(List=split_tree.TotalCircularity, Index=1, Wrap=True)
round = Round(Number=list_item_6)  # -> Nearest, Floor, Ceiling
explode_tree_4 = ExplodeTree(Data=round.Nearest)  # -> Branch0, Branch1, Branch2, Branch3, Branch4, Branch5, Branch6, Branch7, Branch8, Branch9

# ---- group: Environmental Impact Total Results / Total environmental impact results
# Total environmental impact results
total_results_2 = Data(stream_gate.Target1)
split_tree_2 = SplitTree(Data=total_results_2, Masks=flatten(["{0;0}", "{0;1}", "{0;2}"]))  # -> TotalEnvironmentalImpact, Negative
list_item_7 = ListItem(List=split_tree_2.TotalEnvironmentalImpact, Index=1, Wrap=True)
explode_tree_5 = ExplodeTree(Data=list_item_7)  # -> Branch0, Branch1, Branch2
division_5 = Division(A=explode_tree_5.Branch2, B=1000)
expression = Expression(x=explode_tree_5.Branch0, Expression="Format(\"{0:0.000}\",x)")
expression_2 = Expression(x=division_5, Expression="Format(\"{0:0.00}\",x)")
expression_3 = Expression(x=explode_tree_5.Branch1, Expression="Format(\"{0:0.00}\",x)")

# ---- group: Toggles
separator_9 = CreateSeparator(Thickness=60, Horizontal=False, Color=RGBA(255, 255, 255, 0))
create_stack_4 = CreateStack(UIElements=[create_stack, separator_9, create_stack_2], Horizontal=True)

# ---- group: Interface Windows
# Interface windows
get_screen_dimensions = GetScreenDimensions()  # -> Width, Height
division_6 = Division(A=get_screen_dimensions.Width, B=3)
subtraction_2 = Subtraction(A=get_screen_dimensions.Width, B=division_6)
subtraction_3 = Subtraction(A=get_screen_dimensions.Height, B=48)

# ---- group: Total circularity results / BCI
# BCI
panel_5 = Panel("0")
total_bci = Data(explode_tree_4.Branch0)
label_8 = CreateLabel(LabelText="BCI", LabelSize=18, Justification=0)
chart = CreateChart(Data=panel_5, Title="BCI", ChartType=4)
setchart = SetChartContents(ChartToModify=chart, NewChartValues=total_bci)
adjustpos = AdjustElementPositioning(ElementsToAdjust=label_8, AbsolutePositioning=False, HorizontalAlignment=0)
chartappearance = ChartAppearance(ChartToModify=chart, Colors=ColourSwatch(SwatchColor=RGB(77, 137, 116)), Legend=False, Title=False)
adjustelem = AdjustElementAppearance(ElementsToAdjust=chart, Background=RGBA(255, 255, 255, 0))
viewbox = CreateViewBox(UIElements=chart, Width=Slider(120, range=0..1000), Height=Slider(219, range=0..1000))
adjust_element_positioning = AdjustElementPositioning(ElementsToAdjust=viewbox, Margin="-20,-70,0,-40", AbsolutePositioning=False)
stack_2 = CreateStack(UIElements=[label_8, viewbox], Horizontal=False)
panel_6 = Panel("Building Circularity Indicator from 10% (fully linear) to 100% (fully circular)")
tooltip_3 = AttachTooltipToElement(ElementsToAttachTo=stack_2, TooltipContent=panel_6, ShowDelay=500, Duration=100000)

# ---- group: Total circularity results / Material output
# Material output
colour_swatch_2 = ColourSwatch(SwatchColor=RGB(77, 137, 116))
colour_swatch_3 = ColourSwatch(SwatchColor=RGB(163, 21, 21))
colour_swatch_4 = ColourSwatch(SwatchColor=RGB(127, 127, 127))
merge_6 = Merge(Data1=explode_tree_4.Branch6, Data2=explode_tree_4.Branch7, Data3=explode_tree_4.Branch8, Data4=explode_tree_4.Branch9)  # -> flatten(MaterialOutput)
panel_7 = Panel("""%Landfill
%Burning
%Recycling
%Reusing""")
label_9 = CreateLabel(LabelText="Material Output", LabelSize=18, Justification=0)
chart_2 = CreateChart(Data=0, Names=" ", Title=" ", ChartType=0)
setchart_2 = SetChartContents(ChartToModify=chart_2, NewChartValues=merge_6, NewChartNames=panel_7)
chart_appearance = ChartAppearance(
    ChartToModify=chart_2,
    Colors=[colour_swatch_2, ColourSwatch(SwatchColor=RGB(141, 191, 174)), ColourSwatch(SwatchColor=RGB(179, 212, 201)), ColourSwatch(SwatchColor=RGB(217, 234, 228))],
    Legend=True,
    Title=False)
adjustelem_2 = AdjustElementAppearance(ElementsToAdjust=chart_2, Background=RGBA(255, 255, 255, 0))
stack_3 = CreateStack(UIElements=[label_9, chart_2], Horizontal=False)
panel_8 = Panel("Material output flows, as percentages of building mass, normalized by MKI.")
adjust_element_positioning_2 = AdjustElementPositioning(
    ElementsToAdjust=chart_2,
    Margin="-7,-45,-10,-10",
    AbsolutePositioning=False,
    Width=Slider(162, range=100..300),
    Height=Slider(205, range=0..1000))
tooltip_4 = AttachTooltipToElement(ElementsToAttachTo=stack_3, TooltipContent=panel_8, ShowDelay=500, Duration=100000)

# ---- group: Environmental Impact Total Results / CSC
# CSC
number_slider = Slider(29, range=0..100)
label_size = Slider(15, range=0..100)
label_10 = CreateLabel(LabelText="CSC", LabelSize=18, Justification=0)
label_11 = CreateLabel(LabelText=" ", LabelSize=number_slider, Justification=0)
label_12 = CreateLabel(LabelText="tonnes CO2", LabelSize=label_size, Justification=0)
setlabel_2 = SetLabelContents(LabelToModify=label_11, NewLabelContents=expression_2)
stack_4 = CreateStack(UIElements=[label_10, label_11, label_12], Horizontal=False)
adjustelem_3 = AdjustElementAppearance(ElementsToAdjust=[label_11, label_12], Foreground=ColourSwatch(SwatchColor=RGB(42, 91, 115)))
tooltip_5 = AttachTooltipToElement(ElementsToAttachTo=stack_4, TooltipContent="Construction Stored Carbon", ShowDelay=500, Duration=100000)

# ---- group: Environmental Impact Total Results / Data source
# Data source
create_label = CreateLabel(LabelText="Data Source: NMD", LabelSize=8, Justification=0)
separator_10 = CreateSeparator(Thickness=5, Horizontal=True, Color=RGBA(255, 255, 255, 0))
data_source = Merge(Data1=separator_10, Data2=create_label)

# ---- group: Total circularity results / Data source
# Data source
create_label_2 = CreateLabel(LabelText="Data Source: NIBE", LabelSize=8, Justification=0)
separator_11 = CreateSeparator(Thickness=5, Horizontal=True, Color=RGBA(255, 255, 255, 0))
data_source_2 = Merge(Data1=separator_11, Data2=create_label_2)

# ---- group: Financial impact / Financial impact heading
# Financial impact heading
label_13 = CreateLabel(LabelText="FINANCIAL IMPACT", LabelSize=18, Justification=0)
separator_12 = CreateSeparator(Thickness=4, Horizontal=True, Color=RGBA(255, 255, 255, 0))
adjust_element_appearance_3 = AdjustElementAppearance(
    ElementsToAdjust=label_13,
    Foreground=ColourSwatch(SwatchColor=RGB(255, 255, 255)),
    Background=ColourSwatch(SwatchColor=RGB(245, 200, 61)))
merge_7 = Merge(Data1=separator_12, Data2=label_13)

# ---- group: Financial impact / Total financial impact results
# Total financial impact results
total_results_3 = Data(stream_gate.Target1)
split_tree_3 = SplitTree(Data=total_results_3, Masks=flatten("{2;?}"))  # -> TotalFinancialImpact, Negative
list_item_8 = ListItem(List=split_tree_3.TotalFinancialImpact, Index=1, Wrap=True)
explode_tree_6 = ExplodeTree(Data=list_item_8)  # -> Branch0, Branch1, Branch2, Branch3, Branch4
expression_4 = Expression(x=explode_tree_6.Branch0, Expression="Format(\"{0:0}\",x)")
expression_5 = Expression(x=explode_tree_6.Branch1, Expression="Format(\"{0:0}\",x)")
expression_6 = Expression(x=explode_tree_6.Branch2, Expression="Format(\"{0:0}\",x)")
expression_7 = Expression(x=explode_tree_6.Branch3, Expression="Format(\"{0:0}\",x)")
expression_8 = Expression(x=explode_tree_6.Branch4, Expression="Format(\"{0:0}\",x)")
number = Number(expression_4)
number_2 = Number(expression_5)
number_3 = Number(expression_6)
number_4 = Number(expression_7)
number_5 = Number(expression_8)
thousand_point_separator = CSharpScript(x=number)  # -> a
# ---------- thousand_point_separator: C# ----------
// Grasshopper Script Instance
#region Usings
using System;
using System.Linq;
using System.Collections;
using System.Collections.Generic;
using System.Drawing;

using Rhino;
using Rhino.Geometry;

using Grasshopper;
using Grasshopper.Kernel;
using Grasshopper.Kernel.Data;
using Grasshopper.Kernel.Types;
#endregion

public class Script_Instance : GH_ScriptInstance
{
    #region Notes
    /* 
      Members:
        RhinoDoc RhinoDocument
        GH_Document GrasshopperDocument
        IGH_Component Component
        int Iteration

      Methods (Virtual & overridable):
        Print(string text)
        Print(string format, params object[] args)
        Reflect(object obj)
        Reflect(object obj, string method_name)
    */
    #endregion

    private void RunScript(object x, ref object a)
    {
        // Input validation
        if (!(x is double number))
        {
            Component.AddRuntimeMessage(GH_RuntimeMessageLevel.Error, "Input must be a number.");
            return;
        }

        // Round the number to the nearest integer
        int roundedNumber = (int)Math.Round(number);

        // Format the number with thousand separators
        a = roundedNumber.ToString("N0", System.Globalization.CultureInfo.InvariantCulture);
    }
}
# ---------- end thousand_point_separator ----------
thousand_point_separator_2 = CSharpScript(x=number_2)  # -> a; same code as thousand_point_separator
thousand_point_separator_3 = CSharpScript(x=number_3)  # -> a; same code as thousand_point_separator
thousand_point_separator_4 = CSharpScript(x=number_4)  # -> a; same code as thousand_point_separator
thousand_point_separator_5 = CSharpScript(x=number_5)  # -> a; same code as thousand_point_separator
format = Format(
    Format="€{0}.-",
    Culture=127,
    Data0=[thousand_point_separator, thousand_point_separator_2, thousand_point_separator_3, thousand_point_separator_4, thousand_point_separator_5])  # -> simplify(Text)
explode_tree_7 = ExplodeTree(Data=format)  # -> Branch0, Branch1, Branch2, Branch3, Branch4

# ---- group: Colour Palette
colour_swatch_5 = ColourSwatch(SwatchColor=RGB(255, 255, 255))
colour_swatch_6 = ColourSwatch(SwatchColor=RGB(0, 0, 0))
colour_swatch_7 = ColourSwatch(SwatchColor=RGB(127, 127, 127))
transparent_white = ColourSwatch(SwatchColor=RGBA(255, 255, 255, 0))
transparent_black = ColourSwatch(SwatchColor=RGBA(0, 0, 0, 0))
colour_swatch_8 = ColourSwatch(SwatchColor=RGBA(180, 34, 79, 239))
colour_swatch_9 = ColourSwatch(SwatchColor=RGB(219, 67, 114))
colour_swatch_10 = ColourSwatch(SwatchColor=RGB(233, 142, 170))
colour_swatch_11 = ColourSwatch(SwatchColor=RGB(233, 180, 199))
colour_swatch_12 = ColourSwatch(SwatchColor=RGBA(49, 186, 184, 239))
colour_swatch_13 = ColourSwatch(SwatchColor=RGB(124, 221, 219))
colour_swatch_14 = ColourSwatch(SwatchColor=RGB(168, 232, 231))
colour_swatch_15 = ColourSwatch(SwatchColor=RGB(211, 244, 243))

# ---- group: Fonts / Aptos Light
# Aptos Light
panel_9 = Panel(""" <FontFamily>
                    <FontFamily.FamilyMaps>
                        <FontFamilyMap Target="Aptos Light"/>
                    </FontFamily.FamilyMaps>

                </FontFamily>""")
create_objects_from_xaml = CreateObjectsFromXAML(XAML=panel_9)
set_element_property = SetElementProperty(PropertyName="FontFamily", ValueToSet=create_objects_from_xaml)

# ---- group: Financial impact / "Investment Costs" heading
# "Investment Costs" heading
panel_10 = Panel("15")
label_14 = CreateLabel(LabelText="INVESTMENT COSTS", LabelSize=panel_10, Justification=0)
separator_13 = CreateSeparator(Thickness=10, Horizontal=True, Color=RGBA(255, 255, 255, 0))
adjust_element_appearance_4 = AdjustElementAppearance(
    ElementsToAdjust=label_14,
    Foreground=ColourSwatch(SwatchColor=RGB(255, 255, 255)),
    Background=ColourSwatch(SwatchColor=RGB(249, 222, 139)))
merge_8 = Merge(Data1=separator_13, Data2=label_14)

# ---- group: Financial impact / Additional costs variables / Connection costs slider
# Connection costs slider
number_slider_2 = Slider(1, range=0..100)
create_slider = CreateSlider(Slider=number_slider_2, ShowBounds=False, ShowTicks=False, ShowTooltip=False, ShowValLabel=True, showLabel=True)
label_15 = CreateLabel(LabelText="Connection costs                  ", LabelSize=18, Justification=0)
label_16 = CreateLabel(LabelText="% of building costs", LabelSize=18, Justification=0)
create_stack_5 = CreateStack(UIElements=[label_15, create_slider, label_16], Horizontal=True)
value_listener_3 = ValueListener(Elements=create_slider, SomeProperty=True)  # -> Values, Indices
adjust_element_appearance_5 = AdjustElementAppearance(ElementsToAdjust=[label_16, label_15], FontSize=12)

# ---- group: Financial impact / Additional costs variables / Taxes slider
# Taxes slider
number_slider_3 = Slider(0.6, range=0..100)
create_slider_2 = CreateSlider(Slider=number_slider_3, ShowBounds=False, ShowTicks=False, ShowTooltip=False, ShowValLabel=True, showLabel=True)
label_17 = CreateLabel(LabelText="Taxes                                            ", LabelSize=18, Justification=0)
label_18 = CreateLabel(LabelText="% of building costs", LabelSize=18, Justification=0)
create_stack_6 = CreateStack(UIElements=[label_17, create_slider_2, label_18], Horizontal=True)
value_listener_4 = ValueListener(Elements=create_slider_2, SomeProperty=True)  # -> Values, Indices
adjust_element_appearance_6 = AdjustElementAppearance(ElementsToAdjust=[label_18, label_17], FontSize=12)

# ---- group: Financial impact / Indirect costs variables / General construction costs slider
# General construction costs slider
number_slider_4 = Slider(8, range=0..100)
create_slider_3 = CreateSlider(Slider=number_slider_4, ShowBounds=False, ShowTicks=False, ShowTooltip=False, ShowValLabel=True, showLabel=True)
label_19 = CreateLabel(LabelText="General construction costs", LabelSize=18, Justification=0)
label_20 = CreateLabel(LabelText="% of direct costs", LabelSize=18, Justification=0)
create_stack_7 = CreateStack(UIElements=[label_19, create_slider_3, label_20], Horizontal=True)
value_listener_5 = ValueListener(Elements=create_slider_3, SomeProperty=True)  # -> Values, Indices
adjust_element_appearance_7 = AdjustElementAppearance(ElementsToAdjust=[label_20, label_19], FontSize=12)

# ---- group: Financial impact / Indirect costs variables / General overhead costs slider
# General overhead costs slider
number_slider_5 = Slider(5, range=0..100)
create_slider_4 = CreateSlider(Slider=number_slider_5, ShowBounds=False, ShowTicks=False, ShowTooltip=False, ShowValLabel=True, showLabel=True)
label_21 = CreateLabel(LabelText="General overhead costs       ", LabelSize=18, Justification=0)
label_22 = CreateLabel(LabelText="% of direct costs", LabelSize=18, Justification=0)
create_stack_8 = CreateStack(UIElements=[label_21, create_slider_4, label_22], Horizontal=True)
value_listener_6 = ValueListener(Elements=create_slider_4, SomeProperty=True)  # -> Values, Indices
adjust_element_appearance_8 = AdjustElementAppearance(ElementsToAdjust=[label_22, label_21], FontSize=12)

# ---- group: Financial impact / Indirect costs variables / Risk slider
# Risk slider
number_slider_6 = Slider(3, range=0..100)
create_slider_5 = CreateSlider(Slider=number_slider_6, ShowBounds=False, ShowTicks=False, ShowTooltip=False, ShowValLabel=True, showLabel=True)
label_23 = CreateLabel(LabelText="Risk                                                ", LabelSize=18, Justification=0)
label_24 = CreateLabel(LabelText="% of direct costs", LabelSize=18, Justification=0)
create_stack_9 = CreateStack(UIElements=[label_23, create_slider_5, label_24], Horizontal=True)
value_listener_7 = ValueListener(Elements=create_slider_5, SomeProperty=True)  # -> Values, Indices
adjust_element_appearance_9 = AdjustElementAppearance(ElementsToAdjust=[label_24, label_23], FontSize=12)

# ---- group: Financial impact / Building costs calculation
# Building costs calculation
direct_costs = Data(expression_4)
division_7 = Division(A=direct_costs, B=100)
multiplication = Multiplication(A=division_7, B=value_listener_5.Values)
addition_3 = Addition(A=direct_costs, B=multiplication)
division_8 = Division(A=addition_3, B=100)
multiplication_2 = Multiplication(A=division_8, B=value_listener_6.Values)
addition_4 = Addition(A=multiplication_2, B=multiplication, C=direct_costs)
division_9 = Division(A=addition_4, B=100)
multiplication_3 = Multiplication(A=division_9, B=value_listener_7.Values)
general_construction_costs = Number(multiplication)
general_overhead_costs = Number(multiplication_2)
risk = Number(multiplication_3)
addition_5 = Addition(A=general_construction_costs, B=general_overhead_costs, C=risk)
indirect_costs = Number(addition_5)
addition_6 = Addition(A=indirect_costs, B=direct_costs)
building_costs = Number(addition_6)

# ---- group: Financial impact / Additional costs variables / Project management costs slider
# Project management costs slider
number_slider_7 = Slider(1, range=0..100)
create_slider_6 = CreateSlider(Slider=number_slider_7, ShowBounds=False, ShowTicks=False, ShowTooltip=False, ShowValLabel=True, showLabel=True)
label_25 = CreateLabel(LabelText="Project management            ", LabelSize=18, Justification=0)
label_26 = CreateLabel(LabelText="% of building costs", LabelSize=18, Justification=0)
create_stack_10 = CreateStack(UIElements=[label_25, create_slider_6, label_26], Horizontal=True)
value_listener_8 = ValueListener(Elements=create_slider_6, SomeProperty=True)  # -> Values, Indices
adjust_element_appearance_10 = AdjustElementAppearance(ElementsToAdjust=[label_26, label_25], FontSize=12)

# ---- group: Financial impact / Additional costs variables / Fees costs slider
# Fees costs slider
number_slider_8 = Slider(15, range=0..100)
create_slider_7 = CreateSlider(Slider=number_slider_8, ShowBounds=False, ShowTicks=False, ShowTooltip=False, ShowValLabel=True, showLabel=True)
label_27 = CreateLabel(LabelText="Fees                                              ", LabelSize=18, Justification=0)
label_28 = CreateLabel(LabelText="% of building costs", LabelSize=18, Justification=0)
create_stack_11 = CreateStack(UIElements=[label_27, create_slider_7, label_28], Horizontal=True)
value_listener_9 = ValueListener(Elements=create_slider_7, SomeProperty=True)  # -> Values, Indices
adjust_element_appearance_11 = AdjustElementAppearance(ElementsToAdjust=[label_28, label_27], FontSize=12)

# ---- group: Financial impact / Additional costs variables / Insurance slider
# Insurance slider
number_slider_9 = Slider(0.4, range=0..100)
create_slider_8 = CreateSlider(Slider=number_slider_9, ShowBounds=False, ShowTicks=False, ShowTooltip=False, ShowValLabel=True, showLabel=True)
label_29 = CreateLabel(LabelText="Insurance                                  ", LabelSize=18, Justification=0)
label_30 = CreateLabel(LabelText="% of building costs", LabelSize=18, Justification=0)
create_stack_12 = CreateStack(UIElements=[label_29, create_slider_8, label_30], Horizontal=True)
value_listener_10 = ValueListener(Elements=create_slider_8, SomeProperty=True)  # -> Values, Indices
adjust_element_appearance_12 = AdjustElementAppearance(ElementsToAdjust=[label_30, label_29], FontSize=12)

# ---- group: Financial impact / Additional costs variables / Temporary accomodation slider
# Temporary accomodation slider
number_slider_10 = Slider(8, range=0..100)
create_slider_9 = CreateSlider(Slider=number_slider_10, ShowBounds=False, ShowTicks=False, ShowTooltip=False, ShowValLabel=True, showLabel=True)
label_31 = CreateLabel(LabelText="Temporary accomodation ", LabelSize=18, Justification=0)
label_32 = CreateLabel(LabelText="% of building costs", LabelSize=18, Justification=0)
create_stack_13 = CreateStack(UIElements=[label_31, create_slider_9, label_32], Horizontal=True)
value_listener_11 = ValueListener(Elements=create_slider_9, SomeProperty=True)  # -> Values, Indices
adjust_element_appearance_13 = AdjustElementAppearance(ElementsToAdjust=[label_32, label_31], FontSize=12)

# ---- group: Financial impact / Investment costs calculation
# Investment costs calculation
division_10 = Division(BuildingCosts=building_costs, B=100)
multiplication_4 = Multiplication(A=division_10, B=value_listener_8.Values)
multiplication_5 = Multiplication(A=division_10, B=value_listener_9.Values)
multiplication_6 = Multiplication(A=division_10, B=value_listener_3.Values)
multiplication_7 = Multiplication(A=division_10, B=value_listener_4.Values)
multiplication_8 = Multiplication(A=division_10, B=value_listener_10.Values)
multiplication_9 = Multiplication(A=division_10, B=value_listener_11.Values)
mass_addition = MassAddition(Input=[multiplication_4, multiplication_5, multiplication_6, multiplication_7, multiplication_8, multiplication_9])  # -> Result, PartialResults
additional_costs = Number(mass_addition.Result)
addition_7 = Addition(BuildingCosts=building_costs, AdditionalCosts=additional_costs)
investment_costs = Number(addition_7)

# ---- group: Financial impact / Investment results / Total investment ocsts
# Total investment ocsts
colour_swatch_16 = ColourSwatch(SwatchColor=RGB(245, 200, 61))
investment_costs_2 = Number(investment_costs)
thousand_point_separator_6 = CSharpScript(x=investment_costs_2)  # -> a; same code as thousand_point_separator
format_2 = Format(Format="€{0}.-", Culture=127, Data0=thousand_point_separator_6)  # -> simplify(Text)
label_33 = CreateLabel(LabelText="Total investment costs", LabelSize=18, Justification=0)
label_34 = CreateLabel(LabelText=" A", LabelSize=Slider(29, range=0..100), Justification=0)
setlabel_3 = SetLabelContents(LabelToModify=label_34, NewLabelContents=format_2)
adjustelem_4 = AdjustElementAppearance(ElementsToAdjust=label_34, Foreground=colour_swatch_16)
panel_11 = Panel("Total investment costs of the building including preparation and risk costs")
stack_5 = CreateStack(UIElements=[label_33, label_34], Horizontal=False)
tooltip_6 = AttachTooltipToElement(ElementsToAttachTo=stack_5, TooltipContent=panel_11, ShowDelay=500, Duration=100000)

# ---- group: Financial impact / Material, labour and shadow costs - total
# Material, labour and shadow costs - total
merge_9 = Merge(Data1=number_2, Data2=number_3, Data3=number_5)  # -> flatten(MaterialLabourCostsTruePrice)
panel_12 = Panel("""Material Costs
Labour Costs
Shadow Costs""")
chart_3 = CreateChart(Data=0, Names=" ", Title=" ", ChartType=1)
setchart_3 = SetChartContents(ChartToModify=chart_3, NewChartValues=merge_9, NewChartNames=panel_12)
chart_appearance_2 = ChartAppearance(
    ChartToModify=chart_3,
    Colors=[ColourSwatch(SwatchColor=RGB(245, 200, 61)), ColourSwatch(SwatchColor=RGB(249, 222, 139)), ColourSwatch(SwatchColor=RGB(251, 233, 177))],
    Legend=True,
    Title=False)
adjustelem_5 = AdjustElementAppearance(ElementsToAdjust=chart_3, Background=RGBA(255, 255, 255, 0))
panel_13 = Panel("Total costs of the building, consisting of material, labour and shadow (MKI) costs.")
adjust_element_positioning_3 = AdjustElementPositioning(
    ElementsToAdjust=chart_3,
    Margin="-7,-45,-10,-10",
    AbsolutePositioning=False,
    Width=Slider(257, range=100..300),
    Height=Slider(200, range=0..1000))
tooltip_7 = AttachTooltipToElement(ElementsToAttachTo=chart_3, TooltipContent=panel_13, ShowDelay=500, Duration=100000)

# ---- group: Financial impact / "Total costs" heading
# "Total costs" heading
panel_14 = Panel("15")
label_35 = CreateLabel(LabelText="TOTAL COSTS", LabelSize=panel_14, Justification=0)
separator_14 = CreateSeparator(Thickness=10, Horizontal=True, Color=RGBA(255, 255, 255, 0))
adjust_element_appearance_14 = AdjustElementAppearance(
    ElementsToAdjust=label_35,
    Foreground=ColourSwatch(SwatchColor=RGB(255, 255, 255)),
    Background=ColourSwatch(SwatchColor=RGB(249, 222, 139)))
merge_10 = Merge(Data1=label_35, Data2=separator_14)

# ---- group: Financial impact / Direct costs - total
# Direct costs - total
colour_swatch_17 = ColourSwatch(SwatchColor=RGB(245, 200, 61))
label_36 = CreateLabel(LabelText="Direct Costs", LabelSize=18, Justification=0)
label_37 = CreateLabel(LabelText=" A", LabelSize=Slider(29, range=0..100), Justification=0)
setlabel_4 = SetLabelContents(LabelToModify=label_37, NewLabelContents=explode_tree_7.Branch0)
adjustelem_6 = AdjustElementAppearance(ElementsToAdjust=label_37, Foreground=colour_swatch_17)
panel_15 = Panel("Total direct costs of the building, consisting of material and labour costs.")
stack_6 = CreateStack(UIElements=[label_36, label_37], Horizontal=False)
tooltip_8 = AttachTooltipToElement(ElementsToAttachTo=stack_6, TooltipContent=panel_15, ShowDelay=500, Duration=100000)

# ---- group: Financial impact / True price - total
# True price - total
colour_swatch_18 = ColourSwatch(SwatchColor=RGB(245, 200, 61))
label_38 = CreateLabel(LabelText="True Price", LabelSize=18, Justification=0)
label_39 = CreateLabel(LabelText=" A", LabelSize=Slider(29, range=0..100), Justification=0)
setlabel_5 = SetLabelContents(LabelToModify=label_39, NewLabelContents=explode_tree_7.Branch3)
adjustelem_7 = AdjustElementAppearance(ElementsToAdjust=label_39, Foreground=colour_swatch_18)
panel_16 = Panel("True price of the building, consisting of the direct costs and total MKI (environmental shadow costs).")
stack_7 = CreateStack(UIElements=[label_38, label_39], Horizontal=False)
tooltip_9 = AttachTooltipToElement(ElementsToAttachTo=stack_7, TooltipContent=panel_16, ShowDelay=500, Duration=100000)

# ---- group: Financial impact / "Costs per m2 GFA" heading
# "Costs per m2 GFA" heading
panel_17 = Panel("15")
label_40 = CreateLabel(LabelText="COSTS PER M2 GFA", LabelSize=panel_17, Justification=0)
separator_15 = CreateSeparator(Thickness=10, Horizontal=True, Color=RGBA(255, 255, 255, 0))
adjust_element_appearance_15 = AdjustElementAppearance(
    ElementsToAdjust=label_40,
    Foreground=ColourSwatch(SwatchColor=RGB(255, 255, 255)),
    Background=ColourSwatch(SwatchColor=RGB(249, 222, 139)))

# ---- group: Financial impact / Indirect costs variables
# Indirect costs variables
panel_18 = Panel("""Default percentages are currently set for educational buildings and based 
on data from costindicators.com.""")
label_41 = CreateLabel(LabelText=panel_18, LabelSize=12, Justification=0)
label_42 = CreateLabel(LabelText="Indirect Costs", LabelSize=12, Justification=0)
create_stack_14 = CreateStack(UIElements=[label_41, label_42, create_stack_7, create_stack_8, create_stack_9], Horizontal=False)

# ---- group: Financial impact / Additional costs variables
# Additional costs variables
label_43 = CreateLabel(LabelText="Additional Costs", LabelSize=12, Justification=0)
create_stack_15 = CreateStack(
    UIElements=[label_43, create_stack_10, create_stack_11, create_stack_5, create_stack_6, create_stack_12, create_stack_13],
    Horizontal=False)

# ---- group: Financial impact / Data source
# Data source
create_label_3 = CreateLabel(LabelText="Data Source: ArchiCalc", LabelSize=8, Justification=0)
separator_16 = CreateSeparator(Thickness=5, Horizontal=True, Color=RGBA(255, 255, 255, 0))
data_source_3 = Merge(Data1=separator_16, Data2=create_label_3)

# ---- group: Legend / Indicator abbreviation legend
# Indicator abbreviation legend
panel_19 = Panel("""MPG = MilieuPrestatie Gebouw
PPI = Paris Proof Indicator
CSC = Construction Stored Carbon
MKI = MilieuKostenIndicator
GWP = Global Warming Potential""")
label_44 = CreateLabel(LabelText="Environmental Impact Indicators", LabelSize=12, Justification=0)
label_45 = CreateLabel(LabelText=panel_19, LabelSize=12, Justification=0)
stack_8 = CreateStack(UIElements=flatten([label_44, label_45]), Horizontal=False)

# ---- group: Legend / Life Cycle Stages legend
# Life Cycle Stages legend
panel_20 = Panel("""A1 = Raw materials supply
A2 = Transport to factory
A3 = Manufacturing""")
panel_21 = Panel("""A4 = Transport to construction site
A5 = Construction and installation""")
panel_22 = Panel("""B1 = Use
B2 = Maintenance
B3 = Repair
B4 = Replacement
B5 = Refurbishment""")
panel_23 = Panel("""C1 = Demolition
C2 = Transport to end of life faciltiy
C3 = Waste processing
C4 = Disposal""")
panel_24 = Panel("""Benefits and loads:
- Reuse
- Recovery
- Recycling potential""")
label_46 = CreateLabel(LabelText=panel_20, LabelSize=12, Justification=0)
label_47 = CreateLabel(LabelText=panel_21, LabelSize=12, Justification=0)
label_48 = CreateLabel(LabelText=panel_22, LabelSize=12, Justification=0)
label_49 = CreateLabel(LabelText=panel_23, LabelSize=12, Justification=0)
label_50 = CreateLabel(LabelText=panel_24, LabelSize=12, Justification=0)
create_expander = CreateExpander(UIElements=label_46, Header="A1-A3: Product Stage", Open=False)
create_expander_2 = CreateExpander(UIElements=label_47, Header="A4-A5: Construction Stage", Open=False)
create_expander_3 = CreateExpander(UIElements=label_48, Header="B1-B5: Use Stage", Open=False)
create_expander_4 = CreateExpander(UIElements=label_49, Header="C1-C4: End of Life Stage", Open=False)
create_expander_5 = CreateExpander(UIElements=label_50, Header="D: Beyond Life Cycle Stage", Open=False)
label_51 = CreateLabel(LabelText="Life Cycle Stages", LabelSize=12, Justification=0)
stack_9 = CreateStack(
    UIElements=flatten([label_51, create_expander, create_expander_2, create_expander_3, create_expander_4, create_expander_5]),
    Horizontal=False)

# ---- group: Legend
separator_17 = CreateSeparator(Thickness=10, Horizontal=True, Color=RGBA(255, 255, 255, 0))
label_52 = CreateLabel(LabelText="LEGEND", LabelSize=18, Justification=0)
separator_18 = CreateSeparator(Thickness=10, Horizontal=True, Color=RGBA(255, 255, 255, 0))
separator_19 = CreateSeparator(Thickness=20, Horizontal=False, Color=RGBA(255, 255, 255, 0))
separator_20 = CreateSeparator(Thickness=20, Horizontal=True, Color=RGBA(255, 255, 255, 0))
stack_10 = CreateStack(UIElements=[stack_8, separator_19, stack_9], Horizontal=True)
merge_11 = Merge(Data1=separator_17, Data2=label_52, Data3=separator_18, Data4=stack_10, Data5=separator_20)

# ---- group: Total Building Results / Total results
# Total results
panel_25 = Panel("""PPI
[kg CO2 eq. / m2 GFA]""")
panel_26 = Panel("""MPG
[€ / m2 GFA / year]""")
total_mpg = Data(expression)
total_csc = Data(expression_2)
total_pp = Data(expression_3)
panel_27 = Panel("""CSC
[tonnes CO2]""")
chart_4 = CreateChart(Data="0", SubTitle=panel_27, ChartType=1)
chart_5 = CreateChart(Data="0", SubTitle=panel_25, ChartType=1)
chart_6 = CreateChart(Data="0", SubTitle=panel_26, ChartType=1)
setchart_4 = SetChartContents(ChartToModify=chart_4, NewChartValues=flatten(total_csc))
setchart_5 = SetChartContents(ChartToModify=chart_6, NewChartValues=flatten(total_mpg))
setchart_6 = SetChartContents(ChartToModify=chart_5, NewChartValues=flatten(total_pp))
adjustpos_2 = AdjustElementPositioning(
    ElementsToAdjust=[chart_6, chart_5, chart_4],
    AbsolutePositioning=False,
    Width=Slider(220, range=0..2000),
    HorizontalAlignment=0,
    VerticalAlignment=3)
chartappearance_2 = ChartAppearance(ChartToModify=[chart_6, chart_5, chart_4], Legend=False)

# ---- group: Detailed results per NL/SfB class
detailed_results = Data(stream_gate_2.Target1)
split_tree_4 = SplitTree(Data=detailed_results, Masks=flatten("{0;?;?}"))  # -> simplify(EnvironmentalImpactDetailedResults), Negative
split_tree_5 = SplitTree(Data=detailed_results, Masks=flatten("{1;?;?}"))  # -> simplify(CircularityDetailedResults), Negative
split_tree_6 = SplitTree(Data=detailed_results, Masks=flatten("{2;?;?}"))  # -> simplify(FinancialImpactResults), Negative
cluster = Cluster(data=split_tree_4.EnvironmentalImpactDetailedResults)
cluster_2 = Cluster(data=split_tree_5.CircularityDetailedResults)
cluster_3 = Cluster(data=split_tree_6.FinancialImpactResults)

# ---- group: Legend / Indicator abbreviation legend
# Indicator abbreviation legend
panel_28 = Panel("""BCI = Building Circularity Index
PCI = Product Circularity Index
MCI = Material Circularity Index
DP = Disassembly Potential""")
label_53 = CreateLabel(LabelText="Circularity Indicators", LabelSize=12, Justification=0)
label_54 = CreateLabel(LabelText=panel_28, LabelSize=12, Justification=0)
stack_11 = CreateStack(UIElements=flatten([label_53, label_54]), Horizontal=False)

# ---- group: Legend
separator_21 = CreateSeparator(Thickness=10, Horizontal=True, Color=RGBA(255, 255, 255, 0))
label_55 = CreateLabel(LabelText="LEGEND", LabelSize=18, Justification=0)
separator_22 = CreateSeparator(Thickness=10, Horizontal=True, Color=RGBA(255, 255, 255, 0))
separator_23 = CreateSeparator(Thickness=10, Horizontal=True, Color=RGBA(255, 255, 255, 0))
merge_12 = Merge(Data1=separator_21, Data2=label_55, Data3=separator_22, Data4=stack_11, Data5=separator_23)

# ---- group: Legend / Indicator abbreviation legend
# Indicator abbreviation legend
panel_29 = Panel("""Direct costs = Material + Labour costs
True price = Material + Labour + Shadow (MKI) costs""")
label_56 = CreateLabel(LabelText="Financial Impact Indicators", LabelSize=12, Justification=0)
label_57 = CreateLabel(LabelText=panel_29, LabelSize=12, Justification=0)
stack_12 = CreateStack(UIElements=flatten([label_56, label_57]), Horizontal=False)

# ---- group: Legend
separator_24 = CreateSeparator(Thickness=10, Horizontal=True, Color=RGBA(255, 255, 255, 0))
label_58 = CreateLabel(LabelText="LEGEND", LabelSize=18, Justification=0)
separator_25 = CreateSeparator(Thickness=10, Horizontal=True, Color=RGBA(255, 255, 255, 0))
separator_26 = CreateSeparator(Thickness=10, Horizontal=True, Color=RGBA(255, 255, 255, 0))
merge_13 = Merge(Data1=separator_24, Data2=label_58, Data3=separator_25, Data4=stack_12, Data5=separator_26)

# ---- group: Total building results / Total direct costs
# Total direct costs
panel_30 = Panel("""Total direct costs
[€]""")
panel_31 = Panel("""Material Costs
Labour Costs
Shadow Costs""")
chart_7 = CreateChart(Data="0", SubTitle=panel_30, ChartType=1)
setchart_7 = SetChartContents(ChartToModify=chart_7, NewChartValues=flatten(merge_9), NewChartNames=panel_31)

# ---- group: Top captions
label_59 = CreateLabel(LabelText=" ", LabelSize=18, Justification=0)
label_60 = CreateLabel(LabelText="VIEW SETTINGS", LabelSize=18, Justification=0)
headliner_2 = CreateLabel(LabelText="VIEW", LabelSize=24, Justification=0)
list_item_9 = ListItem(List=flatten(building_information), Index=1, Wrap=True)
separator_27 = CreateSeparator(Thickness=20, Horizontal=True, Color=RGBA(255, 255, 255, 0))
setlabel_6 = SetLabelContents(LabelToModify=label_59, NewLabelContents=list_item_9)

# ---- group: Building elements heading
panel_32 = Panel("""The generic building element classes below are simplified for better visualisation. These classes are derived from merging related NL/SfB classes. This is done as follows:

Ground:   11 Ground

Foundation:   16 Foundation, 17 Pile foundations

External walls:   21A External walls - Structure, 21B External walls - Insulation, 41 External wall finishes

Internal walls:   22A Internal walls - Structure, 22B Internal walls - Insulation, 42 Internal wall finishes

Floors:   13A Floors on the ground - Structure, 13B Floors on the ground - Insulation, 23A Floors - Structure, 23B Floors - Insulation, 43 Floor finishes, 45 Ceiling finishes

Stairs and ramps:   24 Stairs and ramps, 34 Stair balustrades and handrails, 44 Stair and ramp finishes

Roofs:   27A Roofs - Structure, 27B Roofs - Insulation, 47 Roof finishes

Load bearing structures:   28A Load bearing structures - General, 28B Load bearing structures - Reinforcement

Windows:   31A External wall openings - Windows (frames), 31B External wall openings - Windows (glazing), 32A Internal wall openings - Windows (frames), 32B Internal wall openings - Windows (glazing), 33A Floor openings - Windows (frames), 33B Floor openings - Windows (glazing), 37A Roof openings - Windows (frames), 37B Roof openings - Windows (glazing)

Doors:   31C External wall openings - Doors,   32C Internal wall openings - Doors""")
tb = CreateTextBlock(Text=panel_32, TextSize=12, Justification=0)
label_61 = CreateLabel(LabelText="BUILDING ELEMENTS", LabelSize=18, Justification=0)
separator_28 = CreateSeparator(Thickness=20, Horizontal=True, Color=RGBA(255, 255, 255, 0))
expander_2 = CreateExpander(UIElements=tb, Header="Explanation", Open=False)
separator_29 = CreateSeparator(Thickness=10, Horizontal=True, Color=RGBA(255, 255, 255, 0))
merge_14 = Merge(Data1=separator_28, Data2=label_61, Data3=expander_2, Data4=separator_29)
adjust_element_appearance_16 = AdjustElementAppearance(ElementsToAdjust=expander_2, Background=ColourSwatch(SwatchColor=RGB(233, 142, 170)))

# ---- group: Transparency slider
create_slider_10 = CreateSlider(Slider=Slider(0, range=0..1), ShowBounds=False, ShowTicks=False, ShowTooltip=False, ShowValLabel=True, showLabel=True)
label_62 = CreateLabel(LabelText="Model transparency", LabelSize=18, Justification=0)
create_stack_16 = CreateStack(UIElements=[label_62, create_slider_10], Horizontal=False)
value_listener_12 = ValueListener(Elements=create_slider_10, SomeProperty=True)  # -> Values, Indices

# ---- group: Show results in model mode / Results mode button
# Results mode button
create_toggle_3 = CreateToggle(Default=False, Label="Show results in model")
value_listener_13 = ValueListener(Elements=create_toggle_3, SomeProperty=True)  # -> Values, Indices

# ---- group: Show results in model mode / Results pulldown menu
# Results pulldown menu
panel_33 = Panel("""MKI (MilieuKostenIndicator)
GWP A1-A5 (Global Warming Potential)
PCI (Product Circularity Index)
DP (Disassembly Potential)
Direct costs
True price""")
create_pulldown_menu = CreatePulldownMenu(ListItems=panel_33, showLabel=True)
label_63 = CreateLabel(LabelText="Show results on:", LabelSize=18, Justification=0)
create_stack_17 = CreateStack(UIElements=[label_63, create_pulldown_menu], Horizontal=False)
value_listener_14 = ValueListener(Elements=create_pulldown_menu, SomeProperty=True)  # -> Values, Indices

# ---- group: Show results in model mode / Gradient legend
# Gradient legend
gradient = Gradient(LowerLimit=0, UpperLimit=1, stops=[0: RGB(0, 128, 0), 0.5: RGB(255, 255, 0), 0.995: RGB(255, 0, 0)])
panel_34 = Panel("""Low Direct Costs
High Direct Costs""")
panel_35 = Panel("""Low True Price
High True Price""")
panel_36 = Panel("""Low MKI
High MKI""")
panel_37 = Panel("""Low GWP
High GWP""")
panel_38 = Panel("""High PCI
Low PCI""")
panel_39 = Panel("""High DP
Low DP""")
stream_filter_3 = StreamFilter(
    Gate=value_listener_14.Indices,
    Stream0=panel_36,
    Stream1=panel_37,
    Stream2=panel_38,
    Stream3=panel_39,
    Stream4=panel_34,
    Stream5=panel_35)
create_gradient_editor = CreateGradientEditor(DefaultGradient=gradient, ShowEditor=True, ShowPresets=False)
list_item_10 = ListItem(List=stream_filter_3, Index=0, Wrap=True)  # -> Item, Item1
label_64 = CreateLabel(LabelText=" ", LabelSize=12, Justification=0)
label_65 = CreateLabel(LabelText=" ", LabelSize=12, Justification=0)
adjust_element_positioning_4 = AdjustElementPositioning(ElementsToAdjust=create_gradient_editor, AbsolutePositioning=False, Width=Slider(229, range=0..1000))
set_label_contents_3 = SetLabelContents(LabelToModify=label_64, NewLabelContents=list_item_10.Item)
set_label_contents_4 = SetLabelContents(LabelToModify=label_65, NewLabelContents=list_item_10.Item1)
adjust_element_positioning_5 = AdjustElementPositioning(ElementsToAdjust=[label_64, label_65], AbsolutePositioning=False, VerticalAlignment=1)

# ---- group: Results per generic class / MKI per generic class
# MKI per generic class
split_tree_7 = SplitTree(Data=cluster, Masks=flatten(["{?;?;41}", "{?;0;0}"]))  # -> Positive, Negative
tree_branch_2 = TreeBranch(Tree=split_tree_7.Positive, Path="{1;0;0}", MaintainPaths=True)
list_length_2 = ListLength(List=tree_branch_2)  # -> flatten(Length)
smaller_than = SmallerThan(FirstNumber=list_length_2, SecondNumber=0)  # -> SmallerThan, OrEqualTo
stream_gate_3 = StreamGate(Stream=split_tree_7.Positive, Gate=smaller_than.OrEqualTo)  # -> Target0, Target1
split_tree_8 = SplitTree(Data=stream_gate_3.Target0, Masks=flatten("{1;0;0}"))  # -> Positive, Negative
mki_per_nl_sfb_class = Data([split_tree_8.Negative, stream_gate_3.Target1])
cull_index_2 = CullIndex(List=mki_per_nl_sfb_class, Indices=0, Wrap=True)  # -> simplify(List)
tstat = TreeStatistics(Tree=cull_index_2)  # -> Paths, Length, Count
dpath = DeconstructPath(Branch=tstat.Paths)
item = ListItem(List=dpath, Index=0, Wrap=True)
path = ConstructPath(Indices=item)
replace = ReplacePaths(Data=cull_index_2, Search=tstat.Paths, Replace=flatten(path))
c_script = CSharpScript(x=replace)  # -> A; inputs x: tree; same code as c_script
cluster_4 = Cluster_2(tree=c_script)
mass_addition_2 = MassAddition(Input=cluster_4)  # -> Result, PartialResults
clean = CleanTree(RemoveNulls=True, RemoveInvalid=True, RemoveEmpty=False, Tree=mass_addition_2.Result)

# ---- group: Results per generic class / GWP per generic class
# GWP per generic class
split_tree_9 = SplitTree(Data=cluster, Masks=flatten(["{?;?;14}", "{?;?;15}", "{?;?;16}", "{?;0;0}"]))  # -> Positive, Negative
tree_branch_3 = TreeBranch(Tree=split_tree_9.Positive, Path="{1;0;0}", MaintainPaths=True)
list_length_3 = ListLength(List=tree_branch_3)  # -> flatten(Length)
smaller_than_2 = SmallerThan(FirstNumber=list_length_3, SecondNumber=0)  # -> SmallerThan, OrEqualTo
stream_gate_4 = StreamGate(Stream=split_tree_9.Positive, Gate=smaller_than_2.OrEqualTo)  # -> Target0, Target1
split_tree_10 = SplitTree(Data=stream_gate_4.Target0, Masks=flatten("{1;0;0}"))  # -> Positive, Negative
gwp_a1_a5_per_nl_sfb_class = Data([split_tree_10.Negative, stream_gate_4.Target1])
cull_index_3 = CullIndex(List=gwp_a1_a5_per_nl_sfb_class, Indices=0, Wrap=True)  # -> simplify(List)
tstat_2 = TreeStatistics(Tree=cull_index_3)  # -> Paths, Length, Count
dpath_2 = DeconstructPath(Branch=tstat_2.Paths)
item_2 = ListItem(List=dpath_2, Index=0, Wrap=True)
path_2 = ConstructPath(Indices=item_2)
replace_2 = ReplacePaths(Data=cull_index_3, Search=tstat_2.Paths, Replace=flatten(path_2))
mass_addition_3 = MassAddition(Input=replace_2)  # -> Result, PartialResults
c_script_2 = CSharpScript(x=mass_addition_3.Result)  # -> A; inputs x: tree; same code as c_script
cluster_5 = Cluster_2(tree=c_script_2)
mass_addition_4 = MassAddition(Input=cluster_5)  # -> Result, PartialResults
clean_2 = CleanTree(RemoveNulls=True, RemoveInvalid=True, RemoveEmpty=False, Tree=mass_addition_4.Result)

# ---- group: Results per generic class / Direct Costs per generic class
# Direct Costs per generic class
split_tree_11 = SplitTree(Data=cluster_3, Masks=flatten(["{?;?;17}", "{?;0;0}"]))  # -> Positive, Negative
tree_branch_4 = TreeBranch(Tree=split_tree_11.Positive, Path="{1;0;0}", MaintainPaths=True)
list_length_4 = ListLength(List=tree_branch_4)  # -> flatten(Length)
smaller_than_3 = SmallerThan(FirstNumber=list_length_4, SecondNumber=0)  # -> SmallerThan, OrEqualTo
stream_gate_5 = StreamGate(Stream=split_tree_11.Positive, Gate=smaller_than_3.OrEqualTo)  # -> Target0, Target1
split_tree_12 = SplitTree(Data=stream_gate_5.Target0, Masks=flatten("{1;0;0}"))  # -> Positive, Negative
direct_costs_per_nl_sfb_class = Data([split_tree_12.Negative, stream_gate_5.Target1])
cull_index_4 = CullIndex(List=direct_costs_per_nl_sfb_class, Indices=0, Wrap=True)  # -> simplify(List)
tstat_3 = TreeStatistics(Tree=cull_index_4)  # -> Paths, Length, Count
dpath_3 = DeconstructPath(Branch=tstat_3.Paths)
item_3 = ListItem(List=dpath_3, Index=0, Wrap=True)
path_3 = ConstructPath(Indices=item_3)
replace_3 = ReplacePaths(Data=cull_index_4, Search=tstat_3.Paths, Replace=flatten(path_3))
c_script_3 = CSharpScript(x=replace_3)  # -> A; inputs x: tree; same code as c_script
cluster_6 = Cluster_2(tree=c_script_3)
mass_addition_5 = MassAddition(Input=cluster_6)  # -> Result, PartialResults
clean_3 = CleanTree(RemoveNulls=True, RemoveInvalid=True, RemoveEmpty=False, Tree=mass_addition_5.Result)

# ---- group: Results per generic class / True Price per generic class
# True Price per generic class
split_tree_13 = SplitTree(Data=cluster_3, Masks=flatten(["{?;?;18}", "{?;0;0}"]))  # -> Positive, Negative
tree_branch_5 = TreeBranch(Tree=split_tree_13.Positive, Path="{1;0;0}", MaintainPaths=True)
list_length_5 = ListLength(List=tree_branch_5)  # -> flatten(Length)
smaller_than_4 = SmallerThan(FirstNumber=list_length_5, SecondNumber=0)  # -> SmallerThan, OrEqualTo
stream_gate_6 = StreamGate(Stream=split_tree_13.Positive, Gate=smaller_than_4.OrEqualTo)  # -> Target0, Target1
split_tree_14 = SplitTree(Data=stream_gate_6.Target0, Masks=flatten("{1;0;0}"))  # -> Positive, Negative
true_price_per_nl_sfb_class = Data([split_tree_14.Negative, stream_gate_6.Target1])
cull_index_5 = CullIndex(List=true_price_per_nl_sfb_class, Indices=0, Wrap=True)  # -> simplify(List)
tstat_4 = TreeStatistics(Tree=cull_index_5)  # -> Paths, Length, Count
dpath_4 = DeconstructPath(Branch=tstat_4.Paths)
item_4 = ListItem(List=dpath_4, Index=0, Wrap=True)
path_4 = ConstructPath(Indices=item_4)
replace_4 = ReplacePaths(Data=cull_index_5, Search=tstat_4.Paths, Replace=flatten(path_4))
c_script_4 = CSharpScript(x=replace_4)  # -> A; inputs x: tree; same code as c_script
cluster_7 = Cluster_2(tree=c_script_4)
mass_addition_6 = MassAddition(Input=cluster_7)  # -> Result, PartialResults
clean_4 = CleanTree(RemoveNulls=True, RemoveInvalid=True, RemoveEmpty=False, Tree=mass_addition_6.Result)

# ---- group: Results per generic class / Geometries per generic class / Geometries per NL/SfB class (environmental impact)
# Geometries per NL/SfB class (environmental impact)
split_tree_15 = SplitTree(Data=cluster, Masks=flatten(["{?;?;3}", "{?;0;0}"]))  # -> Positive, Negative
tree_branch_6 = TreeBranch(Tree=split_tree_15.Positive, Path="{1;0;0}", MaintainPaths=True)
list_length_6 = ListLength(List=tree_branch_6)  # -> flatten(Length)
smaller_than_5 = SmallerThan(FirstNumber=list_length_6, SecondNumber=0)  # -> SmallerThan, OrEqualTo
stream_gate_7 = StreamGate(Stream=split_tree_15.Positive, Gate=smaller_than_5.OrEqualTo)  # -> Target0, Target1
split_tree_16 = SplitTree(Data=stream_gate_7.Target0, Masks=flatten("{1;0;0}"))  # -> Positive, Negative
geometries_environmental_impact = Data([split_tree_16.Negative, stream_gate_7.Target1])

# ---- group: Results per generic class / Geometries per generic class / Geometries per NL/SfB class (circularity)
# Geometries per NL/SfB class (circularity)
split_tree_17 = SplitTree(Data=cluster_2, Masks=flatten(["{?;?;3}", "{?;0;0}"]))  # -> Positive, Negative
tree_branch_7 = TreeBranch(Tree=split_tree_17.Positive, Path="{1;0;0}", MaintainPaths=True)
list_length_7 = ListLength(List=tree_branch_7)  # -> flatten(Length)
smaller_than_6 = SmallerThan(FirstNumber=list_length_7, SecondNumber=0)  # -> SmallerThan, OrEqualTo
stream_gate_8 = StreamGate(Stream=split_tree_17.Positive, Gate=smaller_than_6.OrEqualTo)  # -> Target0, Target1
split_tree_18 = SplitTree(Data=stream_gate_8.Target0, Masks=flatten("{1;0;0}"))  # -> Positive, Negative
geometries_circularity = Data([split_tree_18.Negative, stream_gate_8.Target1])

# ---- group: Results per generic class / Geometries per generic class / Geometries per NL/SfB class (financial impact)
# Geometries per NL/SfB class (financial impact)
split_tree_19 = SplitTree(Data=cluster_3, Masks=flatten(["{?;?;3}", "{?;0;0}"]))  # -> Positive, Negative
tree_branch_8 = TreeBranch(Tree=split_tree_19.Positive, Path="{1;0;0}", MaintainPaths=True)
list_length_8 = ListLength(List=tree_branch_8)  # -> flatten(Length)
smaller_than_7 = SmallerThan(FirstNumber=list_length_8, SecondNumber=0)  # -> SmallerThan, OrEqualTo
stream_gate_9 = StreamGate(Stream=split_tree_19.Positive, Gate=smaller_than_7.OrEqualTo)  # -> Target0, Target1
split_tree_20 = SplitTree(Data=stream_gate_9.Target0, Masks=flatten("{1;0;0}"))  # -> Positive, Negative
geometries_financial_impact = Data([split_tree_20.Negative, stream_gate_9.Target1])

# ---- group: Results per generic class / PCI per generic class / PCI
# PCI
split_tree_21 = SplitTree(Data=cluster_2, Masks=flatten(["{?;?;51}", "{?;0;0}"]))  # -> Positive, Negative
tree_branch_9 = TreeBranch(Tree=split_tree_21.Positive, Path="{1;0;0}", MaintainPaths=True)
list_length_9 = ListLength(List=tree_branch_9)  # -> flatten(Length)
smaller_than_8 = SmallerThan(FirstNumber=list_length_9, SecondNumber=0)  # -> SmallerThan, OrEqualTo
stream_gate_10 = StreamGate(Stream=split_tree_21.Positive, Gate=smaller_than_8.OrEqualTo)  # -> Target0, Target1
split_tree_22 = SplitTree(Data=stream_gate_10.Target0, Masks=flatten("{1;0;0}"))  # -> Positive, Negative
pci_per_nl_sfb_class = Data([split_tree_22.Negative, stream_gate_10.Target1])
cull_index_6 = CullIndex(List=pci_per_nl_sfb_class, Indices=0, Wrap=True)  # -> simplify(List)
tstat_5 = TreeStatistics(Tree=cull_index_6)  # -> Paths, Length, Count
dpath_5 = DeconstructPath(Branch=tstat_5.Paths)
item_5 = ListItem(List=dpath_5, Index=0, Wrap=True)
path_5 = ConstructPath(Indices=item_5)
replace_5 = ReplacePaths(Data=cull_index_6, Search=tstat_5.Paths, Replace=flatten(path_5))
c_script_5 = CSharpScript(x=replace_5)  # -> A; inputs x: tree; same code as c_script
cluster_8 = Cluster_2(tree=c_script_5)

# ---- group: Results per generic class / PCI per generic class / MKI element
# MKI element
split_tree_23 = SplitTree(Data=cluster_2, Masks=flatten(["{?;?;52}", "{?;0;0}"]))  # -> Positive, Negative
tree_branch_10 = TreeBranch(Tree=split_tree_23.Positive, Path="{1;0;0}", MaintainPaths=True)
list_length_10 = ListLength(List=tree_branch_10)  # -> flatten(Length)
smaller_than_9 = SmallerThan(FirstNumber=list_length_10, SecondNumber=0)  # -> SmallerThan, OrEqualTo
stream_gate_11 = StreamGate(Stream=split_tree_23.Positive, Gate=smaller_than_9.OrEqualTo)  # -> Target0, Target1
split_tree_24 = SplitTree(Data=stream_gate_11.Target0, Masks=flatten("{1;0;0}"))  # -> Positive, Negative
mki_per_nl_sfb_class_2 = Data([split_tree_24.Negative, stream_gate_11.Target1])
cull_index_7 = CullIndex(List=mki_per_nl_sfb_class_2, Indices=0, Wrap=True)  # -> simplify(List)
tstat_6 = TreeStatistics(Tree=cull_index_7)  # -> Paths, Length, Count
dpath_6 = DeconstructPath(Branch=tstat_6.Paths)
item_6 = ListItem(List=dpath_6, Index=0, Wrap=True)
path_6 = ConstructPath(Indices=item_6)
replace_6 = ReplacePaths(Data=cull_index_7, Search=tstat_6.Paths, Replace=flatten(path_6))
c_script_6 = CSharpScript(x=replace_6)  # -> A; inputs x: tree; same code as c_script
cluster_9 = Cluster_2(tree=c_script_6)

# ---- group: Building elements / Model colours
colour_swatch_19 = ColourSwatch(SwatchColor=RGB(172, 103, 98))
colour_swatch_20 = ColourSwatch(SwatchColor=RGB(195, 112, 78))
colour_swatch_21 = ColourSwatch(SwatchColor=RGB(227, 151, 89))
colour_swatch_22 = ColourSwatch(SwatchColor=RGB(225, 171, 107))
colour_swatch_23 = ColourSwatch(SwatchColor=RGB(218, 186, 137))

colour_swatch_24 = ColourSwatch(SwatchColor=RGB(88, 94, 94))
colour_swatch_25 = ColourSwatch(SwatchColor=RGB(123, 128, 132))
colour_swatch_26 = ColourSwatch(SwatchColor=RGB(201, 202, 196))
colour_swatch_27 = ColourSwatch(SwatchColor=RGB(232, 232, 224))

colour_swatch_28 = ColourSwatch(SwatchColor=RGB(31, 45, 58))
colour_swatch_29 = ColourSwatch(SwatchColor=RGB(153, 177, 164))
colour_swatch_30 = ColourSwatch(SwatchColor=RGB(151, 170, 176))
colour_swatch_31 = ColourSwatch(SwatchColor=RGB(172, 196, 198))

colour_swatch_32 = ColourSwatch(SwatchColor=RGB(231, 160, 116))
colour_swatch_33 = ColourSwatch(SwatchColor=RGB(220, 175, 134))
colour_swatch_34 = ColourSwatch(SwatchColor=RGB(243, 210, 133))
colour_swatch_35 = ColourSwatch(SwatchColor=RGB(248, 245, 228))

# ---- group: Show results in model mode
separator_30 = CreateSeparator(Thickness=50, Horizontal=False, Color=RGBA(255, 255, 255, 0))
create_stack_18 = CreateStack(UIElements=[create_toggle_3, separator_30, create_stack_17], Horizontal=True)
create_stack_19 = CreateStack(UIElements=[label_64, create_gradient_editor, label_65], Horizontal=True)

# ---- group: Dark mode button
create_toggle_4 = CreateToggle(Default=False, Label="Dark Mode")
value_listener_15 = ValueListener(Elements=create_toggle_4, SomeProperty=True)  # -> Values, Indices

# ---- group: Building elements / Model colours
# Model colours
merge_15 = Merge(
    Data1=colour_swatch_28,
    Data2=colour_swatch_29,
    Data3=colour_swatch_30,
    Data4=colour_swatch_31,
    Data5=colour_swatch_24,
    Data6=colour_swatch_25,
    Data7=colour_swatch_26,
    Data8=colour_swatch_27,
    Data9=colour_swatch_19,
    Data10=colour_swatch_20,
    Data11=colour_swatch_21,
    Data12=colour_swatch_22,
    Data13=colour_swatch_23,
    Data14=colour_swatch_32,
    Data15=colour_swatch_33,
    Data16=colour_swatch_34,
    Data17=colour_swatch_35)

# ----
separator_31 = CreateSeparator(Thickness=50, Horizontal=False, Color=RGBA(255, 255, 255, 0))
create_stack_20 = CreateStack(UIElements=[create_toggle_4, separator_31, create_stack_16], Horizontal=True)
entwine_4 = Entwine(
    Branch00=value_listener_12.Values,
    Branch01=value_listener_12.Values,
    Branch02=value_listener_12.Values,
    Branch03=value_listener_12.Values,
    Branch04=value_listener_12.Values,
    Branch05=value_listener_12.Values,
    Branch06=value_listener_12.Values,
    Branch07=value_listener_12.Values,
    Branch08="0.8",
    Branch09=value_listener_12.Values,
    FlattenInputs=True)  # -> simplify(Result)

# ---- group: Building elements / Building elements captions
# Building elements captions
title = Slider(15, range=0..100)
title_2 = Slider(15, range=0..100)
label_66 = CreateLabel(LabelText="COLOURS           ", LabelSize=title_2, Justification=0)
label_67 = CreateLabel(LabelText="VISIBILITY", LabelSize=title, Justification=0)
separator_32 = CreateSeparator(Thickness=Slider(12, range=0..50), Horizontal=False, Color=RGBA(255, 255, 255, 0))
stack_13 = CreateStack(UIElements=flatten([label_66, separator_32, label_67]), Horizontal=True)

# ---- group: Building elements / Show/hide building elements toggles
separator_33 = CreateSeparator(Thickness="20", Horizontal=False, Color=RGBA(255, 255, 255, 0))
label_68 = CreateLabel(LabelText="Internal walls", LabelSize="15", Justification=1)
toggle = CreateToggle(Default=True, OnLabel="Show", OffLabel="Hide")
colorpicker = CreateColorPicker(DefaultColor=colour_swatch_28, AvailableColors=merge_15)
stack_14 = CreateStack(UIElements=flatten([colorpicker, separator_33, toggle, label_68]), Horizontal=True)

separator_34 = CreateSeparator(Thickness="20", Horizontal=False, Color=RGBA(255, 255, 255, 0))
label_69 = CreateLabel(LabelText="Floors", LabelSize="15", Justification=1)
toggle_2 = CreateToggle(Default=True, OnLabel="Show", OffLabel="Hide")
colorpicker_2 = CreateColorPicker(DefaultColor=colour_swatch_25, AvailableColors=merge_15)
stack_15 = CreateStack(UIElements=flatten([colorpicker_2, separator_34, toggle_2, label_69]), Horizontal=True)

separator_35 = CreateSeparator(Thickness="20", Horizontal=False, Color=RGBA(255, 255, 255, 0))
label_70 = CreateLabel(LabelText="Stairs and ramps", LabelSize="15", Justification=1)
toggle_3 = CreateToggle(Default=True, OnLabel="Show", OffLabel="Hide")
colorpicker_3 = CreateColorPicker(DefaultColor=colour_swatch_34, AvailableColors=merge_15)
stack_16 = CreateStack(UIElements=flatten([colorpicker_3, separator_35, toggle_3, label_70]), Horizontal=True)

separator_36 = CreateSeparator(Thickness="20", Horizontal=False, Color=RGBA(255, 255, 255, 0))
label_71 = CreateLabel(LabelText="External walls", LabelSize="15", Justification=1)
toggle_4 = CreateToggle(Default=True, OnLabel="Show", OffLabel="Hide")
colorpicker_4 = CreateColorPicker(DefaultColor=colour_swatch_28, AvailableColors=merge_15)
stack_17 = CreateStack(UIElements=flatten([colorpicker_4, separator_36, toggle_4, label_71]), Horizontal=True)

separator_37 = CreateSeparator(Thickness="20", Horizontal=False, Color=RGBA(255, 255, 255, 0))
label_72 = CreateLabel(LabelText="Foundation", LabelSize="15", Justification=1)
toggle_5 = CreateToggle(Default=True, OnLabel="Show", OffLabel=" Hide")
colorpicker_5 = CreateColorPicker(DefaultColor=colour_swatch_24, AvailableColors=merge_15)
stack_18 = CreateStack(UIElements=flatten([colorpicker_5, separator_37, toggle_5, label_72]), Horizontal=True)

separator_38 = CreateSeparator(Thickness="20", Horizontal=False, Color=RGBA(255, 255, 255, 0))
label_73 = CreateLabel(LabelText="Roofs", LabelSize="15", Justification=1)
toggle_6 = CreateToggle(Default=True, OnLabel="Show", OffLabel="Hide")
colorpicker_6 = CreateColorPicker(DefaultColor=colour_swatch_28, AvailableColors=merge_15)
stack_19 = CreateStack(UIElements=flatten([colorpicker_6, separator_38, toggle_6, label_73]), Horizontal=True)

separator_39 = CreateSeparator(Thickness="20", Horizontal=False, Color=RGBA(255, 255, 255, 0))
label_74 = CreateLabel(LabelText="Ground", LabelSize="15", Justification=1)
toggle_7 = CreateToggle(Default=True, OnLabel="Show", OffLabel=" Hide")
colorpicker_7 = CreateColorPicker(DefaultColor=colour_swatch_33, AvailableColors=merge_15)
stack_20 = CreateStack(UIElements=flatten([colorpicker_7, separator_39, toggle_7, label_74]), Horizontal=True)

separator_40 = CreateSeparator(Thickness="20", Horizontal=False, Color=RGBA(255, 255, 255, 0))
label_75 = CreateLabel(LabelText="Load bearing structures", LabelSize="15", Justification=1)
toggle_8 = CreateToggle(Default=True, OnLabel="Show", OffLabel="Hide")
colorpicker_8 = CreateColorPicker(DefaultColor=colour_swatch_19, AvailableColors=merge_15)
stack_21 = CreateStack(UIElements=flatten([colorpicker_8, separator_40, toggle_8, label_75]), Horizontal=True)

separator_41 = CreateSeparator(Thickness="20", Horizontal=False, Color=RGBA(255, 255, 255, 0))
label_76 = CreateLabel(LabelText="Windows", LabelSize="15", Justification=1)
toggle_9 = CreateToggle(Default=True, OnLabel="Show", OffLabel="Hide")
colorpicker_9 = CreateColorPicker(DefaultColor=colour_swatch_31, AvailableColors=merge_15)
stack_22 = CreateStack(UIElements=flatten([colorpicker_9, separator_41, toggle_9, label_76]), Horizontal=True)

separator_42 = CreateSeparator(Thickness="20", Horizontal=False, Color=RGBA(255, 255, 255, 0))
label_77 = CreateLabel(LabelText="Doors", LabelSize="15", Justification=1)
toggle_10 = CreateToggle(Default=True, OnLabel="Show", OffLabel="Hide")
colorpicker_10 = CreateColorPicker(DefaultColor=colour_swatch_35, AvailableColors=merge_15)
stack_23 = CreateStack(UIElements=flatten([colorpicker_10, separator_42, toggle_10, label_77]), Horizontal=True)

# Show/hide building elements toggles
values = ValueListener(
    Elements=[toggle_7, toggle_5, toggle_4, toggle, toggle_2, toggle_3, toggle_6, toggle_8, toggle_9, toggle_10],
    SomeProperty=True)  # -> simplify(graft(Values)), Indices
value_listener_16 = ValueListener(
    Elements=[colorpicker_7, colorpicker_5, colorpicker_4, colorpicker, colorpicker_2, colorpicker_3, colorpicker_6, colorpicker_8, colorpicker_9, colorpicker_10],
    SomeProperty=True)  # -> Values, Indices
stack_24 = CreateStack(
    UIElements=[stack_20, stack_18, stack_17, stack_14, stack_15, stack_16, stack_19, stack_21, stack_22, stack_23],
    Horizontal=False)

# ---- group: Results per generic class / Geometries per generic class
# Geometries per generic class
tree_statistics_2 = TreeStatistics(Tree=stream_gate_2.Target1)  # -> Paths, Length, Count
deconstruct_path = DeconstructPath(Branch=tree_statistics_2.Paths)  # -> flatten(Indices)
list_item_11 = ListItem(List=deconstruct_path, Index=0, Wrap=True)
stream_filter_4 = StreamFilter(
    Gate=list_item_11,
    Stream0=geometries_environmental_impact,
    Stream1=geometries_circularity,
    Stream2=geometries_financial_impact)
cull_index_8 = CullIndex(List=stream_filter_4, Indices=0, Wrap=True)  # -> simplify(List)
tstat_7 = TreeStatistics(Tree=cull_index_8)  # -> Paths, Length, Count
dpath_7 = DeconstructPath(Branch=tstat_7.Paths)
item_7 = ListItem(List=dpath_7, Index=0, Wrap=True)
path_7 = ConstructPath(Indices=item_7)
replace_7 = ReplacePaths(Data=cull_index_8, Search=tstat_7.Paths, Replace=flatten(path_7))
c_script_7 = CSharpScript(x=replace_7)  # -> A; inputs x: tree; same code as c_script
cluster_10 = Cluster_2(tree=c_script_7)
mesh_join_2 = MeshJoin(Meshes=cluster_10)
clean_tree = CleanTree(RemoveNulls=True, RemoveInvalid=True, RemoveEmpty=False, Tree=mesh_join_2)
cull_pattern_4 = CullPattern(List=clean_tree, CullPattern=values.Values)

# ---- group: Building elements
stack_25 = CreateStack(UIElements=flatten([stack_13, stack_24]), Horizontal=False)

# ----
# Tab 3: View
separator_43 = CreateSeparator(Thickness=10, Horizontal=True, Color=RGBA(255, 255, 255, 0))
create_stack_21 = CreateStack(UIElements=[create_stack_20, separator_43, create_stack_18, create_stack_19], Horizontal=False)
merge_16 = Merge(
    Data1=headliner_2,
    Data2=label_59,
    Data3=label_60,
    Data4=separator_27,
    Data5=create_stack_21,
    Data6=merge_14,
    Data7=stack_25)  # -> flatten(Tab3ModelView)

# ---- group: Results per generic class / PCI per generic class
# PCI per generic class
multiplication_10 = Multiplication(A=cluster_8, B=cluster_9)
mass_addition_7 = MassAddition(Input=cluster_9)  # -> TotalMKI, PartialResults
mass_addition_8 = MassAddition(Input=multiplication_10)  # -> Result, PartialResults
division_11 = Division(A=mass_addition_8.Result, B=mass_addition_7.TotalMKI)
round_2 = Round(Number=division_11)  # -> Nearest, Floor, Ceiling
clean_tree_2 = CleanTree(RemoveNulls=True, RemoveInvalid=True, RemoveEmpty=False, Tree=round_2.Nearest)

# ---- group: Results per generic class / DP per generic class
# DP per generic class
split_tree_25 = SplitTree(Data=cluster_2, Masks=flatten(["{?;?;49}", "{?;0;0}"]))  # -> Positive, Negative
tree_branch_11 = TreeBranch(Tree=split_tree_25.Positive, Path="{1;0;0}", MaintainPaths=True)
list_length_11 = ListLength(List=tree_branch_11)  # -> flatten(Length)
smaller_than_10 = SmallerThan(FirstNumber=list_length_11, SecondNumber=0)  # -> SmallerThan, OrEqualTo
stream_gate_12 = StreamGate(Stream=split_tree_25.Positive, Gate=smaller_than_10.OrEqualTo)  # -> Target0, Target1
split_tree_26 = SplitTree(Data=stream_gate_12.Target0, Masks=flatten("{1;0;0}"))  # -> Positive, Negative
dp_per_nl_sfb_class = Data([split_tree_26.Negative, stream_gate_12.Target1])
cull_index_9 = CullIndex(List=dp_per_nl_sfb_class, Indices=0, Wrap=True)  # -> simplify(List)
tstat_8 = TreeStatistics(Tree=cull_index_9)  # -> Paths, Length, Count
dpath_8 = DeconstructPath(Branch=tstat_8.Paths)
item_8 = ListItem(List=dpath_8, Index=0, Wrap=True)
path_8 = ConstructPath(Indices=item_8)
replace_8 = ReplacePaths(Data=cull_index_9, Search=tstat_8.Paths, Replace=flatten(path_8))
c_script_8 = CSharpScript(x=replace_8)  # -> A; inputs x: tree; same code as c_script
cluster_11 = Cluster_2(tree=c_script_8)
multiplication_11 = Multiplication(A=cluster_11, B=cluster_9)
mass_addition_9 = MassAddition(Input=multiplication_11)  # -> Result, PartialResults
division_12 = Division(A=mass_addition_9.Result, B=mass_addition_7.TotalMKI)
round_3 = Round(Number=division_12)  # -> Nearest, Floor, Ceiling
clean_tree_3 = CleanTree(RemoveNulls=True, RemoveInvalid=True, RemoveEmpty=False, Tree=round_3.Nearest)

# ---- group: Results per generic class / Geometries per generic class / Slightly offset meshes
# Slightly offset meshes
split_tree_27 = SplitTree(Data=cull_pattern_4, Masks=flatten("{7}"))  # -> Positive, Negative
number_slider_11 = Slider(0.05, range=0..1)
geometry = Geometry(split_tree_27.Negative)
geometry_2 = Geometry(split_tree_27.Positive)
offset_mesh = OffsetMesh(Mesh=geometry, Distance=number_slider_11, BothSides=expr("-X", number_slider_11), CreateSolid=True)  # -> simplify(OffsetModel)
merge_17 = Merge(Data1=offset_mesh, Data2=geometry_2)
final_model = Geometry(merge_17)

# ---- group: Colours (normal or gradient) for Rhino model
stream_gate_13 = StreamGate(Stream=final_model, Gate=value_listener_13.Values)  # -> Target0, Target1
stream_gate_14 = StreamGate(Stream=stream_gate_13.Target1, Gate=value_listener_14.Indices)  # -> Target0, Target1, Target2, Target3, Target4, Target5

# ---- group: Colours (normal or gradient) for Rhino model / Gradient MKI per class
# Gradient MKI per class
bnd = Bounds(Numbers=flatten(clean))
remap = RemapNumbers(Value=clean, Source=bnd, Target=Domain(0, 1))  # -> Mapped, Clipped
gradient_2 = Gradient(LowerLimit=0, UpperLimit=1, Parameter=remap.Mapped, stops=[0: RGB(0, 128, 0), 0.5: RGB(255, 255, 0), 1: RGB(255, 0, 0)])
ahsv = SplitAHSV(Colour=gradient_2)  # -> Alpha, Hue, Saturation, Value
hsv = ColourHSV(Alpha=1, Hue=ahsv.Hue, Saturation=ahsv.Saturation, Value=ahsv.Value)
create_material = CreateMaterial(Diffuse=hsv, Specular=RGB(255, 255, 255), Emission=hsv, Transparency=value_listener_12.Values, Shine=0)
custom_preview = CustomPreview(Geometry=stream_gate_14.Target0, Material=create_material)

# ---- group: Colours (normal or gradient) for Rhino model / Gradient GWP per class
# Gradient GWP per class
bnd_2 = Bounds(Numbers=flatten(clean_2))
remap_2 = RemapNumbers(Value=clean_2, Source=bnd_2, Target=Domain(0, 1))  # -> Mapped, Clipped
gradient_3 = Gradient(
    LowerLimit=0,
    UpperLimit=1,
    Parameter=remap_2.Mapped,
    stops=[0: RGB(0, 128, 0), 0.5: RGB(255, 255, 0), 1: RGB(255, 0, 0)])
ahsv_2 = SplitAHSV(Colour=gradient_3)  # -> Alpha, Hue, Saturation, Value
hsv_2 = ColourHSV(Alpha=1, Hue=ahsv_2.Hue, Saturation=ahsv_2.Saturation, Value=ahsv_2.Value)
create_material_2 = CreateMaterial(Diffuse=hsv_2, Specular=RGB(255, 255, 255), Emission=hsv_2, Transparency=value_listener_12.Values, Shine=0)
custom_preview_2 = CustomPreview(Geometry=stream_gate_14.Target1, Material=create_material_2)

# ---- group: Colours (normal or gradient) for Rhino model / Gradient PCI per class
# Gradient PCI per class
bnd_3 = Bounds(Numbers=flatten(clean_tree_2))
remap_3 = RemapNumbers(Value=clean_tree_2, Source=bnd_3, Target=Domain(0, 1))  # -> Mapped, Clipped
gradient_4 = Gradient(
    LowerLimit=0,
    UpperLimit=1,
    Parameter=remap_3.Mapped,
    stops=[0: RGB(255, 0, 0), 0.5: RGB(255, 255, 0), 1: RGB(0, 128, 0)])
ahsv_3 = SplitAHSV(Colour=gradient_4)  # -> Alpha, Hue, Saturation, Value
hsv_3 = ColourHSV(Alpha=1, Hue=ahsv_3.Hue, Saturation=ahsv_3.Saturation, Value=ahsv_3.Value)
create_material_3 = CreateMaterial(Diffuse=hsv_3, Specular=RGB(255, 255, 255), Emission=hsv_3, Transparency=value_listener_12.Values, Shine=0)
custom_preview_3 = CustomPreview(Geometry=stream_gate_14.Target2, Material=create_material_3)

# ---- group: Colours (normal or gradient) for Rhino model / Gradient DP per class
# Gradient DP per class
bnd_4 = Bounds(Numbers=flatten(clean_tree_3))
remap_4 = RemapNumbers(Value=clean_tree_3, Source=bnd_4, Target=Domain(0, 1))  # -> Mapped, Clipped
gradient_5 = Gradient(
    LowerLimit=0,
    UpperLimit=1,
    Parameter=remap_4.Mapped,
    stops=[0: RGB(255, 0, 0), 0.5: RGB(255, 255, 0), 1: RGB(0, 128, 0)])
ahsv_4 = SplitAHSV(Colour=gradient_5)  # -> Alpha, Hue, Saturation, Value
hsv_4 = ColourHSV(Alpha=1, Hue=ahsv_4.Hue, Saturation=ahsv_4.Saturation, Value=ahsv_4.Value)
create_material_4 = CreateMaterial(Diffuse=hsv_4, Specular=RGB(255, 255, 255), Emission=hsv_4, Transparency=value_listener_12.Values, Shine=0)
custom_preview_4 = CustomPreview(Geometry=stream_gate_14.Target3, Material=create_material_4)

# ---- group: Colours (normal or gradient) for Rhino model / Gradient Direct Costs per class
# Gradient Direct Costs per class
bnd_5 = Bounds(Numbers=flatten(clean_3))
remap_5 = RemapNumbers(Value=clean_3, Source=bnd_5, Target=Domain(0, 1))  # -> Mapped, Clipped
gradient_6 = Gradient(
    LowerLimit=0,
    UpperLimit=1,
    Parameter=remap_5.Mapped,
    stops=[0: RGB(0, 128, 0), 0.5: RGB(255, 255, 0), 1: RGB(255, 0, 0)])
ahsv_5 = SplitAHSV(Colour=gradient_6)  # -> Alpha, Hue, Saturation, Value
hsv_5 = ColourHSV(Alpha=1, Hue=ahsv_5.Hue, Saturation=ahsv_5.Saturation, Value=ahsv_5.Value)
create_material_5 = CreateMaterial(Diffuse=hsv_5, Specular=RGB(255, 255, 255), Emission=hsv_5, Transparency=value_listener_12.Values, Shine=0)
custom_preview_5 = CustomPreview(Geometry=stream_gate_14.Target4, Material=create_material_5)

# ---- group: Colours (normal or gradient) for Rhino model / Gradient True Price per class
# Gradient True Price per class
bnd_6 = Bounds(Numbers=flatten(clean_4))
remap_6 = RemapNumbers(Value=clean_4, Source=bnd_6, Target=Domain(0, 1))  # -> Mapped, Clipped
gradient_7 = Gradient(
    LowerLimit=0,
    UpperLimit=1,
    Parameter=remap_6.Mapped,
    stops=[0: RGB(0, 128, 0), 0.5: RGB(255, 255, 0), 1: RGB(255, 0, 0)])
ahsv_6 = SplitAHSV(Colour=gradient_7)  # -> Alpha, Hue, Saturation, Value
hsv_6 = ColourHSV(Alpha=1, Hue=ahsv_6.Hue, Saturation=ahsv_6.Saturation, Value=ahsv_6.Value)
create_material_6 = CreateMaterial(Diffuse=hsv_6, Specular=RGB(255, 255, 255), Emission=hsv_6, Transparency=value_listener_12.Values, Shine=0)
custom_preview_6 = CustomPreview(Geometry=stream_gate_14.Target5, Material=create_material_6)

# ---- group: Colours (normal or gradient) for Rhino model / Model custom preview
# Model custom preview
create_material_7 = CreateMaterial(
    Diffuse=value_listener_16.Values,
    Specular=RGB(255, 255, 255),
    Emission=value_listener_16.Values,
    Transparency=entwine_4,
    Shine=Slider(100, range=0..100))
custom_preview_7 = CustomPreview(Geometry=stream_gate_13.Target0, Material=create_material_7)

# ---- group: Top captions
list_item_12 = ListItem(List=flatten(building_information), Index=1, Wrap=True)
label_78 = CreateLabel(LabelText=" ", LabelSize=18, Justification=0)
headliner_3 = CreateLabel(LabelText="EXPLORE", LabelSize=24, Justification=0)
separator_44 = CreateSeparator(Thickness=20, Horizontal=True, Color=RGBA(255, 255, 255, 0))
setlabel_7 = SetLabelContents(LabelToModify=label_78, NewLabelContents=list_item_12)

# ---- group: Start exploring button
create_toggle_5 = CreateToggle(Default=False, Label="Start exploring!")
value_listener_17 = ValueListener(Elements=create_toggle_5, SomeProperty=True)  # -> Values, Indices

# ---- group: Explanation
panel_40 = Panel("This function is only available if you have connected the Wallacei optimisation plugin and followed the steps in relifecycle_example_script_wallacei_integration.")
create_text_block = CreateTextBlock(Text=panel_40, TextSize=16, Justification=0)
adjust_element_appearance_17 = AdjustElementAppearance(ElementsToAdjust=create_text_block, Foreground=RGB(0, 0, 0))

# ----
# Tab 4: Explore
separator_45 = CreateSeparator(Thickness=20, Horizontal=True, Color=RGBA(255, 255, 255, 0))
merge_18 = Merge(
    Data1=headliner_3,
    Data2=label_78,
    Data3=separator_44,
    Data4=create_toggle_5,
    Data5=separator_45,
    Data6=create_text_block)  # -> flatten(Tab2DetailedResults)

# ---- group: Optimised solutions heading
label_79 = CreateLabel(LabelText="OPTIMISED SOLUTIONS", LabelSize=18, Justification=0)
separator_46 = CreateSeparator(Thickness=20, Horizontal=True, Color=RGBA(255, 255, 255, 0))
merge_19 = Merge(Data1=label_79, Data2=separator_46)

# ---- group: Save and load heading
label_80 = CreateLabel(LabelText="SAVE AND LOAD", LabelSize=18, Justification=0)
separator_47 = CreateSeparator(Thickness=20, Horizontal=True, Color=RGBA(255, 255, 255, 0))
separator_48 = CreateSeparator(Thickness=20, Horizontal=True, Color=RGBA(255, 255, 255, 0))
merge_20 = Merge(Data1=separator_47, Data2=label_80, Data3=separator_48)

# ---- group: Top captions
panel_41 = Panel("""If the Wallacei optimisation plugin is used in your script and you followed the steps in relifecycle_example_script_wallacei_integration, you are able to select, save and load optimised solutions here. 

Enable the solution selector to select different variants with the slider. The results will update automatically in the ReLifeCycle Results window. When you've found an interesting variant, you can name and save it below.

When you have multiple variants saved, you can set one as a comparison variant by clicking the "Set as comparison variant" button. Afterwards you can load a different variant as baseline and in the "Compare" tab in this window you can effectively compare the two.""")
# RELIFECYCLE EXPLORE WINDOW
headliner_4 = CreateLabel(LabelText="EXPLORATION SETTINGS", LabelSize=24, Justification=0)
label_81 = CreateLabel(LabelText=" ", LabelSize=18, Justification=0)
list_item_13 = ListItem(List=flatten(building_information), Index=1, Wrap=True)
tb_2 = CreateTextBlock(Text=panel_41, TextSize=12, Justification=0)
expander_3 = CreateExpander(UIElements=tb_2, Header="Explanation", Open=False)
setlabel_8 = SetLabelContents(LabelToModify=label_81, NewLabelContents=list_item_13)
merge_21 = Merge(Data1=headliner_4, Data2=label_81, Data3=expander_3)

# ---- group: Solution selector interface elements / Toggle solution selector
# Toggle solution selector
create_toggle_6 = CreateToggle(Default=False, Label="Enable solution selector")
values_2 = ValueListener(Elements=create_toggle_6, SomeProperty=True)  # -> Values, Indices

# ---- group: Top captions
label_82 = CreateLabel(LabelText=" ", LabelSize=18, Justification=0)
headliner_5 = CreateLabel(LabelText="OVERVIEW RESULTS - COMPARISON", LabelSize=24, Justification=0)
list_item_14 = ListItem(List=flatten(building_information), Index=1, Wrap=True)
setlabel_9 = SetLabelContents(LabelToModify=label_82, NewLabelContents=list_item_14)
merge_22 = Merge(Data1=headliner_5, Data2=label_82)

# ---- group: General information heading
label_83 = CreateLabel(LabelText="GENERAL INFORMATION", LabelSize=18, Justification=0)
separator_49 = CreateSeparator(Thickness=10, Horizontal=True, Color=RGBA(255, 255, 255, 0))
merge_23 = Merge(Data1=label_83, Data2=separator_49)

# ---- group: HNN toggle
create_toggle_7 = CreateToggle(Default=False, Label="Compare with HNN")
separator_50 = CreateSeparator(Thickness=10, Horizontal=True, Color=RGBA(255, 255, 255, 0))
panel_42 = Panel("Set results against the performance levels of Het Nieuwe Normaal (HNN)")
merge_24 = Merge(Data1=separator_50, Data2=create_toggle_7)
value_listener_18 = ValueListener(Elements=create_toggle_7, SomeProperty=True)  # -> Values, Indices
tooltip_10 = AttachTooltipToElement(ElementsToAttachTo=create_toggle_7, TooltipContent=panel_42, ShowDelay=500, Duration=100000)

# ---- group: Environmental impact heading
label_84 = CreateLabel(LabelText="ENVIRONMENTAL IMPACT", LabelSize=18, Justification=0)
separator_51 = CreateSeparator(Thickness=10, Horizontal=True, Color=RGBA(255, 255, 255, 0))
separator_52 = CreateSeparator(Thickness=10, Horizontal=True, Color=RGBA(255, 255, 255, 0))
colour_swatch_36 = ColourSwatch(SwatchColor=RGB(42, 91, 115))
adjust_element_appearance_18 = AdjustElementAppearance(
    ElementsToAdjust=label_84,
    Foreground=ColourSwatch(SwatchColor=RGB(255, 255, 255)),
    Background=ColourSwatch(SwatchColor=RGB(42, 91, 115)))
merge_25 = Merge(Data1=separator_51, Data2=label_84, Data3=separator_52)

# ---- group: Total circularity results / Circularity heading
# Circularity heading
label_85 = CreateLabel(LabelText="CIRCULARITY", LabelSize=18, Justification=0)
separator_53 = CreateSeparator(Thickness=4, Horizontal=True, Color=RGBA(255, 255, 255, 0))
separator_54 = CreateSeparator(Thickness=10, Horizontal=True, Color=RGBA(255, 255, 255, 0))
adjust_element_appearance_19 = AdjustElementAppearance(
    ElementsToAdjust=label_85,
    Foreground=ColourSwatch(SwatchColor=RGB(255, 255, 255)),
    Background=ColourSwatch(SwatchColor=RGB(77, 137, 116)))
merge_26 = Merge(Data1=separator_53, Data2=label_85, Data3=separator_54)

# ---- group: Total circularity results / Data source
# Data source
create_label_4 = CreateLabel(LabelText="Data Source: NIBE", LabelSize=8, Justification=0)
separator_55 = CreateSeparator(Thickness=5, Horizontal=True, Color=RGBA(255, 255, 255, 0))
data_source_4 = Merge(Data1=separator_55, Data2=create_label_4)

# ---- group: Environmental Impact Total Results / Data source
# Data source
create_label_5 = CreateLabel(LabelText="Data Source: NMD", LabelSize=8, Justification=0)
separator_56 = CreateSeparator(Thickness=5, Horizontal=True, Color=RGBA(255, 255, 255, 0))
data_source_5 = Merge(Data1=separator_56, Data2=create_label_5)

# ---- group: Financial impact heading
label_86 = CreateLabel(LabelText="FINANCIAL IMPACT", LabelSize=18, Justification=0)
separator_57 = CreateSeparator(Thickness=4, Horizontal=True, Color=RGBA(255, 255, 255, 0))
adjust_element_appearance_20 = AdjustElementAppearance(
    ElementsToAdjust=label_86,
    Foreground=ColourSwatch(SwatchColor=RGB(255, 255, 255)),
    Background=ColourSwatch(SwatchColor=RGB(245, 200, 61)))
merge_27 = Merge(Data1=separator_57, Data2=label_86)

# ---- group: "Total costs" heading
label_87 = CreateLabel(LabelText="TOTAL COSTS", LabelSize="15", Justification=0)
separator_58 = CreateSeparator(Thickness=10, Horizontal=True, Color=RGBA(255, 255, 255, 0))
adjust_element_appearance_21 = AdjustElementAppearance(
    ElementsToAdjust=label_87,
    Foreground=ColourSwatch(SwatchColor=RGB(255, 255, 255)),
    Background=ColourSwatch(SwatchColor=RGB(249, 222, 139)))
merge_28 = Merge(Data1=label_87, Data2=separator_58)

# ---- group: "Costs per m" heading
label_88 = CreateLabel(LabelText="COSTS PER M2 GFA", LabelSize="15", Justification=0)
separator_59 = CreateSeparator(Thickness=10, Horizontal=True, Color=RGBA(255, 255, 255, 0))
separator_60 = CreateSeparator(Thickness=10, Horizontal=True, Color=RGBA(255, 255, 255, 0))
adjust_element_appearance_22 = AdjustElementAppearance(
    ElementsToAdjust=label_88,
    Foreground=ColourSwatch(SwatchColor=RGB(255, 255, 255)),
    Background=ColourSwatch(SwatchColor=RGB(249, 222, 139)))
merge_29 = Merge(Data1=separator_59, Data2=label_88, Data3=separator_60)

# ---- group: "Investment Costs" heading
label_89 = CreateLabel(LabelText="INVESTMENT COSTS", LabelSize="15", Justification=0)
separator_61 = CreateSeparator(Thickness=10, Horizontal=True, Color=RGBA(255, 255, 255, 0))
separator_62 = CreateSeparator(Thickness=10, Horizontal=True, Color=RGBA(255, 255, 255, 0))
adjust_element_appearance_23 = AdjustElementAppearance(
    ElementsToAdjust=label_89,
    Foreground=ColourSwatch(SwatchColor=RGB(255, 255, 255)),
    Background=ColourSwatch(SwatchColor=RGB(249, 222, 139)))
merge_30 = Merge(Data1=separator_61, Data2=label_89, Data3=separator_62)

# ---- group: Data source
create_label_6 = CreateLabel(LabelText="Data Source: ArchiCalc", LabelSize=8, Justification=0)
separator_63 = CreateSeparator(Thickness=5, Horizontal=True, Color=RGBA(255, 255, 255, 0))
data_source_6 = Merge(Data1=separator_63, Data2=create_label_6)

# ---- group: General information
building_information_2 = Data(building_information)
list_item_15 = ListItem(List=building_information_2, Index=1, Wrap=True)
explode_tree_8 = ExplodeTree(Data=list_item_15)  # -> Branch0, Branch1, Branch2, Branch3
panel_43 = Panel("""Project name:   
Variant name:   
Building function:   
Functional lifespan:   """)
number_slider_12 = Slider(13, range=1..30)
format_3 = Format(Format="{0} years", Culture=127, Data0=explode_tree_8.Branch1)
label_90 = CreateLabel(LabelText=panel_43, LabelSize=number_slider_12, Justification=0)
label_91 = CreateLabel(LabelSize=number_slider_12, Justification=0)
create_stack_22 = CreateStack(UIElements=label_90, Horizontal=False)
create_stack_23 = CreateStack(UIElements=label_91, Horizontal=False)
separator_64 = CreateSeparator(Thickness=20, Horizontal=False, Color=RGBA(255, 255, 255, 0))

# ---- group: HNN performance indicators
building_function = Data(explode_tree_8.Branch2)
expression_9 = Expression(
    X=building_function,
    Expression="If(x=\"Residential function - ground based\", 0.45, If(x =\"Residential function - stacked\", 0.50, 0.70))")
expression_10 = Expression(
    X=building_function,
    Expression="If(x=\"Residential function - ground based\", 55, If(x =\"Residential function - stacked\", 50, 55))")
expression_11 = Expression(
    X=building_function,
    Expression="If(x=\"Residential function - ground based\", 75, If(x =\"Residential function - stacked\", 80, 75))")
expression_12 = Expression(X=building_function, Expression="If(x=\"Residential function - ground based\", 200, 240)")
format_4 = Format(Format="≤{0} (HNN)", Culture=127, Data0=expression_9)
format_5 = Format(Format="≤{0} (HNN)", Culture=127, Data0=expression_12)
format_6 = Format(Format="≥{0}% (HNN)", Culture=127, Data0=expression_10)
format_7 = Format(Format="≤{0}% new (HNN)", Culture=127, Data0=expression_11)

# ---- group: General information / GFA
# GFA
round_4 = Round(Number=explode_tree_8.Branch3)  # -> Nearest, Floor, Ceiling
label_92 = CreateLabel(LabelText="GFA:", LabelSize=24, Justification=0)
label_93 = CreateLabel(LabelText=" ", LabelSize=24, Justification=0)
format_8 = Format(Format="{0} m2", Culture=127, Data0=round_4.Nearest)
create_stack_24 = CreateStack(UIElements=[label_92, label_93], Horizontal=False)
setlabel_10 = SetLabelContents(LabelToModify=label_93, NewLabelContents=format_8)

# ---- group: Financial impact / Investment costs per element class / Investment costs per m2 GFA per generic class
# Investment costs per m2 GFA per generic class
split_tree_28 = SplitTree(Data=cluster_3, Masks=flatten(["{?;?;17}", "{?;0;0}"]))  # -> Positive, Negative
tree_branch_12 = TreeBranch(Tree=split_tree_28.Positive, Path="{1;0;0}", MaintainPaths=True)
list_length_12 = ListLength(List=tree_branch_12)  # -> flatten(Length)
# Baseline variant total results
smaller_than_11 = SmallerThan(FirstNumber=list_length_12, SecondNumber=0)  # -> SmallerThan, OrEqualTo
stream_gate_15 = StreamGate(Stream=split_tree_28.Positive, Gate=smaller_than_11.OrEqualTo)  # -> Target0, Target1
split_tree_29 = SplitTree(Data=stream_gate_15.Target0, Masks=flatten("{1;0;0}"))  # -> Positive, Negative
direct_costs_per_nl_sfb_class_2 = Data([split_tree_29.Negative, stream_gate_15.Target1])
cull_index_10 = CullIndex(List=direct_costs_per_nl_sfb_class_2, Indices=0, Wrap=True)  # -> simplify(List)
tstat_9 = TreeStatistics(Tree=cull_index_10)  # -> Paths, Length, Count
dpath_9 = DeconstructPath(Branch=tstat_9.Paths)
item_9 = ListItem(List=dpath_9, Index=0, Wrap=True)
path_9 = ConstructPath(Indices=item_9)
replace_9 = ReplacePaths(Data=cull_index_10, Search=tstat_9.Paths, Replace=flatten(path_9))
c_script_9 = CSharpScript(x=replace_9)  # -> A; inputs x: tree; same code as c_script
cluster_12 = Cluster_2(tree=c_script_9)
mass_addition_10 = MassAddition(Input=cluster_12)  # -> Result, PartialResults
clean_5 = CleanTree(RemoveNulls=True, RemoveInvalid=True, RemoveEmpty=False, Tree=mass_addition_10.Result)
division_13 = Division(A=clean_5, B=explode_tree_8.Branch3)
round_5 = Round(Number=division_13)  # -> Nearest, Floor, Ceiling
c_script_10 = CSharpScript(x=round_5.Nearest)  # -> A; inputs x: tree
# ---------- c_script_10: C# ----------
// Grasshopper Script Instance
#region Usings
using System;
using System.Linq;
using System.Collections;
using System.Collections.Generic;
using System.Drawing;

using Rhino;
using Rhino.Geometry;

using Grasshopper;
using Grasshopper.Kernel;
using Grasshopper.Kernel.Data;
using Grasshopper.Kernel.Types;
#endregion

public class Script_Instance : GH_ScriptInstance
{
    #region Notes
    /* 
      Members:
        RhinoDoc RhinoDocument
        GH_Document GrasshopperDocument
        IGH_Component Component
        int Iteration

      Methods (Virtual & overridable):
        Print(string text)
        Print(string format, params object[] args)
        Reflect(object obj)
        Reflect(object obj, string method_name)
    */
    #endregion

private void RunScript(DataTree<object> x, ref object A)
{
foreach(GH_Path p in x.Paths){
if(x.Branch(p).Count == 0){
x.Add(0, p);
}
}
A = x;
}
}
# ---------- end c_script_10 ----------

# ---- group: Financial impact / Direct costs - per m2 GFA
# Direct costs - per m2 GFA
division_14 = Division(A=number, B=explode_tree_8.Branch3)
round_6 = Round(Number=division_14)  # -> Nearest, Floor, Ceiling
colour_swatch_37 = ColourSwatch(SwatchColor=RGB(245, 200, 61))
format_9 = Format(Format="€{0}.-", Culture=127, Data0=round_6.Nearest)  # -> simplify(Text)
label_94 = CreateLabel(LabelText="/ m2 GFA", LabelSize="15", Justification=0)
label_95 = CreateLabel(LabelText="Direct Costs", LabelSize=18, Justification=0)
label_96 = CreateLabel(LabelText=" A", LabelSize=Slider(29, range=0..100), Justification=0)
create_stack_25 = CreateStack(UIElements=flatten([label_96, label_94]), Horizontal=True)
adjust_element_appearance_24 = AdjustElementAppearance(ElementsToAdjust=label_94, Foreground=colour_swatch_37)
setlabel_11 = SetLabelContents(LabelToModify=label_96, NewLabelContents=format_9)
adjustelem_8 = AdjustElementAppearance(ElementsToAdjust=label_96, Foreground=colour_swatch_37)
adjust_element_positioning_6 = AdjustElementPositioning(ElementsToAdjust=label_94, AbsolutePositioning=False, VerticalAlignment=1)
panel_44 = Panel("Direct costs of the building per m2 GFA, consisting of material and labour costs.")
stack_26 = CreateStack(UIElements=[label_95, create_stack_25], Horizontal=False)
tooltip_11 = AttachTooltipToElement(ElementsToAttachTo=stack_26, TooltipContent=panel_44, ShowDelay=500, Duration=100000)

# ---- group: Financial impact / True price - per m2 GF
# True price - per m2 GF
division_15 = Division(A=number_4, B=explode_tree_8.Branch3)
round_7 = Round(Number=division_15)  # -> Nearest, Floor, Ceiling
colour_swatch_38 = ColourSwatch(SwatchColor=RGB(245, 200, 61))
format_10 = Format(Format="€{0}.-", Culture=127, Data0=round_7.Nearest)  # -> simplify(Text)
label_97 = CreateLabel(LabelText="/ m2 GFA", LabelSize="15", Justification=0)
label_98 = CreateLabel(LabelText="True Price", LabelSize=18, Justification=0)
label_99 = CreateLabel(LabelText=" A", LabelSize=Slider(29, range=0..100), Justification=0)
create_stack_26 = CreateStack(UIElements=flatten([label_99, label_97]), Horizontal=True)
setlabel_12 = SetLabelContents(LabelToModify=label_99, NewLabelContents=format_10)
adjust_element_appearance_25 = AdjustElementAppearance(ElementsToAdjust=label_97, Foreground=colour_swatch_38)
adjustelem_9 = AdjustElementAppearance(ElementsToAdjust=label_99, Foreground=colour_swatch_38)
adjust_element_positioning_7 = AdjustElementPositioning(ElementsToAdjust=label_97, AbsolutePositioning=False, VerticalAlignment=1)
panel_45 = Panel("True price of the building per m2 GFA, consisting of the direct costs and total MKI (environmental shadow costs).")
stack_27 = CreateStack(UIElements=[label_98, create_stack_26], Horizontal=False)
tooltip_12 = AttachTooltipToElement(ElementsToAttachTo=stack_27, TooltipContent=panel_45, ShowDelay=500, Duration=100000)

# ---- group: Financial impact / Material, abour and shadow costs - per m2 GFA
# Material, abour and shadow costs - per m2 GFA
division_16 = Division(A=number_2, B=explode_tree_8.Branch3)
division_17 = Division(A=number_3, B=explode_tree_8.Branch3)
division_18 = Division(A=number_5, B=explode_tree_8.Branch3)
round_8 = Round(Number=division_16)  # -> Nearest, Floor, Ceiling
round_9 = Round(Number=division_17)  # -> Nearest, Floor, Ceiling
round_10 = Round(Number=division_18)  # -> Nearest, Floor, Ceiling
merge_31 = Merge(Data1=round_8.Nearest, Data2=round_9.Nearest, Data3=round_10.Nearest)  # -> flatten(MaterialLabourCostsTruePrice)
panel_46 = Panel("""Material Costs
Labour Costs
Shadow Costs""")
chart_8 = CreateChart(Data=0, Names=" ", Title=" ", ChartType=1)
setchart_8 = SetChartContents(ChartToModify=chart_8, NewChartValues=merge_31, NewChartNames=panel_46)
chart_appearance_3 = ChartAppearance(
    ChartToModify=chart_8,
    Colors=[ColourSwatch(SwatchColor=RGB(245, 200, 61)), ColourSwatch(SwatchColor=RGB(249, 222, 139)), ColourSwatch(SwatchColor=RGB(251, 233, 177))],
    Legend=True,
    Title=False)
adjustelem_10 = AdjustElementAppearance(ElementsToAdjust=chart_8, Background=RGBA(255, 255, 255, 0))
panel_47 = Panel("Costs of the building per m2 GFA, consisting of material, labour and shadow (MKI) costs.")
adjust_element_positioning_8 = AdjustElementPositioning(
    ElementsToAdjust=chart_8,
    Margin="-7,-45,-10,-10",
    AbsolutePositioning=False,
    Width=Slider(257, range=100..300),
    Height=Slider(200, range=0..1000),
    HorizontalAlignment=3)
tooltip_13 = AttachTooltipToElement(ElementsToAttachTo=chart_8, TooltipContent=panel_47, ShowDelay=500, Duration=100000)

# ---- group: Financial impact / Investment results / Investment costs- per m2 GFA
# Investment costs- per m2 GFA
division_19 = Division(A=investment_costs, B=explode_tree_8.Branch3)
colour_swatch_39 = ColourSwatch(SwatchColor=RGB(245, 200, 61))
round_11 = Round(Number=division_19)  # -> Nearest, Floor, Ceiling
format_11 = Format(Format="€{0}.-", Culture=127, Data0=round_11.Nearest)  # -> simplify(Text)
label_100 = CreateLabel(LabelText="/ m2 GFA", LabelSize="15", Justification=0)
label_101 = CreateLabel(LabelText="Investment costs GFA", LabelSize=18, Justification=0)
label_102 = CreateLabel(LabelText=" A", LabelSize=Slider(29, range=0..100), Justification=0)
create_stack_27 = CreateStack(UIElements=flatten([label_102, label_100]), Horizontal=True)
adjust_element_appearance_26 = AdjustElementAppearance(ElementsToAdjust=label_100, Foreground=colour_swatch_39)
setlabel_13 = SetLabelContents(LabelToModify=label_102, NewLabelContents=format_11)
adjustelem_11 = AdjustElementAppearance(ElementsToAdjust=label_102, Foreground=colour_swatch_39)
adjust_element_positioning_9 = AdjustElementPositioning(ElementsToAdjust=label_100, AbsolutePositioning=False, VerticalAlignment=1)
panel_48 = Panel("Investment costs of the building per m2 GFA including preparation and risk costs")
stack_28 = CreateStack(UIElements=[label_101, create_stack_27], Horizontal=False)
tooltip_14 = AttachTooltipToElement(ElementsToAttachTo=stack_28, TooltipContent=panel_48, ShowDelay=500, Duration=100000)

# ---- group: Financial impact / Investment results / Investment costs decomposed - per m2 GFA
# Investment costs decomposed - per m2 GFA
division_20 = Division(AdditionalCosts=additional_costs, B=explode_tree_8.Branch3)
division_21 = Division(IndirectCosts=indirect_costs, B=explode_tree_8.Branch3)
division_22 = Division(DirectCosts=direct_costs, B=explode_tree_8.Branch3)
round_12 = Round(Number=division_22)  # -> Nearest, Floor, Ceiling
round_13 = Round(Number=division_21)  # -> Nearest, Floor, Ceiling
round_14 = Round(Number=division_20)  # -> Nearest, Floor, Ceiling
merge_32 = Merge(Data1=round_12.Nearest, Data2=round_13.Nearest, Data3=round_14.Nearest)  # -> flatten(MaterialLabourCostsTruePrice)
panel_49 = Panel("""Direct Costs
Indirect Costs
Additional Costs""")
chart_9 = CreateChart(Data=0, Names=" ", Title=" ", ChartType=1)
setchart_9 = SetChartContents(ChartToModify=chart_9, NewChartValues=merge_32, NewChartNames=panel_49)
chart_appearance_4 = ChartAppearance(
    ChartToModify=chart_9,
    Colors=[ColourSwatch(SwatchColor=RGB(245, 200, 61)), ColourSwatch(SwatchColor=RGB(249, 222, 139)), ColourSwatch(SwatchColor=RGB(251, 233, 177))],
    Legend=True,
    Title=False)
adjustelem_12 = AdjustElementAppearance(ElementsToAdjust=chart_9, Background=RGBA(255, 255, 255, 0))
panel_50 = Panel("Costs of the building per m2 GFA, consisting of material, labour and shadow (MKI) costs.")
adjust_element_positioning_10 = AdjustElementPositioning(
    ElementsToAdjust=chart_9,
    Margin="-7,-45,-10,-10",
    AbsolutePositioning=False,
    Width=Slider(257, range=100..300),
    Height=Slider(200, range=0..1000),
    HorizontalAlignment=3)
tooltip_15 = AttachTooltipToElement(ElementsToAttachTo=chart_9, TooltipContent=panel_50, ShowDelay=500, Duration=100000)

# ---- group: Financial impact / Investment costs per element class
# Investment costs per element class
panel_51 = Panel("""Ground
Foundation
External walls
Internal walls
Floors
Stairs and ramps
Roofs
Load bearing structures
Windows
Doors""")
panel_52 = Panel("""€/m2 GFA
€/m2 GFA
€/m2 GFA
€/m2 GFA
€/m2 GFA
€/m2 GFA
€/m2 GFA
€/m2 GFA
€/m2 GFA
€/m2 GFA""")
entwine_5 = Entwine(Branch00=panel_51, Branch01=panel_52, Branch02=c_script_10, FlattenInputs=True)
create_data_table = CreateDataTable(Data=" ", ColumnHeadings=" ", AllowSorting=True, ColumnSizingMode=-1)
panel_53 = Panel("""Element class
Unit
Direct costs""")
create_expander_6 = CreateExpander(UIElements=create_data_table, Header="DIRECT COSTS PER ELEMENT CLASS", Open=False)
set_data_table = SetDataTable(DataTableToSet=create_data_table, Data=entwine_5, ColumnHeadings=panel_53)
create_separator = CreateSeparator(Thickness=10, Horizontal=True, Color=RGBA(0, 0, 0, 0))

# ---- group: Financial impact / Investment results
# Investment results
create_separator_2 = CreateSeparator(Thickness=20, Horizontal=False, Color=RGBA(0, 0, 0, 0))
stack_29 = CreateStack(UIElements=[stack_5, stack_28], Horizontal=False)
create_stack_28 = CreateStack(UIElements=[stack_29, create_separator_2, chart_9], Horizontal=True)

# ---- group: Financial impact
create_separator_3 = CreateSeparator(Thickness=20, Horizontal=False, Color=RGBA(0, 0, 0, 0))
create_separator_4 = CreateSeparator(Thickness=20, Horizontal=False, Color=RGBA(0, 0, 0, 0))
stack_30 = CreateStack(UIElements=[stack_6, stack_7, data_source_3], Horizontal=False)
stack_31 = CreateStack(UIElements=[stack_26, stack_27], Horizontal=False)
create_stack_29 = CreateStack(UIElements=[stack_30, create_separator_3, chart_3], Horizontal=True)
create_expander_7 = CreateExpander(UIElements=[create_stack_14, create_stack_15], Header="INVESTMENT VARIABLES", Open=False)
create_stack_30 = CreateStack(UIElements=[stack_31, create_separator_4, chart_8], Horizontal=True)
merge_33 = Merge(Data1=separator_15, Data2=label_40, Data3=create_expander_6, Data4=create_separator)
separator_65 = CreateSeparator(Thickness=10, Horizontal=True, Color=RGBA(255, 255, 255, 0))
create_stack_31 = CreateStack(UIElements=[create_expander_7, separator_65], Horizontal=False)
create_stack_32 = CreateStack(UIElements=[create_stack_29, merge_33, create_stack_30, merge_8, create_stack_31, create_stack_28], Horizontal=False)

# ---- group: Total building results / Direct costs per m2 GFA
# Direct costs per m2 GFA
panel_54 = Panel("""Direct costs per m2 GFA
[€]""")
panel_55 = Panel("""Material Costs
Labour Costs
Shadow Costs""")
chart_10 = CreateChart(Data="0", SubTitle=panel_54, ChartType=1)
setchart_10 = SetChartContents(ChartToModify=chart_10, NewChartValues=flatten(merge_31), NewChartNames=panel_55)

# ---- group: Total building results
adjustpos_3 = AdjustElementPositioning(
    ElementsToAdjust=[chart_10, chart_7],
    AbsolutePositioning=False,
    Width=Slider(220, range=0..2000),
    HorizontalAlignment=0,
    VerticalAlignment=3)
chartappearance_3 = ChartAppearance(ChartToModify=[chart_10, chart_7], Legend=True)
stack_32 = CreateStack(UIElements=flatten([chart_7, chart_10]), Horizontal=True)
colour_swatch_40 = ColourSwatch(SwatchColor=RGB(245, 200, 61))

# ---- group: Total building results / Total Building Results
# Total Building Results
expander_4 = CreateExpander(UIElements=flatten(stack_32), Header="TOTAL BUILDING RESULTS", Open=False)
adjust_element_appearance_27 = AdjustElementAppearance(
    ElementsToAdjust=expander_4,
    Foreground=ColourSwatch(SwatchColor=RGB(255, 255, 255)),
    Background=colour_swatch_40,
    FontSize=18)

# ---- group: Total circularity results / DP HNN
# DP HNN
larger_than = LargerThan(FirstNumber=explode_tree_4.Branch1, SecondNumber=expression_10)  # -> LargerThan, OrEqualTo
label_103 = CreateLabel(LabelText=" ", LabelSize=12, Justification=0)
setlabel_14 = SetLabelContents(LabelToModify=label_103, NewLabelContents=format_6)
stream_gate_16 = StreamGate(Stream=larger_than.OrEqualTo, Gate=value_listener.Values)  # -> Target0, Target1
stream_filter_5 = StreamFilter(Gate=value_listener.Values, Stream1=label_103)

# ---- group: Total circularity results / Material input HNN
# Material input HNN
smaller_than_12 = SmallerThan(FirstNumber=explode_tree_4.Branch2, SecondNumber=expression_11)  # -> SmallerThan, OrEqualTo
label_104 = CreateLabel(LabelText=" ", LabelSize=12, Justification=0)
stream_gate_17 = StreamGate(Stream=smaller_than_12.OrEqualTo, Gate=value_listener.Values)  # -> Target0, Target1
setlabel_15 = SetLabelContents(LabelToModify=label_104, NewLabelContents=format_7)
stream_filter_6 = StreamFilter(Gate=value_listener.Values, Stream1=label_104)

# ---- group: Total circularity results / DP
# DP
panel_56 = Panel("0")
colour_swatch_41 = ColourSwatch(SwatchColor=RGB(77, 137, 116))
colour_swatch_42 = ColourSwatch(SwatchColor=RGB(163, 21, 21))
colour_swatch_43 = ColourSwatch(SwatchColor=RGB(127, 127, 127))
total_dp = Data(explode_tree_4.Branch1)
label_105 = CreateLabel(LabelText="DP", LabelSize=18, Justification=0)
chart_11 = CreateChart(Data=panel_56, Title="BCI", ChartType=4)
setchart_11 = SetChartContents(ChartToModify=chart_11, NewChartValues=total_dp)
adjustelem_13 = AdjustElementAppearance(ElementsToAdjust=chart_11, Background=RGBA(255, 255, 255, 0))
viewbox_2 = CreateViewBox(UIElements=chart_11, Width=Slider(120, range=0..1000), Height=Slider(219, range=0..1000))
adjust_element_positioning_11 = AdjustElementPositioning(ElementsToAdjust=viewbox_2, Margin="-20,-70,-10,-40", AbsolutePositioning=False)
stack_33 = CreateStack(UIElements=[label_105, viewbox_2, stream_filter_5], Horizontal=False)
panel_57 = Panel("Disassembly Potential from 10% (most difficult to disassemble) to 100% (least difficult to disassemble)")
tooltip_16 = AttachTooltipToElement(ElementsToAttachTo=stack_33, TooltipContent=panel_57, ShowDelay=500, Duration=100000)

# ---- group: Total circularity results / DP HNN (continued)
stream_filter_7 = StreamFilter(Gate=stream_gate_16.Target1, Stream0=colour_swatch_42, Stream1=colour_swatch_41)
stream_filter_8 = StreamFilter(Gate=stream_gate_16.Target1, Stream0=colour_swatch_42, Stream1=colour_swatch_43)
adjustelem_14 = AdjustElementAppearance(ElementsToAdjust=label_103, Foreground=stream_filter_8)

# ---- group: Total building results / Total BCI and DP
# Total BCI and DP
panel_58 = Panel("""DP
[%]""")
panel_59 = Panel("""BCI
[%]""")
bci = Data(total_bci)
dp = Data(total_dp)
chart_12 = CreateChart(Data="0", SubTitle=panel_58, ChartType=4)
chart_13 = CreateChart(Data="0", SubTitle=panel_59, ChartType=4)
setchart_12 = SetChartContents(ChartToModify=chart_12, NewChartValues=flatten(dp))
setchart_13 = SetChartContents(ChartToModify=chart_13, NewChartValues=flatten(bci))
chart_appearance_5 = ChartAppearance(ChartToModify=[chart_13, chart_12], Legend=True, Title=True)
adjustpos_4 = AdjustElementPositioning(
    ElementsToAdjust=[chart_13, chart_12],
    AbsolutePositioning=False,
    Width=Slider(278, range=0..2000),
    HorizontalAlignment=0,
    VerticalAlignment=3)
number_slider_13 = Slider(200, range=0..1000)
number_slider_14 = Slider(280, range=0..1000)
viewbox_3 = CreateViewBox(UIElements=chart_13, Width=number_slider_13, Height=number_slider_14)
viewbox_4 = CreateViewBox(UIElements=chart_12, Width=number_slider_13, Height=number_slider_14)
adjust_element_positioning_12 = AdjustElementPositioning(ElementsToAdjust=chart_13, Margin="0,0,0,20", AbsolutePositioning=False)
adjust_element_positioning_13 = AdjustElementPositioning(ElementsToAdjust=chart_12, Margin="0,0,0,20", AbsolutePositioning=False)

# ---- group: Total circularity results / Material input
# Material input
colour_swatch_44 = ColourSwatch(SwatchColor=RGB(77, 137, 116))
colour_swatch_45 = ColourSwatch(SwatchColor=RGB(163, 21, 21))
colour_swatch_46 = ColourSwatch(SwatchColor=RGB(127, 127, 127))
merge_34 = Merge(Data1=explode_tree_4.Branch2, Data2=explode_tree_4.Branch3, Data3=explode_tree_4.Branch4, Data4=explode_tree_4.Branch5)  # -> flatten(MaterialInput)
panel_60 = Panel("""%New
%Biobased
%Recycled
%Reused""")
label_106 = CreateLabel(LabelText="Material Input", LabelSize=18, Justification=0)
chart_14 = CreateChart(Data=0, Names=" ", Title=" ", ChartType=0)
setchart_14 = SetChartContents(ChartToModify=chart_14, NewChartValues=merge_34, NewChartNames=panel_60)
adjustelem_15 = AdjustElementAppearance(ElementsToAdjust=chart_14, Background=RGBA(255, 255, 255, 0))
stack_34 = CreateStack(UIElements=[label_106, chart_14, stream_filter_6], Horizontal=False)
panel_61 = Panel("Material input flows, as percentages of building mass, normalized by MKI.")
adjust_element_positioning_14 = AdjustElementPositioning(
    ElementsToAdjust=chart_14,
    Margin="-7,-45,-10,-10",
    AbsolutePositioning=False,
    Width=Slider(162, range=100..300),
    Height=Slider(205, range=0..1000))
tooltip_17 = AttachTooltipToElement(ElementsToAttachTo=stack_34, TooltipContent=panel_61, ShowDelay=500, Duration=100000)

# ---- group: Total circularity results / Material input HNN (continued)
stream_filter_9 = StreamFilter(Gate=stream_gate_17.Target1, Stream0=colour_swatch_45, Stream1=colour_swatch_44)
stream_filter_10 = StreamFilter(Gate=stream_gate_17.Target1, Stream0=colour_swatch_45, Stream1=colour_swatch_46)
stream_filter_11 = StreamFilter(Gate=value_listener.Values, Stream0=colour_swatch_44, Stream1=stream_filter_9)
adjustelem_16 = AdjustElementAppearance(ElementsToAdjust=label_104, Foreground=stream_filter_10)

# ---- group: Total circularity results / Material input (continued)
chart_appearance_6 = ChartAppearance(
    ChartToModify=chart_14,
    Colors=[stream_filter_11, ColourSwatch(SwatchColor=RGB(141, 191, 174)), ColourSwatch(SwatchColor=RGB(179, 212, 201)), ColourSwatch(SwatchColor=RGB(217, 234, 228))],
    Legend=True,
    Title=False)

# ---- group: Total circularity results
stream_filter_12 = StreamFilter(Gate=value_listener.Values, Stream0=colour_swatch_41, Stream1=stream_filter_7)
create_stack_33 = CreateStack(UIElements=[stack_2, stack_33, stack_34, stack_3], Horizontal=True)

# ---- group: Total circularity results / DP (continued)
chartappearance_4 = ChartAppearance(ChartToModify=chart_11, Colors=stream_filter_12, Legend=False, Title=False)

# ---- group: Total building results / Total material input
# Total material input
panel_62 = Panel("""Material Input
[%]""")
panel_63 = Panel("""%New
%Biobased
%Recycled
%Reused""")
material_input = Data(merge_34)
chart_15 = CreateChart(Data=0, Names=" ", SubTitle=panel_62, ChartType=0)
setchart_15 = SetChartContents(ChartToModify=chart_15, NewChartValues=material_input, NewChartNames=panel_63)
chart_appearance_7 = ChartAppearance(ChartToModify=chart_15, Legend=True, Title=True)
adjustelem_17 = AdjustElementAppearance(ElementsToAdjust=chart_15, Background=RGBA(255, 255, 255, 0))
panel_64 = Panel("0,-45,0,-10")
number_slider_15 = Slider(220, range=100..300)
number_slider_16 = Slider(250, range=0..1000)
adjust_element_positioning_15 = AdjustElementPositioning(ElementsToAdjust=chart_15, Margin=panel_64, AbsolutePositioning=False, Width=number_slider_15, Height=number_slider_16)

# ---- group: Total building results / Total material output
# Total material output
panel_65 = Panel("""Material Output
[%]""")
panel_66 = Panel("""%Landfill
%Burning
%Recycling
%Reusing""")
material_output = Data(merge_6)
chart_16 = CreateChart(Data=0, Names=" ", SubTitle=panel_65, ChartType=0)
setchart_16 = SetChartContents(ChartToModify=chart_16, NewChartValues=material_output, NewChartNames=panel_66)
chart_appearance_8 = ChartAppearance(ChartToModify=chart_16, Legend=True, Title=True)
adjustelem_18 = AdjustElementAppearance(ElementsToAdjust=chart_16, Background=RGBA(255, 255, 255, 0))
adjust_element_positioning_16 = AdjustElementPositioning(ElementsToAdjust=chart_16, Margin=panel_64, AbsolutePositioning=False, Width=number_slider_15, Height=number_slider_16)

# ---- group: Total building results
stack_35 = CreateStack(UIElements=flatten([viewbox_3, viewbox_4]), Horizontal=True)
stack_36 = CreateStack(UIElements=flatten([chart_15, chart_16]), Horizontal=True)
colour_swatch_47 = ColourSwatch(SwatchColor=RGB(77, 137, 116))

# ---- group: Total building results / Total Building Results
# Total Building Results
expander_5 = CreateExpander(UIElements=flatten([stack_35, stack_36]), Header="TOTAL BUILDING RESULTS", Open=False)
adjust_element_appearance_28 = AdjustElementAppearance(
    ElementsToAdjust=expander_5,
    Foreground=ColourSwatch(SwatchColor=RGB(255, 255, 255)),
    Background=colour_swatch_47,
    FontSize=18)

# ---- group: Baseline variant total results
baseline_mpg = Data(expression)
baseline_pp = Data(expression_3)
baseline_csc = Data(expression_2)
baseline_bci = Data(explode_tree_4.Branch0)
baseline_dp = Data(explode_tree_4.Branch1)
baseline_material_input = Data(merge_34)
baseline_total_direct_costs = Data(expression_4)
baseline_total_true_price = Data(expression_7)
baseline_direct_costs_per_m2 = Data(division_14)
baseline_true_price_per_m2 = Data(division_15)
baseline_total_investment_costs = Data(investment_costs)
baseline_investment_costs_per_m2_gfa = Data(round_11.Nearest)
baseline_material_output = Data(merge_6)

# ---- group: General information (continued)
create_stack_34 = CreateStack(UIElements=[create_stack_22, create_stack_23, separator_64, create_stack_24], Horizontal=True)

# ---- group: Environmental Impact Total Results / MPG HNN
# MPG HNN
smaller_than_13 = SmallerThan(FirstNumber=expression, SecondNumber=expression_9)  # -> SmallerThan, OrEqualTo
label_107 = CreateLabel(LabelText=" ", LabelSize=12, Justification=0)
stream_gate_18 = StreamGate(Stream=smaller_than_13.OrEqualTo, Gate=value_listener.Values)  # -> Target0, Target1
setlabel_16 = SetLabelContents(LabelToModify=label_107, NewLabelContents=format_4)
stream_filter_13 = StreamFilter(Gate=value_listener.Values, Stream1=label_107)

# ---- group: Environmental Impact Total Results / PP HNN
# PP HNN
smaller_than_14 = SmallerThan(FirstNumber=expression_3, SecondNumber=expression_12)  # -> SmallerThan, OrEqualTo
stream_gate_19 = StreamGate(Stream=smaller_than_14.OrEqualTo, Gate=value_listener.Values)  # -> Target0, Target1
label_108 = CreateLabel(LabelText=" ", LabelSize=12, Justification=0)
setlabel_17 = SetLabelContents(LabelToModify=label_108, NewLabelContents=format_5)
stream_filter_14 = StreamFilter(Gate=value_listener.Values, Stream1=label_108)

# ---- group: Environmental Impact Total Results / MPG
# MPG
colour_swatch_48 = ColourSwatch(SwatchColor=RGB(42, 91, 115))
colour_swatch_49 = ColourSwatch(SwatchColor=RGB(163, 21, 21))
colour_swatch_50 = ColourSwatch(SwatchColor=RGB(127, 127, 127))
label_size_2 = Slider(15, range=0..100)
label_109 = CreateLabel(LabelText="MPG", LabelSize=18, Justification=0)
label_110 = CreateLabel(LabelText=" A", LabelSize=Slider(29, range=0..100), Justification=0)
label_111 = CreateLabel(LabelText="MKI / m2 GFA / year", LabelSize=label_size_2, Justification=0)
setlabel_18 = SetLabelContents(LabelToModify=label_110, NewLabelContents=expression)
adjustelem_19 = AdjustElementAppearance(ElementsToAdjust=[label_110, label_111], Foreground=colour_swatch_48)
panel_67 = Panel("MilieuPrestatie Gebouw (Environmental Performance Building) for the total building.")
stack_37 = CreateStack(UIElements=[label_109, label_110, label_111, stream_filter_13], Horizontal=False)
tooltip_18 = AttachTooltipToElement(ElementsToAttachTo=stack_37, TooltipContent=panel_67, ShowDelay=500, Duration=100000)

# ---- group: Environmental Impact Total Results / MPG HNN (continued)
stream_filter_15 = StreamFilter(Gate=stream_gate_18.Target1, Stream0=colour_swatch_49, Stream1=colour_swatch_48)
stream_filter_16 = StreamFilter(Gate=stream_gate_18.Target1, Stream0=colour_swatch_49, Stream1=colour_swatch_50)
stream_filter_17 = StreamFilter(Gate=value_listener.Values, Stream0=colour_swatch_48, Stream1=stream_filter_15)
adjustelem_20 = AdjustElementAppearance(ElementsToAdjust=label_107, Foreground=stream_filter_16)

# ---- group: Environmental Impact Total Results / MPG (continued)
adjustelem_21 = AdjustElementAppearance(ElementsToAdjust=label_110, Foreground=stream_filter_17)

# ---- group: Environmental Impact Total Results / PP
# PP
colour_swatch_51 = ColourSwatch(SwatchColor=RGB(42, 91, 115))
colour_swatch_52 = ColourSwatch(SwatchColor=RGB(163, 21, 21))
colour_swatch_53 = ColourSwatch(SwatchColor=RGB(127, 127, 127))
label_size_3 = Slider(15, range=0..100)
label_112 = CreateLabel(LabelText="Paris Proof Indicator", LabelSize=18, Justification=0)
label_113 = CreateLabel(LabelText=" ", LabelSize=Slider(29, range=0..100), Justification=0)
label_114 = CreateLabel(LabelText="kg CO2 eq. / m2 GFA", LabelSize=label_size_3, Justification=0)
setlabel_19 = SetLabelContents(LabelToModify=label_113, NewLabelContents=expression_3)
adjustelem_22 = AdjustElementAppearance(ElementsToAdjust=[label_113, label_114], Foreground=colour_swatch_51)
stack_38 = CreateStack(UIElements=[label_112, label_113, label_114, stream_filter_14], Horizontal=False)
tooltip_19 = AttachTooltipToElement(
    ElementsToAttachTo=stack_38,
    TooltipContent="Paris Proof Indicator for the total building.",
    ShowDelay=500,
    Duration=100000)

# ---- group: Environmental Impact Total Results / PP HNN (continued)
stream_filter_18 = StreamFilter(Gate=stream_gate_19.Target1, Stream0=colour_swatch_52, Stream1=colour_swatch_51)
stream_filter_19 = StreamFilter(Gate=stream_gate_19.Target1, Stream0=colour_swatch_52, Stream1=colour_swatch_53)
stream_filter_20 = StreamFilter(Gate=value_listener.Values, Stream0=colour_swatch_51, Stream1=stream_filter_18)
adjustelem_23 = AdjustElementAppearance(ElementsToAdjust=label_108, Foreground=stream_filter_19)

# ---- group: Environmental Impact Total Results / PP (continued)
adjustelem_24 = AdjustElementAppearance(ElementsToAdjust=label_113, Foreground=stream_filter_20)

# ---- group: Environmental Impact Total Results
separator_66 = CreateSeparator(Thickness=20, Horizontal=False, Color=RGBA(255, 255, 255, 0))
separator_67 = CreateSeparator(Thickness=20, Horizontal=False, Color=RGBA(255, 255, 255, 0))
create_stack_35 = CreateStack(UIElements=[stack_37, separator_66, stack_38, separator_67, stack_4], Horizontal=True)

# ----
# Tab 1: Overview results
merge_35 = Merge(
    Data1=merge_2,
    Data2=merge_3,
    Data3=create_stack_34,
    Data4=separator_8,
    Data5=expander,
    Data6=create_stack_4,
    Data7=merge_4,
    Data8=create_stack_35,
    Data9=data_source,
    Data10=merge_5,
    Data11=create_stack_33,
    Data12=data_source_2,
    Data13=merge_7,
    Data14=merge_10,
    Data15=create_stack_32)  # -> flatten(Tab1OverviewResults)

# ---- group: Interface Windows / ReLifeCycle Results window
# ReLifeCycle Results window
launch_transparent_window = LaunchTransparentWindow(
    Show=launch_results_interface,
    Name="ReLifeCycle Results",
    Width=division_6,
    Height=subtraction_3,
    FontFamily="Aptos Extrabold",
    ChildStatus=2,
    EnableHorizScroll=False)
panel_68 = Panel("""OVERVIEW RESULTS
DETAILED RESULTS
VIEW
EXPLORE""")

# ---- group: Interface Windows / ReLifeCycle Results window / Window properties
# Window properties
colour_swatch_54 = ColourSwatch(SwatchColor=RGBA(255, 255, 255, 230))
accent_colors = ValueList({"Amber", "Blue", "Brown", "Cobalt", "Crimson", "Cyan", "Emerald", "Green", "Indigo", "Lime", "Magenta", "Mauve", "Olive", "Orange", "Pink", "Purple", "Red", "Sienna", "Steel", "Taupe", "Teal", "Violet", "Yellow"}, selected="Crimson")
stream_filter_21 = StreamFilter(Gate=value_listener_15.Values, Stream0=0, Stream1=1)
stream_filter_22 = StreamFilter(Gate=value_listener_15.Values, Stream0=colour_swatch_54, Stream1=ColourSwatch(SwatchColor=RGBA(0, 0, 0, 210)))
set_window_properties = SetWindowProperties(
    Window=launch_transparent_window,
    StartingLocation="0,0",
    Theme=stream_filter_21,
    AccentColor=accent_colors,
    ShowTitleBar=True,
    BackgroundColor=stream_filter_22,
    ScaleFactor=1)

# ---- group: Interface Windows / ReLifeCycle Explore Window
# ReLifeCycle Explore Window
launch_transparent_window_2 = LaunchTransparentWindow(
    Show=value_listener_17.Values,
    Name="ReLifeCycle Explore",
    Width=division_6,
    Height=subtraction_3,
    FontFamily="Aptos Extrabold",
    ChildStatus=2,
    EnableHorizScroll=False)
panel_69 = Panel("""SETTINGS
COMPARE""")

# ---- group: Interface Windows / ReLifeCycle Explore Window / Window properties
# Window properties
colour_swatch_55 = ColourSwatch(SwatchColor=RGBA(255, 255, 255, 230))
format_12 = Format(Format="{0},0", Culture=127, Data0=subtraction_2)
accent_colors_2 = ValueList({"Amber", "Blue", "Brown", "Cobalt", "Crimson", "Cyan", "Emerald", "Green", "Indigo", "Lime", "Magenta", "Mauve", "Olive", "Orange", "Pink", "Purple", "Red", "Sienna", "Steel", "Taupe", "Teal", "Violet", "Yellow"}, selected="Teal")
stream_filter_23 = StreamFilter(Gate=value_listener_15.Values, Stream0=0, Stream1=1)
stream_filter_24 = StreamFilter(Gate=value_listener_15.Values, Stream0=colour_swatch_55, Stream1=ColourSwatch(SwatchColor=RGBA(0, 0, 0, 210)))
set_window_properties_2 = SetWindowProperties(
    Window=launch_transparent_window_2,
    StartingLocation=format_12,
    Theme=stream_filter_23,
    AccentColor=accent_colors_2,
    ShowTitleBar=True,
    BackgroundColor=stream_filter_24,
    ScaleFactor=1)

# ---- group: Text Types / Text types results window
# Text types results window
material_list_names = Data(label_5)
heading_2 = Data([label_61, label_2, label_60])
heading_3 = Data(label_7)
expander_2_2 = Data([create_expander, create_expander_2, create_expander_3, create_expander_4, create_expander_5])

# ---- group: Text Types / Text types explore window
# Text types explore window
headliner_6 = Data([headliner_4, headliner_5])
heading_1 = Data([label_81, label_82])
heading_2_2 = Data(label_83)
expander_6 = Data(expander_3)

# ---- group: Fonts / Aptos Black
# Aptos Black
panel_70 = Panel(""" <FontFamily>
                    <FontFamily.FamilyMaps>
                        <FontFamilyMap Target="Aptos Black"/>
                    </FontFamily.FamilyMaps>

                </FontFamily>""")
create_objects_from_xaml_2 = CreateObjectsFromXAML(XAML=panel_70)

# ---- group: Fonts / Aptos Extrabold
# Aptos Extrabold
panel_71 = Panel(""" <FontFamily>
                    <FontFamily.FamilyMaps>
                        <FontFamilyMap Target="Aptos Extrabold"/>
                    </FontFamily.FamilyMaps>

                </FontFamily>""")
create_objects_from_xaml_3 = CreateObjectsFromXAML(XAML=panel_71)

# ---- group: Fonts / Aptos Semibold
# Aptos Semibold
panel_72 = Panel(""" <FontFamily>
                    <FontFamily.FamilyMaps>
                        <FontFamilyMap Target="Aptos Semibold"/>
                    </FontFamily.FamilyMaps>

                </FontFamily>""")
create_objects_from_xaml_4 = CreateObjectsFromXAML(XAML=panel_72)

# ---- group: Fonts / Aptos Regular
# Aptos Regular
panel_73 = Panel(""" <FontFamily>
                    <FontFamily.FamilyMaps>
                        <FontFamilyMap Target="Aptos Regular"/>
                    </FontFamily.FamilyMaps>

                </FontFamily>""")
create_objects_from_xaml_5 = CreateObjectsFromXAML(XAML=panel_73)

# ---- group: Text Properties / Texts "ReLifeCycle Results" window
# Texts "ReLifeCycle Results" window
stream_filter_25 = StreamFilter(Gate=value_listener_15.Values, Stream0=colour_swatch_6, Stream1=colour_swatch_5)
stream_filter_26 = StreamFilter(Gate=value_listener_15.Values, Stream0=transparent_white, Stream1=transparent_black)
heading_2_3 = AdjustElementAppearance(ElementsToAdjust=heading_2, Foreground=colour_swatch_5, Background=colour_swatch_10)
heading_3_2 = AdjustElementAppearance(ElementsToAdjust=heading_3, Foreground=colour_swatch_6, Background=colour_swatch_11)
expander_2_3 = AdjustElementAppearance(ElementsToAdjust=expander_2_2, Foreground=colour_swatch_6, Background=stream_filter_26, FontSize=11.6)
material_list_names_2 = AdjustElementAppearance(ElementsToAdjust=material_list_names, Foreground=colour_swatch_9, Background=RGBA(255, 255, 255, 0))

# ---- group: Text Properties / Texts "ReLifeCycle Explore" window
# Texts "ReLifeCycle Explore" window
headliner_7 = AdjustElementAppearance(ElementsToAdjust=headliner_6, Foreground=colour_swatch_5, Background=colour_swatch_12)
heading_1_2 = AdjustElementAppearance(ElementsToAdjust=heading_1, Foreground=colour_swatch_5, Background=colour_swatch_13)
expander_7 = AdjustElementAppearance(ElementsToAdjust=expander_6, Foreground=colour_swatch_6, Background=colour_swatch_13)
heading_2_4 = AdjustElementAppearance(ElementsToAdjust=heading_2_2, Foreground=colour_swatch_5, Background=colour_swatch_14)

# ---- group: Top captions
create_toggle_8 = CreateToggle(Default=False, Label="Enable detailed results")
list_item_16 = ListItem(List=flatten(building_information), Index=1, Wrap=True)
label_115 = CreateLabel(LabelText=" ", LabelSize=18, Justification=0)
value_listener_19 = ValueListener(Elements=create_toggle_8, SomeProperty=True)  # -> Values, Indices
# Tab 2: Detailed results
headliner_8 = CreateLabel(LabelText="DETAILED RESULTS", LabelSize=24, Justification=0)
separator_68 = CreateSeparator(Thickness=10, Horizontal=True, Color=RGBA(255, 255, 255, 0))
separator_69 = CreateSeparator(Thickness=10, Horizontal=True, Color=RGBA(255, 255, 255, 0))
setlabel_20 = SetLabelContents(LabelToModify=label_115, NewLabelContents=list_item_16)
panel_74 = Panel("""ENVIRONMENTAL IMPACT
CIRCULARITY
FINANCIAL IMPACT""")
merge_36 = Merge(Data1=headliner_8, Data2=label_115, Data3=separator_68, Data4=create_toggle_8, Data5=separator_69)

# ---- group: Extracted detailed results / Total results
# Total results
stream_gate_20 = StreamGate(Stream=stream_gate.Target1, Gate=value_listener_19.Values)  # -> Target0, Target1
total_results_4 = Data(stream_gate_20.Target1)
split_tree_30 = SplitTree(Data=total_results_4, Masks=flatten("{0;?}"))  # -> simplify(EnvironmentalImpactTotalResults), Negative
split_tree_31 = SplitTree(Data=total_results_4, Masks=flatten("{1;?}"))  # -> simplify(CircularityTotalResults), Negative
split_tree_32 = SplitTree(Data=total_results_4, Masks=flatten("{2;?}"))  # -> simplify(FinancialImpactTotalResults), Negative

# ---- group: Total Building Results / Total GWP and MKI
# Total GWP and MKI
total_results_5 = Data(split_tree_30.EnvironmentalImpactTotalResults)
split_tree_33 = SplitTree(Data=total_results_5, Masks=flatten("{4 to 16}"))  # -> Positive, Negative
cull_index_11 = CullIndex(List=split_tree_33.Positive, Indices=0, Wrap=True)
split_tree_34 = SplitTree(Data=total_results_5, Masks=flatten("{3}"))  # -> Positive, Negative
mass_addition_11 = MassAddition(Input=flatten(cull_index_11))  # -> Result, PartialResults
cull_index_12 = CullIndex(List=split_tree_34.Positive, Indices=0, Wrap=True)
round_15 = Round(Number=mass_addition_11.Result)  # -> Nearest, Floor, Ceiling
round_16 = Round(Number=cull_index_12)  # -> Nearest, Floor, Ceiling
panel_75 = Panel("""Total MKI
[€]""")
panel_76 = Panel("""Total GWP
[kg CO2 eq.]""")
total_gwp = Data(round_15.Nearest)
total_mki = Data(round_16.Nearest)
chart_17 = CreateChart(Data="0", SubTitle=panel_75, ChartType=1)
chart_18 = CreateChart(Data="0", SubTitle=panel_76, ChartType=1)
setchart_17 = SetChartContents(ChartToModify=chart_17, NewChartValues=flatten(total_mki))
setchart_18 = SetChartContents(ChartToModify=chart_18, NewChartValues=flatten(total_gwp))
adjustpos_5 = AdjustElementPositioning(
    ElementsToAdjust=[chart_18, chart_17],
    AbsolutePositioning=False,
    Width=Slider(220, range=0..2000),
    HorizontalAlignment=0,
    VerticalAlignment=3)
chartappearance_5 = ChartAppearance(ChartToModify=[chart_18, chart_17], Legend=False)

# ---- group: Total Building Results / GWP and MKI per life cycle stage
# GWP and MKI per life cycle stage
total_results_6 = Data(split_tree_30.EnvironmentalImpactTotalResults)
split_tree_35 = SplitTree(Data=total_results_6, Masks=flatten("{4 to 16}"))  # -> Positive, Negative
split_tree_36 = SplitTree(Data=total_results_6, Masks=flatten("{17 to 29}"))  # -> Positive, Negative
cull_index_13 = CullIndex(List=split_tree_35.Positive, Indices=0, Wrap=True)
cull_index_14 = CullIndex(List=split_tree_36.Positive, Indices=0, Wrap=True)
panel_77 = Panel("""A1-A3
A4
A5
B1
B2
B3
B4
B5
C1
C2
C3
C4
D""")
gwp_per_life_cycle_stage = Data(cull_index_13)
mki_per_life_cycle_stage = Data(cull_index_14)
round_17 = Round(Number=gwp_per_life_cycle_stage)  # -> Nearest, Floor, Ceiling
round_18 = Round(Number=mki_per_life_cycle_stage)  # -> Nearest, Floor, Ceiling
panel_78 = Panel("""GWP per life cycle stage
[kg CO2 eq.]""")
panel_79 = Panel("""MKI per life cycle stage
[€]""")
chart_19 = CreateChart(Data="0", SubTitle=panel_79, ChartType=1)
chart_20 = CreateChart(Data="0", SubTitle=panel_78, ChartType=1)
setchart_19 = SetChartContents(ChartToModify=chart_20, NewChartValues=flatten(round_17.Nearest), NewChartNames=panel_77)
setchart_20 = SetChartContents(ChartToModify=chart_19, NewChartValues=flatten(round_18.Nearest), NewChartNames=panel_77)
chartappearance_6 = ChartAppearance(ChartToModify=[chart_20, chart_19])
adjustpos_6 = AdjustElementPositioning(
    ElementsToAdjust=[chart_20, chart_19],
    AbsolutePositioning=False,
    Width=Slider(220, range=0..2000),
    HorizontalAlignment=0,
    VerticalAlignment=3)

# ---- group: Extracted detailed results / Detailed results per building element
# Detailed results per building element
stream_gate_21 = StreamGate(Stream=stream_gate_2.Target1, Gate=value_listener_19.Values)  # -> Target0, Target1
detailed_results_2 = Data(stream_gate_21.Target1)
split_tree_37 = SplitTree(Data=detailed_results_2, Masks=flatten("{0;?;?}"))  # -> simplify(EnvironmentalImpactPerBuildingElement), Negative
split_tree_38 = SplitTree(Data=detailed_results_2, Masks=flatten("{1;?;?}"))  # -> simplify(CircularityPerBuildingElement), Negative
split_tree_39 = SplitTree(Data=detailed_results_2, Masks=flatten("{2;?;?}"))  # -> simplify(FinancialImpactPerBuildingElement), Negative

# ---- group: Results per building element / Detailed results per building element
# Detailed results per building element
environmental_impact_per_building_elemen = Data(split_tree_37.EnvironmentalImpactPerBuildingElement)  # "Environmental impact per building element"
split_tree_40 = SplitTree(Data=environmental_impact_per_building_elemen, Masks=flatten("{?;0}"))  # -> Positive, Negative
split_tree_41 = SplitTree(Data=environmental_impact_per_building_elemen, Masks=flatten("{?;44}"))  # -> Positive, Negative
split_tree_42 = SplitTree(Data=environmental_impact_per_building_elemen, Masks=flatten("{?;43}"))  # -> Positive, Negative
split_tree_43 = SplitTree(Data=environmental_impact_per_building_elemen, Masks=flatten("{?;40}"))  # -> Positive, Negative
split_tree_44 = SplitTree(Data=environmental_impact_per_building_elemen, Masks=flatten("{?;42}"))  # -> Positive, Negative
split_tree_45 = SplitTree(Data=environmental_impact_per_building_elemen, Masks=flatten("{?;41}"))  # -> Positive, Negative
cull_index_15 = CullIndex(List=split_tree_40.Positive, Indices=0, Wrap=True)  # -> flatten(List)
cull_index_16 = CullIndex(List=split_tree_41.Positive, Indices=0, Wrap=True)  # -> simplify(List)
cull_index_17 = CullIndex(List=split_tree_42.Positive, Indices=0, Wrap=True)  # -> simplify(List)
cull_index_18 = CullIndex(List=split_tree_43.Positive, Indices=0, Wrap=True)  # -> simplify(List)
cull_index_19 = CullIndex(List=split_tree_44.Positive, Indices=0, Wrap=True)  # -> simplify(List)
cull_index_20 = CullIndex(List=split_tree_45.Positive, Indices=0, Wrap=True)  # -> simplify(List)
expression_13 = Expression(X=cull_index_16, Expression="Format(\"{0:0.000}\",x)")
expression_14 = Expression(X=cull_index_17, Expression="Format(\"{0:0.00}\",x)")
division_23 = Division(A=cull_index_18, B=1000)
round_19 = Round(Number=cull_index_19)  # -> Nearest, Floor, Ceiling
round_20 = Round(Number=cull_index_20)  # -> Nearest, Floor, Ceiling
expression_15 = Expression(X=division_23, Expression="Format(\"{0:0.00}\",x)")

# ---- group: Results per building element
building_element_names = Panel(cull_index_15)
mpg_per_building_element = Data(flatten(expression_13))
ppi_per_building_element = Data(flatten(expression_14))
csc_per_building_element = Data(flatten(expression_15))
gwp_per_building_element = Data(flatten(round_19.Nearest))
mki_per_building_element = Data(flatten(round_20.Nearest))
sort_list = SortList(Keys=mpg_per_building_element, ValuesValuesA=building_element_names)  # -> reverse(Keys), reverse(ValuesValuesA)
sort_list_2 = SortList(Keys=ppi_per_building_element, ValuesValuesA=building_element_names)  # -> reverse(Keys), reverse(ValuesValuesA)
sort_list_3 = SortList(Keys=csc_per_building_element, ValuesValuesA=building_element_names)  # -> reverse(Keys), reverse(ValuesValuesA)
sort_list_4 = SortList(Keys=gwp_per_building_element, ValuesValuesA=building_element_names)  # -> reverse(Keys), reverse(ValuesValuesA)
sort_list_5 = SortList(Keys=mki_per_building_element, ValuesValuesA=building_element_names)  # -> reverse(Keys), reverse(ValuesValuesA)
panel_80 = Panel("""MPG
[€ / m2 GFA / year]""")
panel_81 = Panel("""GWP
[kg CO2 eq.]""")
panel_82 = Panel("""CSC
[tonnes CO2]""")
panel_83 = Panel("""MKI
[€]""")
panel_84 = Panel("""PPI
[kg CO2 eq. / m2 GFA]""")
chart_21 = CreateChart(Data="0", SubTitle=panel_81, ChartType=1)
chart_22 = CreateChart(Data="0", SubTitle=panel_82, ChartType=1)
chart_23 = CreateChart(Data="0", SubTitle=panel_83, ChartType=1)
chart_24 = CreateChart(Data="0", SubTitle=panel_84, ChartType=1)
chart_25 = CreateChart(Data="0", SubTitle=panel_80, ChartType=1)
setchart_21 = SetChartContents(ChartToModify=chart_21, NewChartValues=flatten(sort_list_4.Keys), NewChartNames=sort_list_4.ValuesValuesA)
setchart_22 = SetChartContents(ChartToModify=chart_22, NewChartValues=flatten(sort_list_3.Keys), NewChartNames=sort_list_3.ValuesValuesA)
setchart_23 = SetChartContents(ChartToModify=chart_23, NewChartValues=flatten(sort_list_5.Keys), NewChartNames=sort_list_5.ValuesValuesA)
setchart_24 = SetChartContents(ChartToModify=chart_24, NewChartValues=flatten(sort_list_2.Keys), NewChartNames=sort_list_2.ValuesValuesA)
setchart_25 = SetChartContents(ChartToModify=chart_25, NewChartValues=flatten(sort_list.Keys), NewChartNames=sort_list.ValuesValuesA)
stack_39 = CreateStack(UIElements=flatten([chart_25, chart_24]), Horizontal=True)
stack_40 = CreateStack(UIElements=flatten([chart_22, chart_21]), Horizontal=True)
stack_41 = CreateStack(UIElements=flatten(chart_23), Horizontal=True)
stack_42 = CreateStack(UIElements=flatten([stack_39, stack_40, stack_41]), Horizontal=False)
chartappearance_7 = ChartAppearance(ChartToModify=[chart_25, chart_24, chart_22, chart_21, chart_23])
adjustpos_7 = AdjustElementPositioning(
    ElementsToAdjust=[chart_25, chart_24, chart_22, chart_21, chart_23],
    AbsolutePositioning=False,
    Width=Slider(220, range=0..2000),
    HorizontalAlignment=0,
    VerticalAlignment=3)
expander_8 = CreateExpander(UIElements=flatten(stack_42), Header="RESULTS PER BUILDING ELEMENT", Open=False)
adjust_element_appearance_29 = AdjustElementAppearance(
    ElementsToAdjust=expander_8,
    Foreground=ColourSwatch(SwatchColor=RGB(255, 255, 255)),
    Background=ColourSwatch(SwatchColor=RGB(42, 91, 115)),
    FontSize=18)

# ---- group: Total Building Results
stack_43 = CreateStack(UIElements=flatten(chart_17), Horizontal=True)
stack_44 = CreateStack(UIElements=flatten([chart_6, chart_5]), Horizontal=True)
stack_45 = CreateStack(UIElements=flatten([chart_4, chart_18]), Horizontal=True)
stack_46 = CreateStack(UIElements=flatten([chart_20, chart_19]), Horizontal=True)

expander_9 = CreateExpander(UIElements=flatten([stack_44, stack_45, stack_43, stack_46]), Header="TOTAL BUILDING RESULTS", Open=False)
adjust_element_appearance_30 = AdjustElementAppearance(
    ElementsToAdjust=expander_9,
    Foreground=ColourSwatch(SwatchColor=RGB(255, 255, 255)),
    Background=ColourSwatch(SwatchColor=RGB(42, 91, 115)),
    FontSize=18)

# ---- group: Extracted detailed results / Detailed results per NL/SfB class
# Detailed results per NL/SfB class
stream_gate_22 = StreamGate(Stream=stream_gate_2.Target1, Gate=value_listener_19.Values)  # -> Target0, Target1
detailed_results_3 = Data(stream_gate_22.Target1)
split_tree_46 = SplitTree(Data=detailed_results_3, Masks=flatten("{0;?;?}"))  # -> simplify(EnvironmentalImpactDetailedResults), Negative
split_tree_47 = SplitTree(Data=detailed_results_3, Masks=flatten("{1;?;?}"))  # -> simplify(CircularityDetailedResults), Negative
split_tree_48 = SplitTree(Data=detailed_results_3, Masks=flatten("{2;?;?}"))  # -> simplify(FinancialImpactResults), Negative
cluster_13 = Cluster(data=split_tree_46.EnvironmentalImpactDetailedResults)
cluster_14 = Cluster(data=split_tree_47.CircularityDetailedResults)
cluster_15 = Cluster(data=split_tree_48.FinancialImpactResults)

# ---- group: Results per NL/SfB class / Detailed results per NL/SfB class
# Detailed results per NL/SfB class
environmental_impact_per_nl_sfb_class = Data(cluster_13)

# ---- group: Results per NL/SfB class / Detailed results per NL/SfB class / Included NL/SfB classes
# Included NL/SfB classes
split_tree_49 = SplitTree(Data=environmental_impact_per_nl_sfb_class, Masks=flatten(["{?;?;1}", "{?;?;2}"]))  # -> Positive, Negative
cull_index_21 = CullIndex(List=split_tree_49.Positive, Indices=0, Wrap=True)  # -> simplify(List)
tstat_10 = TreeStatistics(Tree=cull_index_21)  # -> Paths, Length, Count
dpath_10 = DeconstructPath(Branch=tstat_10.Paths)
item_10 = ListItem(List=dpath_10, Index=0, Wrap=True)
path_10 = ConstructPath(Indices=item_10)
replace_10 = ReplacePaths(Data=cull_index_21, Search=tstat_10.Paths, Replace=flatten(path_10))
list_item_17 = ListItem(List=replace_10, Index=0, Wrap=True)  # -> Item, Item1
concatenate_2 = Concatenate(Fragment_A=list_item_17.Item, Space=" ", Fragment_B=list_item_17.Item1)  # -> flatten(NLSfBClasses)

# ---- group: Results per NL/SfB class / Detailed results per NL/SfB class / MPG per NL/SfB class
# MPG per NL/SfB class
split_tree_50 = SplitTree(Data=environmental_impact_per_nl_sfb_class, Masks=flatten("{?;?;44}"))  # -> Positive, Negative
cull_index_22 = CullIndex(List=split_tree_50.Positive, Indices=0, Wrap=True)  # -> simplify(List)
tstat_11 = TreeStatistics(Tree=cull_index_22)  # -> Paths, Length, Count
dpath_11 = DeconstructPath(Branch=tstat_11.Paths)
item_11 = ListItem(List=dpath_11, Index=0, Wrap=True)
path_11 = ConstructPath(Indices=item_11)
replace_11 = ReplacePaths(Data=cull_index_22, Search=tstat_11.Paths, Replace=flatten(path_11))
mass_addition_12 = MassAddition(Input=replace_11)  # -> Result, PartialResults
expression_16 = Expression(X=mass_addition_12.Result, Expression="Format(\"{0:0.000}\",x)")

# ---- group: Results per NL/SfB class / Detailed results per NL/SfB class / PPI per NL/SfB class
# PPI per NL/SfB class
split_tree_51 = SplitTree(Data=environmental_impact_per_nl_sfb_class, Masks=flatten("{?;?;43}"))  # -> Positive, Negative
cull_index_23 = CullIndex(List=split_tree_51.Positive, Indices=0, Wrap=True)  # -> simplify(List)
tstat_12 = TreeStatistics(Tree=cull_index_23)  # -> Paths, Length, Count
dpath_12 = DeconstructPath(Branch=tstat_12.Paths)
item_12 = ListItem(List=dpath_12, Index=0, Wrap=True)
path_12 = ConstructPath(Indices=item_12)
replace_12 = ReplacePaths(Data=cull_index_23, Search=tstat_12.Paths, Replace=flatten(path_12))
mass_addition_13 = MassAddition(Input=replace_12)  # -> Result, PartialResults
expression_17 = Expression(X=mass_addition_13.Result, Expression="Format(\"{0:0.00}\",x)")

# ---- group: Results per NL/SfB class / Detailed results per NL/SfB class / CSC per NL/SfB class
# CSC per NL/SfB class
split_tree_52 = SplitTree(Data=environmental_impact_per_nl_sfb_class, Masks=flatten("{?;?;40}"))  # -> Positive, Negative
cull_index_24 = CullIndex(List=split_tree_52.Positive, Indices=0, Wrap=True)  # -> simplify(List)
tstat_13 = TreeStatistics(Tree=cull_index_24)  # -> Paths, Length, Count
dpath_13 = DeconstructPath(Branch=tstat_13.Paths)
item_13 = ListItem(List=dpath_13, Index=0, Wrap=True)
path_13 = ConstructPath(Indices=item_13)
replace_13 = ReplacePaths(Data=cull_index_24, Search=tstat_13.Paths, Replace=flatten(path_13))
mass_addition_14 = MassAddition(Input=replace_13)  # -> Result, PartialResults
division_24 = Division(A=mass_addition_14.Result, B=1000)
expression_18 = Expression(X=division_24, Expression="Format(\"{0:0.00}\",x)")

# ---- group: Results per NL/SfB class / Detailed results per NL/SfB class / GWP per NL/SfB class
# GWP per NL/SfB class
split_tree_53 = SplitTree(Data=environmental_impact_per_nl_sfb_class, Masks=flatten("{?;?;42}"))  # -> Positive, Negative
cull_index_25 = CullIndex(List=split_tree_53.Positive, Indices=0, Wrap=True)  # -> simplify(List)
tstat_14 = TreeStatistics(Tree=cull_index_25)  # -> Paths, Length, Count
dpath_14 = DeconstructPath(Branch=tstat_14.Paths)
item_14 = ListItem(List=dpath_14, Index=0, Wrap=True)
path_14 = ConstructPath(Indices=item_14)
replace_14 = ReplacePaths(Data=cull_index_25, Search=tstat_14.Paths, Replace=flatten(path_14))
mass_addition_15 = MassAddition(Input=replace_14)  # -> Result, PartialResults
round_21 = Round(Number=mass_addition_15.Result)  # -> Nearest, Floor, Ceiling

# ---- group: Results per NL/SfB class / Detailed results per NL/SfB class / MKI per NL/SfB class
# MKI per NL/SfB class
split_tree_54 = SplitTree(Data=environmental_impact_per_nl_sfb_class, Masks=flatten("{?;?;41}"))  # -> Positive, Negative
cull_index_26 = CullIndex(List=split_tree_54.Positive, Indices=0, Wrap=True)  # -> simplify(List)
tstat_15 = TreeStatistics(Tree=cull_index_26)  # -> Paths, Length, Count
dpath_15 = DeconstructPath(Branch=tstat_15.Paths)
item_15 = ListItem(List=dpath_15, Index=0, Wrap=True)
path_15 = ConstructPath(Indices=item_15)
replace_15 = ReplacePaths(Data=cull_index_26, Search=tstat_15.Paths, Replace=flatten(path_15))
mass_addition_16 = MassAddition(Input=replace_15)  # -> Result, PartialResults
round_22 = Round(Number=mass_addition_16.Result)  # -> Nearest, Floor, Ceiling

# ---- group: Results per NL/SfB class
included_nl_sfb_classes = Panel(concatenate_2)
mpg_per_nl_sfb_class = Data(flatten(expression_16))
ppi_per_nl_sfb_class = Data(flatten(expression_17))
csc_per_nl_sfb_class = Data(flatten(expression_18))
gwp_per_nl_sfb_class = Data(flatten(round_21.Nearest))
mki_per_nl_sfb_class_3 = Data(flatten(round_22.Nearest))
sort_list_6 = SortList(Keys=mpg_per_nl_sfb_class, ValuesValuesA=included_nl_sfb_classes)  # -> reverse(Keys), reverse(ValuesValuesA)
sort_list_7 = SortList(Keys=ppi_per_nl_sfb_class, ValuesValuesA=included_nl_sfb_classes)  # -> reverse(Keys), reverse(ValuesValuesA)
sort_list_8 = SortList(Keys=csc_per_nl_sfb_class, ValuesValuesA=included_nl_sfb_classes)  # -> reverse(Keys), reverse(ValuesValuesA)
sort_list_9 = SortList(Keys=gwp_per_nl_sfb_class, ValuesValuesA=included_nl_sfb_classes)  # -> reverse(Keys), reverse(ValuesValuesA)
sort_list_10 = SortList(Keys=mki_per_nl_sfb_class_3, ValuesValuesA=included_nl_sfb_classes)  # -> reverse(Keys), reverse(ValuesValuesA)
panel_85 = Panel("""MPG
[€ / m2 GFA / year]""")
panel_86 = Panel("""GWP
[kg CO2 eq.]""")
panel_87 = Panel("""MKI
[€]""")
panel_88 = Panel("""CSC
[tonnes CO2]""")
panel_89 = Panel("""PPI
[kg CO2 eq. / m2 GFA]""")
chart_26 = CreateChart(Data="0", SubTitle=panel_86, ChartType=1)
chart_27 = CreateChart(Data="0", SubTitle=panel_88, ChartType=1)
chart_28 = CreateChart(Data="0", SubTitle=panel_87, ChartType=1)
chart_29 = CreateChart(Data="0", SubTitle=panel_89, ChartType=1)
chart_30 = CreateChart(Data="0", SubTitle=panel_85, ChartType=1)
setchart_26 = SetChartContents(ChartToModify=chart_26, NewChartValues=flatten(sort_list_9.Keys), NewChartNames=sort_list_9.ValuesValuesA)
setchart_27 = SetChartContents(ChartToModify=chart_27, NewChartValues=flatten(sort_list_8.Keys), NewChartNames=sort_list_8.ValuesValuesA)
setchart_28 = SetChartContents(ChartToModify=chart_28, NewChartValues=flatten(sort_list_10.Keys), NewChartNames=sort_list_10.ValuesValuesA)
setchart_29 = SetChartContents(ChartToModify=chart_29, NewChartValues=flatten(sort_list_7.Keys), NewChartNames=sort_list_7.ValuesValuesA)
setchart_30 = SetChartContents(ChartToModify=chart_30, NewChartValues=flatten(sort_list_6.Keys), NewChartNames=sort_list_6.ValuesValuesA)
stack_47 = CreateStack(UIElements=flatten([chart_30, chart_29]), Horizontal=True)
stack_48 = CreateStack(UIElements=flatten([chart_27, chart_26]), Horizontal=True)
stack_49 = CreateStack(UIElements=flatten(chart_28), Horizontal=True)
stack_50 = CreateStack(UIElements=flatten([stack_47, stack_48, stack_49]), Horizontal=False)
chartappearance_8 = ChartAppearance(ChartToModify=[chart_30, chart_29, chart_27, chart_26, chart_28])
adjustpos_8 = AdjustElementPositioning(
    ElementsToAdjust=[chart_30, chart_29, chart_27, chart_26, chart_28],
    AbsolutePositioning=False,
    Width=Slider(220, range=0..2000),
    HorizontalAlignment=0,
    VerticalAlignment=3)

expander_10 = CreateExpander(UIElements=flatten(stack_50), Header="RESULTS PER NL/SFB CLASS", Open=False)
adjust_element_appearance_31 = AdjustElementAppearance(
    ElementsToAdjust=expander_10,
    Foreground=ColourSwatch(SwatchColor=RGB(255, 255, 255)),
    Background=ColourSwatch(SwatchColor=RGB(42, 91, 115)),
    FontSize=18)

# ----
# Tab 2.1: Environmental Impact
colour_swatch_56 = ColourSwatch(SwatchColor=RGB(255, 255, 255))
adjust_element_appearance_32 = AdjustElementAppearance(ElementsToAdjust=label_52, Foreground=colour_swatch_56, Background=ColourSwatch(SwatchColor=RGB(42, 91, 115)))
separator_70 = CreateSeparator(Thickness=10, Horizontal=True, Color=RGBA(255, 255, 255, 0))
separator_71 = CreateSeparator(Thickness=10, Horizontal=True, Color=RGBA(255, 255, 255, 0))
merge_37 = Merge(Data1=merge_11, Data2=expander_9, Data3=separator_71, Data4=expander_8, Data5=separator_70, Data6=expander_10)  # -> flatten(EnvironmentalImpactDetailedResults)

# ---- group: Results per building element / Detailed results per building element
# Detailed results per building element
circularity_per_building_element = Data(split_tree_38.CircularityPerBuildingElement)
split_tree_55 = SplitTree(Data=circularity_per_building_element, Masks=flatten("{?;0}"))  # -> Positive, Negative
split_tree_56 = SplitTree(Data=circularity_per_building_element, Masks=flatten("{?;50}"))  # -> Positive, Negative
split_tree_57 = SplitTree(Data=circularity_per_building_element, Masks=flatten("{?;49}"))  # -> Positive, Negative
split_tree_58 = SplitTree(Data=circularity_per_building_element, Masks=flatten("{?;51}"))  # -> Positive, Negative
split_tree_59 = SplitTree(Data=circularity_per_building_element, Masks=flatten("{?;41}"))  # -> New_input, Negative
split_tree_60 = SplitTree(Data=circularity_per_building_element, Masks=flatten("{?;42}"))  # -> Biobased_input, Negative
split_tree_61 = SplitTree(Data=circularity_per_building_element, Masks=flatten("{?;43}"))  # -> Recycled_input, Negative
split_tree_62 = SplitTree(Data=circularity_per_building_element, Masks=flatten("{?;44}"))  # -> Reused_input, Negative
split_tree_63 = SplitTree(Data=circularity_per_building_element, Masks=flatten("{?;45}"))  # -> Landfill_output, Negative
split_tree_64 = SplitTree(Data=circularity_per_building_element, Masks=flatten("{?;46}"))  # -> Burning_output, Negative
split_tree_65 = SplitTree(Data=circularity_per_building_element, Masks=flatten("{?;47}"))  # -> Recycling_output, Negative
split_tree_66 = SplitTree(Data=circularity_per_building_element, Masks=flatten("{?;48}"))  # -> Reusing_output, Negative
cull_index_27 = CullIndex(List=split_tree_55.Positive, Indices=0, Wrap=True)  # -> flatten(List)
cull_index_28 = CullIndex(List=split_tree_56.Positive, Indices=0, Wrap=True)  # -> simplify(List)
cull_index_29 = CullIndex(List=split_tree_57.Positive, Indices=0, Wrap=True)  # -> simplify(List)
cull_index_30 = CullIndex(List=split_tree_58.Positive, Indices=0, Wrap=True)  # -> simplify(List)
cull_index_31 = CullIndex(List=split_tree_59.New_input, Indices=0, Wrap=True)  # -> simplify(New_input)
cull_index_32 = CullIndex(List=split_tree_60.Biobased_input, Indices=0, Wrap=True)  # -> simplify(Biobased_input)
cull_index_33 = CullIndex(List=split_tree_61.Recycled_input, Indices=0, Wrap=True)  # -> simplify(Recycled_input)
cull_index_34 = CullIndex(List=split_tree_62.Reused_input, Indices=0, Wrap=True)  # -> simplify(Reused_input)
cull_index_35 = CullIndex(List=split_tree_63.Landfill_output, Indices=0, Wrap=True)  # -> simplify(Landfill_output)
cull_index_36 = CullIndex(List=split_tree_64.Burning_output, Indices=0, Wrap=True)  # -> simplify(Burning_output)
cull_index_37 = CullIndex(List=split_tree_65.Recycling_output, Indices=0, Wrap=True)  # -> simplify(Recycling_output)
cull_index_38 = CullIndex(List=split_tree_66.Reusing_output, Indices=0, Wrap=True)  # -> simplify(Reusing_output)
round_23 = Round(Number=cull_index_28)  # -> Nearest, Floor, Ceiling
round_24 = Round(Number=cull_index_29)  # -> Nearest, Floor, Ceiling
round_25 = Round(Number=cull_index_30)  # -> Nearest, Floor, Ceiling
round_26 = Round(Number=cull_index_31)  # -> Nearest, Floor, Ceiling
round_27 = Round(Number=cull_index_32)  # -> Nearest, Floor, Ceiling
round_28 = Round(Number=cull_index_33)  # -> Nearest, Floor, Ceiling
round_29 = Round(Number=cull_index_34)  # -> Nearest, Floor, Ceiling
round_30 = Round(Number=cull_index_35)  # -> Nearest, Floor, Ceiling
round_31 = Round(Number=cull_index_36)  # -> Nearest, Floor, Ceiling
round_32 = Round(Number=cull_index_37)  # -> Nearest, Floor, Ceiling
round_33 = Round(Number=cull_index_38)  # -> Nearest, Floor, Ceiling

# ---- group: Results per NL/SfB class / Detailed results per NL/SfB class
# Detailed results per NL/SfB class
circularity_per_nl_sfb_class = Data(cluster_14)

# ---- group: Results per NL/SfB class / Detailed results per NL/SfB class / Included NL/SfB classes
# Included NL/SfB classes
split_tree_67 = SplitTree(Data=circularity_per_nl_sfb_class, Masks=flatten(["{?;?;1}", "{?;?;2}"]))  # -> Positive, Negative
cull_index_39 = CullIndex(List=split_tree_67.Positive, Indices=0, Wrap=True)  # -> simplify(List)
tstat_16 = TreeStatistics(Tree=cull_index_39)  # -> Paths, Length, Count
dpath_16 = DeconstructPath(Branch=tstat_16.Paths)
item_16 = ListItem(List=dpath_16, Index=0, Wrap=True)
path_16 = ConstructPath(Indices=item_16)
replace_16 = ReplacePaths(Data=cull_index_39, Search=tstat_16.Paths, Replace=flatten(path_16))
list_item_18 = ListItem(List=replace_16, Index=0, Wrap=True)  # -> Item, Item1
concatenate_3 = Concatenate(Fragment_A=list_item_18.Item, Space=" ", Fragment_B=list_item_18.Item1)  # -> flatten(NLSfBClasses)

# ---- group: Results per NL/SfB class / Detailed results per NL/SfB class / MCI per NL/SfB class / MCI
# MCI
split_tree_68 = SplitTree(Data=circularity_per_nl_sfb_class, Masks=flatten("{?;?;50}"))  # -> Positive, Negative
cull_index_40 = CullIndex(List=split_tree_68.Positive, Indices=0, Wrap=True)  # -> simplify(List)
tstat_17 = TreeStatistics(Tree=cull_index_40)  # -> Paths, Length, Count
dpath_17 = DeconstructPath(Branch=tstat_17.Paths)
item_17 = ListItem(List=dpath_17, Index=0, Wrap=True)
path_17 = ConstructPath(Indices=item_17)
replace_17 = ReplacePaths(Data=cull_index_40, Search=tstat_17.Paths, Replace=flatten(path_17))

# ---- group: Results per NL/SfB class / Detailed results per NL/SfB class / MCI per NL/SfB class / MKI
# MKI
split_tree_69 = SplitTree(Data=circularity_per_nl_sfb_class, Masks=flatten("{?;?;52}"))  # -> Positive, Negative
cull_index_41 = CullIndex(List=split_tree_69.Positive, Indices=0, Wrap=True)  # -> simplify(List)
tstat_18 = TreeStatistics(Tree=cull_index_41)  # -> Paths, Length, Count
dpath_18 = DeconstructPath(Branch=tstat_18.Paths)
item_18 = ListItem(List=dpath_18, Index=0, Wrap=True)
path_18 = ConstructPath(Indices=item_18)
replace_18 = ReplacePaths(Data=cull_index_41, Search=tstat_18.Paths, Replace=flatten(path_18))

# ---- group: Results per NL/SfB class / Detailed results per NL/SfB class / DP per NL/SfB class
# DP per NL/SfB class
split_tree_70 = SplitTree(Data=circularity_per_nl_sfb_class, Masks=flatten("{?;?;49}"))  # -> Positive, Negative
cull_index_42 = CullIndex(List=split_tree_70.Positive, Indices=0, Wrap=True)  # -> simplify(List)
tstat_19 = TreeStatistics(Tree=cull_index_42)  # -> Paths, Length, Count
dpath_19 = DeconstructPath(Branch=tstat_19.Paths)
item_19 = ListItem(List=dpath_19, Index=0, Wrap=True)
path_19 = ConstructPath(Indices=item_19)
replace_19 = ReplacePaths(Data=cull_index_42, Search=tstat_19.Paths, Replace=flatten(path_19))
mass_addition_17 = MassAddition(Input=replace_18)  # -> TotalMKI, PartialResults
multiplication_12 = Multiplication(A=replace_19, B=replace_18)
mass_addition_18 = MassAddition(Input=multiplication_12)  # -> Result, PartialResults
division_25 = Division(A=mass_addition_18.Result, B=mass_addition_17.TotalMKI)
round_34 = Round(Number=division_25)  # -> Nearest, Floor, Ceiling

# ---- group: Results per NL/SfB class / Detailed results per NL/SfB class / PCI per NL/SfB class
# PCI per NL/SfB class
split_tree_71 = SplitTree(Data=circularity_per_nl_sfb_class, Masks=flatten("{?;?;51}"))  # -> Positive, Negative
cull_index_43 = CullIndex(List=split_tree_71.Positive, Indices=0, Wrap=True)  # -> simplify(List)
tstat_20 = TreeStatistics(Tree=cull_index_43)  # -> Paths, Length, Count
dpath_20 = DeconstructPath(Branch=tstat_20.Paths)
item_20 = ListItem(List=dpath_20, Index=0, Wrap=True)
path_20 = ConstructPath(Indices=item_20)
replace_20 = ReplacePaths(Data=cull_index_43, Search=tstat_20.Paths, Replace=flatten(path_20))
mass_addition_19 = MassAddition(Input=replace_18)  # -> TotalMKI, PartialResults
multiplication_13 = Multiplication(A=replace_20, B=replace_18)
mass_addition_20 = MassAddition(Input=multiplication_13)  # -> Result, PartialResults
division_26 = Division(A=mass_addition_20.Result, B=mass_addition_19.TotalMKI)
round_35 = Round(Number=division_26)  # -> Nearest, Floor, Ceiling

# ---- group: Results per NL/SfB class / Detailed results per NL/SfB class / %new_input per NL/SfB class
# %new_input per NL/SfB class
split_tree_72 = SplitTree(Data=circularity_per_nl_sfb_class, Masks=flatten("{?;?;41}"))  # -> New_input, Negative
cull_index_44 = CullIndex(List=split_tree_72.New_input, Indices=0, Wrap=True)  # -> simplify(List)
tstat_21 = TreeStatistics(Tree=cull_index_44)  # -> Paths, Length, Count
dpath_21 = DeconstructPath(Branch=tstat_21.Paths)
item_21 = ListItem(List=dpath_21, Index=0, Wrap=True)
path_21 = ConstructPath(Indices=item_21)
replace_21 = ReplacePaths(Data=cull_index_44, Search=tstat_21.Paths, Replace=flatten(path_21))
mass_addition_21 = MassAddition(Input=replace_18)  # -> TotalMKI, PartialResults
multiplication_14 = Multiplication(A=replace_21, B=replace_18)
mass_addition_22 = MassAddition(Input=multiplication_14)  # -> Result, PartialResults
division_27 = Division(A=mass_addition_22.Result, B=mass_addition_21.TotalMKI)
round_36 = Round(Number=division_27)  # -> Nearest, Floor, Ceiling

# ---- group: Results per NL/SfB class / Detailed results per NL/SfB class / %biobased_input per NL/SfB class
# %biobased_input per NL/SfB class
split_tree_73 = SplitTree(Data=circularity_per_nl_sfb_class, Masks=flatten("{?;?;42}"))  # -> Biobased_input, Negative
cull_index_45 = CullIndex(List=split_tree_73.Biobased_input, Indices=0, Wrap=True)  # -> simplify(List)
tstat_22 = TreeStatistics(Tree=cull_index_45)  # -> Paths, Length, Count
dpath_22 = DeconstructPath(Branch=tstat_22.Paths)
item_22 = ListItem(List=dpath_22, Index=0, Wrap=True)
path_22 = ConstructPath(Indices=item_22)
replace_22 = ReplacePaths(Data=cull_index_45, Search=tstat_22.Paths, Replace=flatten(path_22))
mass_addition_23 = MassAddition(Input=replace_18)  # -> TotalMKI, PartialResults
multiplication_15 = Multiplication(A=replace_22, B=replace_18)
mass_addition_24 = MassAddition(Input=multiplication_15)  # -> Result, PartialResults
division_28 = Division(A=mass_addition_24.Result, B=mass_addition_23.TotalMKI)
round_37 = Round(Number=division_28)  # -> Nearest, Floor, Ceiling

# ---- group: Results per NL/SfB class / Detailed results per NL/SfB class / %recycled_input per NL/SfB class
# %recycled_input per NL/SfB class
split_tree_74 = SplitTree(Data=circularity_per_nl_sfb_class, Masks=flatten("{?;?;43}"))  # -> Recycled_input, Negative
cull_index_46 = CullIndex(List=split_tree_74.Recycled_input, Indices=0, Wrap=True)  # -> simplify(List)
tstat_23 = TreeStatistics(Tree=cull_index_46)  # -> Paths, Length, Count
dpath_23 = DeconstructPath(Branch=tstat_23.Paths)
item_23 = ListItem(List=dpath_23, Index=0, Wrap=True)
path_23 = ConstructPath(Indices=item_23)
replace_23 = ReplacePaths(Data=cull_index_46, Search=tstat_23.Paths, Replace=flatten(path_23))
mass_addition_25 = MassAddition(Input=replace_18)  # -> TotalMKI, PartialResults
multiplication_16 = Multiplication(A=replace_23, B=replace_18)
mass_addition_26 = MassAddition(Input=multiplication_16)  # -> Result, PartialResults
division_29 = Division(A=mass_addition_26.Result, B=mass_addition_25.TotalMKI)
round_38 = Round(Number=division_29)  # -> Nearest, Floor, Ceiling

# ---- group: Results per NL/SfB class / Detailed results per NL/SfB class / %reused_input per NL/SfB class
# %reused_input per NL/SfB class
split_tree_75 = SplitTree(Data=circularity_per_nl_sfb_class, Masks=flatten("{?;?;44}"))  # -> Reused_input, Negative
cull_index_47 = CullIndex(List=split_tree_75.Reused_input, Indices=0, Wrap=True)  # -> simplify(List)
tstat_24 = TreeStatistics(Tree=cull_index_47)  # -> Paths, Length, Count
dpath_24 = DeconstructPath(Branch=tstat_24.Paths)
item_24 = ListItem(List=dpath_24, Index=0, Wrap=True)
path_24 = ConstructPath(Indices=item_24)
replace_24 = ReplacePaths(Data=cull_index_47, Search=tstat_24.Paths, Replace=flatten(path_24))
mass_addition_27 = MassAddition(Input=replace_18)  # -> TotalMKI, PartialResults
multiplication_17 = Multiplication(A=replace_24, B=replace_18)
mass_addition_28 = MassAddition(Input=multiplication_17)  # -> Result, PartialResults
division_30 = Division(A=mass_addition_28.Result, B=mass_addition_27.TotalMKI)
round_39 = Round(Number=division_30)  # -> Nearest, Floor, Ceiling

# ---- group: Results per NL/SfB class / Detailed results per NL/SfB class / %landfill_output per NL/SfB class
# %landfill_output per NL/SfB class
split_tree_76 = SplitTree(Data=circularity_per_nl_sfb_class, Masks=flatten("{?;?;45}"))  # -> Landfill_output, Negative
cull_index_48 = CullIndex(List=split_tree_76.Landfill_output, Indices=0, Wrap=True)  # -> simplify(List)
tstat_25 = TreeStatistics(Tree=cull_index_48)  # -> Paths, Length, Count
dpath_25 = DeconstructPath(Branch=tstat_25.Paths)
item_25 = ListItem(List=dpath_25, Index=0, Wrap=True)
path_25 = ConstructPath(Indices=item_25)
replace_25 = ReplacePaths(Data=cull_index_48, Search=tstat_25.Paths, Replace=flatten(path_25))
mass_addition_29 = MassAddition(Input=replace_18)  # -> TotalMKI, PartialResults
multiplication_18 = Multiplication(A=replace_25, B=replace_18)
mass_addition_30 = MassAddition(Input=multiplication_18)  # -> Result, PartialResults
division_31 = Division(A=mass_addition_30.Result, B=mass_addition_29.TotalMKI)
round_40 = Round(Number=division_31)  # -> Nearest, Floor, Ceiling

# ---- group: Results per NL/SfB class / Detailed results per NL/SfB class / %burning_output per NL/SfB class
# %burning_output per NL/SfB class
split_tree_77 = SplitTree(Data=circularity_per_nl_sfb_class, Masks=flatten("{?;?;46}"))  # -> Burning_output, Negative
cull_index_49 = CullIndex(List=split_tree_77.Burning_output, Indices=0, Wrap=True)  # -> simplify(List)
tstat_26 = TreeStatistics(Tree=cull_index_49)  # -> Paths, Length, Count
dpath_26 = DeconstructPath(Branch=tstat_26.Paths)
item_26 = ListItem(List=dpath_26, Index=0, Wrap=True)
path_26 = ConstructPath(Indices=item_26)
replace_26 = ReplacePaths(Data=cull_index_49, Search=tstat_26.Paths, Replace=flatten(path_26))
mass_addition_31 = MassAddition(Input=replace_18)  # -> TotalMKI, PartialResults
multiplication_19 = Multiplication(A=replace_26, B=replace_18)
mass_addition_32 = MassAddition(Input=multiplication_19)  # -> Result, PartialResults
division_32 = Division(A=mass_addition_32.Result, B=mass_addition_31.TotalMKI)
round_41 = Round(Number=division_32)  # -> Nearest, Floor, Ceiling

# ---- group: Results per NL/SfB class / Detailed results per NL/SfB class / %recycling_output per NL/SfB class
# %recycling_output per NL/SfB class
split_tree_78 = SplitTree(Data=circularity_per_nl_sfb_class, Masks=flatten("{?;?;47}"))  # -> Recycling_output, Negative
cull_index_50 = CullIndex(List=split_tree_78.Recycling_output, Indices=0, Wrap=True)  # -> simplify(List)
tstat_27 = TreeStatistics(Tree=cull_index_50)  # -> Paths, Length, Count
dpath_27 = DeconstructPath(Branch=tstat_27.Paths)
item_27 = ListItem(List=dpath_27, Index=0, Wrap=True)
path_27 = ConstructPath(Indices=item_27)
replace_27 = ReplacePaths(Data=cull_index_50, Search=tstat_27.Paths, Replace=flatten(path_27))
mass_addition_33 = MassAddition(Input=replace_18)  # -> TotalMKI, PartialResults
multiplication_20 = Multiplication(A=replace_27, B=replace_18)
mass_addition_34 = MassAddition(Input=multiplication_20)  # -> Result, PartialResults
division_33 = Division(A=mass_addition_34.Result, B=mass_addition_33.TotalMKI)
round_42 = Round(Number=division_33)  # -> Nearest, Floor, Ceiling

# ---- group: Results per NL/SfB class / Detailed results per NL/SfB class / %reusing_output per NL/SfB class
# %reusing_output per NL/SfB class
split_tree_79 = SplitTree(Data=circularity_per_nl_sfb_class, Masks=flatten("{?;?;48}"))  # -> Reusing_output, Negative
cull_index_51 = CullIndex(List=split_tree_79.Reusing_output, Indices=0, Wrap=True)  # -> simplify(List)
tstat_28 = TreeStatistics(Tree=cull_index_51)  # -> Paths, Length, Count
dpath_28 = DeconstructPath(Branch=tstat_28.Paths)
item_28 = ListItem(List=dpath_28, Index=0, Wrap=True)
path_28 = ConstructPath(Indices=item_28)
replace_28 = ReplacePaths(Data=cull_index_51, Search=tstat_28.Paths, Replace=flatten(path_28))
mass_addition_35 = MassAddition(Input=replace_18)  # -> TotalMKI, PartialResults
multiplication_21 = Multiplication(A=replace_28, B=replace_18)
mass_addition_36 = MassAddition(Input=multiplication_21)  # -> Result, PartialResults
division_34 = Division(A=mass_addition_36.Result, B=mass_addition_35.TotalMKI)
round_43 = Round(Number=division_34)  # -> Nearest, Floor, Ceiling

# ---- group: Results per building element
recycling_output_per_building_element = Data(flatten(round_32.Nearest))
mci_per_building_element = Data(flatten(round_23.Nearest))
dp_per_building_element = Data(flatten(round_24.Nearest))
pci_per_building_element = Data(flatten(round_25.Nearest))
biobased_input_per_building_element = Data(flatten(round_27.Nearest))
building_element_names_2 = Panel(cull_index_27)
new_input_per_building_element = Data(flatten(round_26.Nearest))
burning_output_per_building_element = Data(flatten(round_31.Nearest))
reusing_output_per_building_element = Data(flatten(round_33.Nearest))
recycled_input_per_building_element = Data(flatten(round_28.Nearest))
landfill_output_per_building_element = Data(flatten(round_30.Nearest))
reused_input_per_building_element = Data(flatten(round_29.Nearest))
sort_list_11 = SortList(Keys=mci_per_building_element, ValuesValuesA=building_element_names_2)  # -> reverse(Keys), reverse(ValuesValuesA)
sort_list_12 = SortList(Keys=dp_per_building_element, ValuesValuesA=building_element_names_2)  # -> reverse(Keys), reverse(ValuesValuesA)
sort_list_13 = SortList(Keys=pci_per_building_element, ValuesValuesA=building_element_names_2)  # -> reverse(Keys), reverse(ValuesValuesA)
sort_list_14 = SortList(Keys=new_input_per_building_element, ValuesValuesA=building_element_names_2)  # -> reverse(Keys), reverse(ValuesValuesA)
sort_list_15 = SortList(Keys=biobased_input_per_building_element, ValuesValuesA=building_element_names_2)  # -> reverse(Keys), reverse(ValuesValuesA)
sort_list_16 = SortList(Keys=reused_input_per_building_element, ValuesValuesA=building_element_names_2)  # -> reverse(Keys), reverse(ValuesValuesA)
sort_list_17 = SortList(Keys=burning_output_per_building_element, ValuesValuesA=building_element_names_2)  # -> reverse(Keys), reverse(ValuesValuesA)
sort_list_18 = SortList(Keys=reusing_output_per_building_element, ValuesValuesA=building_element_names_2)  # -> reverse(Keys), reverse(ValuesValuesA)
sort_list_19 = SortList(Keys=recycled_input_per_building_element, ValuesValuesA=building_element_names_2)  # -> reverse(Keys), reverse(ValuesValuesA)
sort_list_20 = SortList(Keys=landfill_output_per_building_element, ValuesValuesA=building_element_names_2)  # -> reverse(Keys), reverse(ValuesValuesA)
sort_list_21 = SortList(Keys=recycling_output_per_building_element, ValuesValuesA=building_element_names_2)  # -> reverse(Keys), reverse(ValuesValuesA)
panel_90 = Panel("""MCI
[%]""")
panel_91 = Panel("""New material input
[%]""")
panel_92 = Panel("""PCI
[%]""")
panel_93 = Panel("""Biobased material input
[%]""")
panel_94 = Panel("""DP
[%]""")
panel_95 = Panel("""Reused material input
[%]""")
panel_96 = Panel("""Burning material output
[%]""")
panel_97 = Panel("""Reusing material output
[%]""")
panel_98 = Panel("""Recycled material input
[%]""")
panel_99 = Panel("""Landfill material output
[%]""")
panel_100 = Panel("""Recycling material output
[%]""")
chart_31 = CreateChart(Data="0", SubTitle=panel_91, ChartType=1)
chart_32 = CreateChart(Data="0", SubTitle=panel_92, ChartType=1)
chart_33 = CreateChart(Data="0", SubTitle=panel_93, ChartType=1)
chart_34 = CreateChart(Data="0", SubTitle=panel_95, ChartType=1)
chart_35 = CreateChart(Data="0", SubTitle=panel_96, ChartType=1)
chart_36 = CreateChart(Data="0", SubTitle=panel_97, ChartType=1)
chart_37 = CreateChart(Data="0", SubTitle=panel_94, ChartType=1)
chart_38 = CreateChart(Data="0", SubTitle=panel_98, ChartType=1)
chart_39 = CreateChart(Data="0", SubTitle=panel_99, ChartType=1)
chart_40 = CreateChart(Data="0", SubTitle=panel_100, ChartType=1)
chart_41 = CreateChart(Data="0", SubTitle=panel_90, ChartType=1)
setchart_31 = SetChartContents(ChartToModify=chart_31, NewChartValues=flatten(sort_list_14.Keys), NewChartNames=sort_list_14.ValuesValuesA)
setchart_32 = SetChartContents(ChartToModify=chart_32, NewChartValues=flatten(sort_list_13.Keys), NewChartNames=sort_list_13.ValuesValuesA)
setchart_33 = SetChartContents(ChartToModify=chart_33, NewChartValues=flatten(sort_list_15.Keys), NewChartNames=sort_list_15.ValuesValuesA)
setchart_34 = SetChartContents(ChartToModify=chart_34, NewChartValues=flatten(sort_list_16.Keys), NewChartNames=sort_list_16.ValuesValuesA)
setchart_35 = SetChartContents(ChartToModify=chart_35, NewChartValues=flatten(sort_list_17.Keys), NewChartNames=sort_list_17.ValuesValuesA)
setchart_36 = SetChartContents(ChartToModify=chart_36, NewChartValues=flatten(sort_list_18.Keys), NewChartNames=sort_list_18.ValuesValuesA)
setchart_37 = SetChartContents(ChartToModify=chart_37, NewChartValues=flatten(sort_list_12.Keys), NewChartNames=sort_list_12.ValuesValuesA)
setchart_38 = SetChartContents(ChartToModify=chart_38, NewChartValues=flatten(sort_list_19.Keys), NewChartNames=sort_list_19.ValuesValuesA)
setchart_39 = SetChartContents(ChartToModify=chart_39, NewChartValues=flatten(sort_list_20.Keys), NewChartNames=sort_list_20.ValuesValuesA)
setchart_40 = SetChartContents(ChartToModify=chart_40, NewChartValues=flatten(sort_list_21.Keys), NewChartNames=sort_list_21.ValuesValuesA)
setchart_41 = SetChartContents(ChartToModify=chart_41, NewChartValues=flatten(sort_list_11.Keys), NewChartNames=sort_list_11.ValuesValuesA)
stack_51 = CreateStack(UIElements=flatten([chart_41, chart_37]), Horizontal=True)
stack_52 = CreateStack(UIElements=flatten([chart_32, chart_31]), Horizontal=True)
stack_53 = CreateStack(UIElements=flatten([chart_33, chart_38]), Horizontal=True)
stack_54 = CreateStack(UIElements=flatten([chart_34, chart_39]), Horizontal=True)
stack_55 = CreateStack(UIElements=flatten([chart_35, chart_40]), Horizontal=True)
stack_56 = CreateStack(UIElements=flatten(chart_36), Horizontal=True)
stack_57 = CreateStack(UIElements=flatten([stack_51, stack_52, stack_53, stack_54, stack_55, stack_56]), Horizontal=False)
chartappearance_9 = ChartAppearance(ChartToModify=[chart_41, chart_37, chart_32, chart_31, chart_33, chart_38, chart_34, chart_39, chart_35, chart_40, chart_36])
adjustpos_9 = AdjustElementPositioning(
    ElementsToAdjust=[chart_41, chart_37, chart_32, chart_31, chart_33, chart_38, chart_34, chart_39, chart_35, chart_40, chart_36],
    AbsolutePositioning=False,
    Width=Slider(220, range=0..2000),
    HorizontalAlignment=0,
    VerticalAlignment=3)

# ---- group: Results per NL/SfB class / Detailed results per NL/SfB class / MCI per NL/SfB class
# MCI per NL/SfB class
mass_addition_37 = MassAddition(Input=replace_18)  # -> TotalMKI, PartialResults
multiplication_22 = Multiplication(A=replace_17, B=replace_18)
mass_addition_38 = MassAddition(Input=multiplication_22)  # -> Result, PartialResults
division_35 = Division(A=mass_addition_38.Result, B=mass_addition_37.TotalMKI)
round_44 = Round(Number=division_35)  # -> Nearest, Floor, Ceiling

# ---- group: Results per NL/SfB class
mci_per_building_element_2 = Data(flatten(round_44.Nearest))
dp_per_building_element_2 = Data(flatten(round_34.Nearest))
biobased_input_per_building_element_2 = Data(flatten(round_37.Nearest))
recycling_output_per_building_element_2 = Data(flatten(round_42.Nearest))
included_nl_sfb_classes_2 = Panel(concatenate_3)
pci_per_building_element_2 = Data(flatten(round_35.Nearest))
new_input_per_building_element_2 = Data(flatten(round_36.Nearest))
burning_output_per_building_element_2 = Data(flatten(round_41.Nearest))
reusing_output_per_building_element_2 = Data(flatten(round_43.Nearest))
recycled_input_per_building_element_2 = Data(flatten(round_38.Nearest))
landfill_output_per_building_element_2 = Data(flatten(round_40.Nearest))
reused_input_per_building_element_2 = Data(flatten(round_39.Nearest))
sort_list_22 = SortList(Keys=mci_per_building_element_2, ValuesValuesA=included_nl_sfb_classes_2)  # -> reverse(Keys), reverse(ValuesValuesA)
sort_list_23 = SortList(Keys=dp_per_building_element_2, ValuesValuesA=included_nl_sfb_classes_2)  # -> reverse(Keys), reverse(ValuesValuesA)
sort_list_24 = SortList(Keys=pci_per_building_element_2, ValuesValuesA=included_nl_sfb_classes_2)  # -> reverse(Keys), reverse(ValuesValuesA)
sort_list_25 = SortList(Keys=new_input_per_building_element_2, ValuesValuesA=included_nl_sfb_classes_2)  # -> reverse(Keys), reverse(ValuesValuesA)
sort_list_26 = SortList(Keys=biobased_input_per_building_element_2, ValuesValuesA=included_nl_sfb_classes_2)  # -> reverse(Keys), reverse(ValuesValuesA)
sort_list_27 = SortList(Keys=reused_input_per_building_element_2, ValuesValuesA=included_nl_sfb_classes_2)  # -> reverse(Keys), reverse(ValuesValuesA)
sort_list_28 = SortList(Keys=burning_output_per_building_element_2, ValuesValuesA=included_nl_sfb_classes_2)  # -> reverse(Keys), reverse(ValuesValuesA)
sort_list_29 = SortList(Keys=reusing_output_per_building_element_2, ValuesValuesA=included_nl_sfb_classes_2)  # -> reverse(Keys), reverse(ValuesValuesA)
sort_list_30 = SortList(Keys=recycled_input_per_building_element_2, ValuesValuesA=included_nl_sfb_classes_2)  # -> reverse(Keys), reverse(ValuesValuesA)
sort_list_31 = SortList(Keys=landfill_output_per_building_element_2, ValuesValuesA=included_nl_sfb_classes_2)  # -> reverse(Keys), reverse(ValuesValuesA)
sort_list_32 = SortList(Keys=recycling_output_per_building_element_2, ValuesValuesA=included_nl_sfb_classes_2)  # -> reverse(Keys), reverse(ValuesValuesA)
panel_101 = Panel("""MCI
[%]""")
panel_102 = Panel("""New material input
[%]""")
panel_103 = Panel("""PCI
[%]""")
panel_104 = Panel("""Biobased material input
[%]""")
panel_105 = Panel("""DP
[%]""")
panel_106 = Panel("""Reused material input
[%]""")
panel_107 = Panel("""Burning material output
[%]""")
panel_108 = Panel("""Reusing material output
[%]""")
panel_109 = Panel("""Recycled material input
[%]""")
panel_110 = Panel("""Landfill material output
[%]""")
panel_111 = Panel("""Recycling material output
[%]""")
chart_42 = CreateChart(Data="0", SubTitle=panel_102, ChartType=1)
chart_43 = CreateChart(Data="0", SubTitle=panel_103, ChartType=1)
chart_44 = CreateChart(Data="0", SubTitle=panel_104, ChartType=1)
chart_45 = CreateChart(Data="0", SubTitle=panel_106, ChartType=1)
chart_46 = CreateChart(Data="0", SubTitle=panel_107, ChartType=1)
chart_47 = CreateChart(Data="0", SubTitle=panel_108, ChartType=1)
chart_48 = CreateChart(Data="0", SubTitle=panel_105, ChartType=1)
chart_49 = CreateChart(Data="0", SubTitle=panel_109, ChartType=1)
chart_50 = CreateChart(Data="0", SubTitle=panel_110, ChartType=1)
chart_51 = CreateChart(Data="0", SubTitle=panel_111, ChartType=1)
chart_52 = CreateChart(Data="0", SubTitle=panel_101, ChartType=1)
setchart_42 = SetChartContents(ChartToModify=chart_42, NewChartValues=flatten(sort_list_25.Keys), NewChartNames=sort_list_25.ValuesValuesA)
setchart_43 = SetChartContents(ChartToModify=chart_43, NewChartValues=flatten(sort_list_24.Keys), NewChartNames=sort_list_24.ValuesValuesA)
setchart_44 = SetChartContents(ChartToModify=chart_44, NewChartValues=flatten(sort_list_26.Keys), NewChartNames=sort_list_26.ValuesValuesA)
setchart_45 = SetChartContents(ChartToModify=chart_45, NewChartValues=flatten(sort_list_27.Keys), NewChartNames=sort_list_27.ValuesValuesA)
setchart_46 = SetChartContents(ChartToModify=chart_46, NewChartValues=flatten(sort_list_28.Keys), NewChartNames=sort_list_28.ValuesValuesA)
setchart_47 = SetChartContents(ChartToModify=chart_47, NewChartValues=flatten(sort_list_29.Keys), NewChartNames=sort_list_29.ValuesValuesA)
setchart_48 = SetChartContents(ChartToModify=chart_48, NewChartValues=flatten(sort_list_23.Keys), NewChartNames=sort_list_23.ValuesValuesA)
setchart_49 = SetChartContents(ChartToModify=chart_49, NewChartValues=flatten(sort_list_30.Keys), NewChartNames=sort_list_30.ValuesValuesA)
setchart_50 = SetChartContents(ChartToModify=chart_50, NewChartValues=flatten(sort_list_31.Keys), NewChartNames=sort_list_31.ValuesValuesA)
setchart_51 = SetChartContents(ChartToModify=chart_51, NewChartValues=flatten(sort_list_32.Keys), NewChartNames=sort_list_32.ValuesValuesA)
setchart_52 = SetChartContents(ChartToModify=chart_52, NewChartValues=flatten(sort_list_22.Keys), NewChartNames=sort_list_22.ValuesValuesA)
stack_58 = CreateStack(UIElements=flatten([chart_52, chart_48]), Horizontal=True)
stack_59 = CreateStack(UIElements=flatten([chart_43, chart_42]), Horizontal=True)
stack_60 = CreateStack(UIElements=flatten([chart_44, chart_49]), Horizontal=True)
stack_61 = CreateStack(UIElements=flatten([chart_45, chart_50]), Horizontal=True)
stack_62 = CreateStack(UIElements=flatten([chart_46, chart_51]), Horizontal=True)
stack_63 = CreateStack(UIElements=flatten(chart_47), Horizontal=True)
chartappearance_10 = ChartAppearance(ChartToModify=[chart_52, chart_48, chart_43, chart_42, chart_44, chart_49, chart_45, chart_50, chart_46, chart_51, chart_47])
adjustpos_10 = AdjustElementPositioning(
    ElementsToAdjust=[chart_52, chart_48, chart_43, chart_42, chart_44, chart_49, chart_45, chart_50, chart_46, chart_51, chart_47],
    AbsolutePositioning=False,
    Width=Slider(220, range=0..2000),
    HorizontalAlignment=0,
    VerticalAlignment=3)
stack_64 = CreateStack(UIElements=flatten([stack_58, stack_59, stack_60, stack_61, stack_62, stack_63]), Horizontal=False)

# ---- group: Results per building element
expander_11 = CreateExpander(UIElements=flatten(stack_57), Header="RESULTS PER BUILDING ELEMENT", Open=False)
adjust_element_appearance_33 = AdjustElementAppearance(
    ElementsToAdjust=expander_11,
    Foreground=ColourSwatch(SwatchColor=RGB(255, 255, 255)),
    Background=ColourSwatch(SwatchColor=RGB(77, 137, 116)),
    FontSize=18)

# ---- group: Results per NL/SfB class
expander_12 = CreateExpander(UIElements=flatten(stack_64), Header="RESULTS PER NL/SFB CLASS", Open=False)
adjust_element_appearance_34 = AdjustElementAppearance(
    ElementsToAdjust=expander_12,
    Foreground=ColourSwatch(SwatchColor=RGB(255, 255, 255)),
    Background=ColourSwatch(SwatchColor=RGB(77, 137, 116)),
    FontSize=18)

# ----
# Tab 2.2: Circularity
colour_swatch_57 = ColourSwatch(SwatchColor=RGB(255, 255, 255))
adjust_element_appearance_35 = AdjustElementAppearance(ElementsToAdjust=label_55, Foreground=colour_swatch_57, Background=ColourSwatch(SwatchColor=RGB(77, 137, 116)))
separator_72 = CreateSeparator(Thickness=10, Horizontal=True, Color=RGBA(255, 255, 255, 0))
separator_73 = CreateSeparator(Thickness=10, Horizontal=True, Color=RGBA(255, 255, 255, 0))
merge_38 = Merge(Data1=merge_12, Data2=expander_5, Data3=separator_72, Data4=expander_11, Data5=separator_73, Data6=expander_12)  # -> flatten(CircularityDetailedResults)

# ---- group: Results per building element / Detailed results per building element
# Detailed results per building element
financial_impact_per_building_element = Data(split_tree_39.FinancialImpactPerBuildingElement)
split_tree_80 = SplitTree(Data=financial_impact_per_building_element, Masks=flatten("{?;0}"))  # -> Positive, Negative
split_tree_81 = SplitTree(Data=financial_impact_per_building_element, Masks=flatten("{?;17}"))  # -> DirectCosts, Negative
split_tree_82 = SplitTree(Data=financial_impact_per_building_element, Masks=flatten("{?;18}"))  # -> TruePrice, Negative
split_tree_83 = SplitTree(Data=financial_impact_per_building_element, Masks=flatten("{?;15}"))  # -> MaterialCosts, Negative
split_tree_84 = SplitTree(Data=financial_impact_per_building_element, Masks=flatten("{?;16}"))  # -> LabourCosts, Negative
split_tree_85 = SplitTree(Data=financial_impact_per_building_element, Masks=flatten("{?;14}"))  # -> ShadowCostsMKI, Negative
cull_index_52 = CullIndex(List=split_tree_80.Positive, Indices=0, Wrap=True)  # -> flatten(List)
cull_index_53 = CullIndex(List=split_tree_81.DirectCosts, Indices=0, Wrap=True)  # -> simplify(DirectCosts)
cull_index_54 = CullIndex(List=split_tree_82.TruePrice, Indices=0, Wrap=True)  # -> simplify(TruePrice)
cull_index_55 = CullIndex(List=split_tree_83.MaterialCosts, Indices=0, Wrap=True)  # -> simplify(MaterialCosts)
cull_index_56 = CullIndex(List=split_tree_84.LabourCosts, Indices=0, Wrap=True)  # -> simplify(LabourCosts)
cull_index_57 = CullIndex(List=split_tree_85.ShadowCostsMKI, Indices=0, Wrap=True)  # -> simplify(ShadowCostsMKI)
round_45 = Round(Number=cull_index_53)  # -> Nearest, Floor, Ceiling
round_46 = Round(Number=cull_index_54)  # -> Nearest, Floor, Ceiling
round_47 = Round(Number=cull_index_55)  # -> Nearest, Floor, Ceiling
round_48 = Round(Number=cull_index_56)  # -> Nearest, Floor, Ceiling
round_49 = Round(Number=cull_index_57)  # -> Nearest, Floor, Ceiling

# ---- group: Results per NL/SfB class / Detailed results per NL/SfB class
# Detailed results per NL/SfB class
financial_impact_per_nl_sfb_class = Data(cluster_15)

# ---- group: Results per NL/SfB class / Detailed results per NL/SfB class / Included NL/SfB classes
# Included NL/SfB classes
split_tree_86 = SplitTree(Data=financial_impact_per_nl_sfb_class, Masks=flatten(["{?;?;1}", "{?;?;2}"]))  # -> Positive, Negative
cull_index_58 = CullIndex(List=split_tree_86.Positive, Indices=0, Wrap=True)  # -> simplify(List)
tstat_29 = TreeStatistics(Tree=cull_index_58)  # -> Paths, Length, Count
dpath_29 = DeconstructPath(Branch=tstat_29.Paths)
item_29 = ListItem(List=dpath_29, Index=0, Wrap=True)
path_29 = ConstructPath(Indices=item_29)
replace_29 = ReplacePaths(Data=cull_index_58, Search=tstat_29.Paths, Replace=flatten(path_29))
list_item_19 = ListItem(List=replace_29, Index=0, Wrap=True)  # -> Item, Item1
concatenate_4 = Concatenate(Fragment_A=list_item_19.Item, Space=" ", Fragment_B=list_item_19.Item1)  # -> flatten(NLSfBClasses)

# ---- group: Results per NL/SfB class / Detailed results per NL/SfB class / Direct costs per NL/SfB class
# Direct costs per NL/SfB class
split_tree_87 = SplitTree(Data=financial_impact_per_nl_sfb_class, Masks=flatten("{?;?;17}"))  # -> DirectCosts, Negative
cull_index_59 = CullIndex(List=split_tree_87.DirectCosts, Indices=0, Wrap=True)  # -> simplify(List)
tstat_30 = TreeStatistics(Tree=cull_index_59)  # -> Paths, Length, Count
dpath_30 = DeconstructPath(Branch=tstat_30.Paths)
item_30 = ListItem(List=dpath_30, Index=0, Wrap=True)
path_30 = ConstructPath(Indices=item_30)
replace_30 = ReplacePaths(Data=cull_index_59, Search=tstat_30.Paths, Replace=flatten(path_30))
mass_addition_39 = MassAddition(Input=replace_30)  # -> Result, PartialResults
round_50 = Round(Number=mass_addition_39.Result)  # -> Nearest, Floor, Ceiling

# ---- group: Results per NL/SfB class / Detailed results per NL/SfB class / True price per NL/SfB class
# True price per NL/SfB class
split_tree_88 = SplitTree(Data=financial_impact_per_nl_sfb_class, Masks=flatten("{?;?;18}"))  # -> TruePrice, Negative
cull_index_60 = CullIndex(List=split_tree_88.TruePrice, Indices=0, Wrap=True)  # -> simplify(List)
tstat_31 = TreeStatistics(Tree=cull_index_60)  # -> Paths, Length, Count
dpath_31 = DeconstructPath(Branch=tstat_31.Paths)
item_31 = ListItem(List=dpath_31, Index=0, Wrap=True)
path_31 = ConstructPath(Indices=item_31)
replace_31 = ReplacePaths(Data=cull_index_60, Search=tstat_31.Paths, Replace=flatten(path_31))
mass_addition_40 = MassAddition(Input=replace_31)  # -> Result, PartialResults
round_51 = Round(Number=mass_addition_40.Result)  # -> Nearest, Floor, Ceiling

# ---- group: Results per NL/SfB class / Detailed results per NL/SfB class / Material costs per NL/SfB class
# Material costs per NL/SfB class
split_tree_89 = SplitTree(Data=financial_impact_per_nl_sfb_class, Masks=flatten("{?;?;15}"))  # -> MaterialCosts, Negative
cull_index_61 = CullIndex(List=split_tree_89.MaterialCosts, Indices=0, Wrap=True)  # -> simplify(List)
tstat_32 = TreeStatistics(Tree=cull_index_61)  # -> Paths, Length, Count
dpath_32 = DeconstructPath(Branch=tstat_32.Paths)
item_32 = ListItem(List=dpath_32, Index=0, Wrap=True)
path_32 = ConstructPath(Indices=item_32)
replace_32 = ReplacePaths(Data=cull_index_61, Search=tstat_32.Paths, Replace=flatten(path_32))
mass_addition_41 = MassAddition(Input=replace_32)  # -> Result, PartialResults
round_52 = Round(Number=mass_addition_41.Result)  # -> Nearest, Floor, Ceiling

# ---- group: Results per NL/SfB class / Detailed results per NL/SfB class / Labour costs per NL/SfB class
# Labour costs per NL/SfB class
split_tree_90 = SplitTree(Data=financial_impact_per_nl_sfb_class, Masks=flatten("{?;?;16}"))  # -> LabourCosts, Negative
cull_index_62 = CullIndex(List=split_tree_90.LabourCosts, Indices=0, Wrap=True)  # -> simplify(List)
tstat_33 = TreeStatistics(Tree=cull_index_62)  # -> Paths, Length, Count
dpath_33 = DeconstructPath(Branch=tstat_33.Paths)
item_33 = ListItem(List=dpath_33, Index=0, Wrap=True)
path_33 = ConstructPath(Indices=item_33)
replace_33 = ReplacePaths(Data=cull_index_62, Search=tstat_33.Paths, Replace=flatten(path_33))
mass_addition_42 = MassAddition(Input=replace_33)  # -> Result, PartialResults
round_53 = Round(Number=mass_addition_42.Result)  # -> Nearest, Floor, Ceiling

# ---- group: Results per NL/SfB class / Detailed results per NL/SfB class / Shadow costs (MKI) per NL/SfB class
# Shadow costs (MKI) per NL/SfB class
split_tree_91 = SplitTree(Data=financial_impact_per_nl_sfb_class, Masks=flatten("{?;?;14}"))  # -> ShadowCostsMKI, Negative
cull_index_63 = CullIndex(List=split_tree_91.ShadowCostsMKI, Indices=0, Wrap=True)  # -> simplify(List)
tstat_34 = TreeStatistics(Tree=cull_index_63)  # -> Paths, Length, Count
dpath_34 = DeconstructPath(Branch=tstat_34.Paths)
item_34 = ListItem(List=dpath_34, Index=0, Wrap=True)
path_34 = ConstructPath(Indices=item_34)
replace_34 = ReplacePaths(Data=cull_index_63, Search=tstat_34.Paths, Replace=flatten(path_34))
mass_addition_43 = MassAddition(Input=replace_34)  # -> Result, PartialResults
round_54 = Round(Number=mass_addition_43.Result)  # -> Nearest, Floor, Ceiling

# ---- group: Results per building element
building_element_names_3 = Panel(cull_index_52)
direct_costs_per_building_element = Data(flatten(round_45.Nearest))
true_price_per_building_element = Data(flatten(round_46.Nearest))
material_costs_per_building_element = Data(flatten(round_47.Nearest))
labour_costs_per_building_element = Data(flatten(round_48.Nearest))
shadow_costs_mki_per_building_element = Data(flatten(round_49.Nearest))
sort_list_33 = SortList(Keys=direct_costs_per_building_element, ValuesValuesA=building_element_names_3)  # -> reverse(Keys), reverse(ValuesValuesA)
sort_list_34 = SortList(Keys=true_price_per_building_element, ValuesValuesA=building_element_names_3)  # -> reverse(Keys), reverse(ValuesValuesA)
sort_list_35 = SortList(Keys=material_costs_per_building_element, ValuesValuesA=building_element_names_3)  # -> reverse(Keys), reverse(ValuesValuesA)
sort_list_36 = SortList(Keys=labour_costs_per_building_element, ValuesValuesA=building_element_names_3)  # -> reverse(Keys), reverse(ValuesValuesA)
sort_list_37 = SortList(Keys=shadow_costs_mki_per_building_element, ValuesValuesA=building_element_names_3)  # -> reverse(Keys), reverse(ValuesValuesA)
panel_112 = Panel("""Direct costs
[€]""")
panel_113 = Panel("""Labour costs
[€]""")
panel_114 = Panel("""Material costs
[€]""")
panel_115 = Panel("""Shadow costs (MKI)
[€]""")
panel_116 = Panel("""True price
[€]""")
chart_53 = CreateChart(Data="0", SubTitle=panel_113, ChartType=1)
chart_54 = CreateChart(Data="0", SubTitle=panel_114, ChartType=1)
chart_55 = CreateChart(Data="0", SubTitle=panel_115, ChartType=1)
chart_56 = CreateChart(Data="0", SubTitle=panel_116, ChartType=1)
chart_57 = CreateChart(Data="0", SubTitle=panel_112, ChartType=1)
setchart_53 = SetChartContents(ChartToModify=chart_53, NewChartValues=flatten(sort_list_36.Keys), NewChartNames=sort_list_36.ValuesValuesA)
setchart_54 = SetChartContents(ChartToModify=chart_54, NewChartValues=flatten(sort_list_35.Keys), NewChartNames=sort_list_35.ValuesValuesA)
setchart_55 = SetChartContents(ChartToModify=chart_55, NewChartValues=flatten(sort_list_37.Keys), NewChartNames=sort_list_37.ValuesValuesA)
setchart_56 = SetChartContents(ChartToModify=chart_56, NewChartValues=flatten(sort_list_34.Keys), NewChartNames=sort_list_34.ValuesValuesA)
setchart_57 = SetChartContents(ChartToModify=chart_57, NewChartValues=flatten(sort_list_33.Keys), NewChartNames=sort_list_33.ValuesValuesA)
stack_65 = CreateStack(UIElements=flatten([chart_57, chart_56]), Horizontal=True)
stack_66 = CreateStack(UIElements=flatten([chart_54, chart_53]), Horizontal=True)
stack_67 = CreateStack(UIElements=flatten(chart_55), Horizontal=True)
stack_68 = CreateStack(UIElements=flatten([stack_65, stack_66, stack_67]), Horizontal=False)
chartappearance_11 = ChartAppearance(ChartToModify=[chart_57, chart_56, chart_54, chart_53, chart_55])
adjustpos_11 = AdjustElementPositioning(
    ElementsToAdjust=[chart_57, chart_56, chart_54, chart_53, chart_55],
    AbsolutePositioning=False,
    Width=Slider(220, range=0..2000),
    HorizontalAlignment=0,
    VerticalAlignment=3)

# ---- group: Results per NL/SfB class
shadow_costs_mki_per_nl_sfb_class = Data(flatten(round_54.Nearest))
direct_costs_per_nl_sfb_class_3 = Data(flatten(round_50.Nearest))
true_price_per_nl_sfb_class_2 = Data(flatten(round_51.Nearest))
material_costs_per_nl_sfb_class = Data(flatten(round_52.Nearest))
labour_costs_per_nl_sfb_class = Data(flatten(round_53.Nearest))
included_nl_sfb_classes_3 = Panel(concatenate_4)
sort_list_38 = SortList(Keys=direct_costs_per_nl_sfb_class_3, ValuesValuesA=included_nl_sfb_classes_3)  # -> reverse(Keys), reverse(ValuesValuesA)
sort_list_39 = SortList(Keys=true_price_per_nl_sfb_class_2, ValuesValuesA=included_nl_sfb_classes_3)  # -> reverse(Keys), reverse(ValuesValuesA)
sort_list_40 = SortList(Keys=material_costs_per_nl_sfb_class, ValuesValuesA=included_nl_sfb_classes_3)  # -> reverse(Keys), reverse(ValuesValuesA)
sort_list_41 = SortList(Keys=labour_costs_per_nl_sfb_class, ValuesValuesA=included_nl_sfb_classes_3)  # -> reverse(Keys), reverse(ValuesValuesA)
sort_list_42 = SortList(Keys=shadow_costs_mki_per_nl_sfb_class, ValuesValuesA=included_nl_sfb_classes_3)  # -> reverse(Keys), reverse(ValuesValuesA)
panel_117 = Panel("""Direct costs
[€]""")
panel_118 = Panel("""Labour costs
[€]""")
panel_119 = Panel("""Shadow costs (MKI)
[€]""")
panel_120 = Panel("""Material costs
[€]""")
panel_121 = Panel("""True price
[€]""")
chart_58 = CreateChart(Data="0", SubTitle=panel_118, ChartType=1)
chart_59 = CreateChart(Data="0", SubTitle=panel_120, ChartType=1)
chart_60 = CreateChart(Data="0", SubTitle=panel_119, ChartType=1)
chart_61 = CreateChart(Data="0", SubTitle=panel_121, ChartType=1)
chart_62 = CreateChart(Data="0", SubTitle=panel_117, ChartType=1)
setchart_58 = SetChartContents(ChartToModify=chart_58, NewChartValues=flatten(sort_list_41.Keys), NewChartNames=sort_list_41.ValuesValuesA)
setchart_59 = SetChartContents(ChartToModify=chart_59, NewChartValues=flatten(sort_list_40.Keys), NewChartNames=sort_list_40.ValuesValuesA)
setchart_60 = SetChartContents(ChartToModify=chart_60, NewChartValues=flatten(sort_list_42.Keys), NewChartNames=sort_list_42.ValuesValuesA)
setchart_61 = SetChartContents(ChartToModify=chart_61, NewChartValues=flatten(sort_list_39.Keys), NewChartNames=sort_list_39.ValuesValuesA)
setchart_62 = SetChartContents(ChartToModify=chart_62, NewChartValues=flatten(sort_list_38.Keys), NewChartNames=sort_list_38.ValuesValuesA)
stack_69 = CreateStack(UIElements=flatten([chart_62, chart_61]), Horizontal=True)
stack_70 = CreateStack(UIElements=flatten([chart_59, chart_58]), Horizontal=True)
stack_71 = CreateStack(UIElements=flatten(chart_60), Horizontal=True)
stack_72 = CreateStack(UIElements=flatten([stack_69, stack_70, stack_71]), Horizontal=False)
chartappearance_12 = ChartAppearance(ChartToModify=[chart_62, chart_61, chart_59, chart_58, chart_60])
adjustpos_12 = AdjustElementPositioning(
    ElementsToAdjust=[chart_62, chart_61, chart_59, chart_58, chart_60],
    AbsolutePositioning=False,
    Width=Slider(220, range=0..2000),
    HorizontalAlignment=0,
    VerticalAlignment=3)

# ---- group: Results per building element
expander_13 = CreateExpander(UIElements=flatten(stack_68), Header="RESULTS PER BUILDING ELEMENT", Open=False)
adjust_element_appearance_36 = AdjustElementAppearance(
    ElementsToAdjust=expander_13,
    Foreground=ColourSwatch(SwatchColor=RGB(255, 255, 255)),
    Background=ColourSwatch(SwatchColor=RGB(245, 200, 61)),
    FontSize=18)

# ---- group: Results per NL/SfB class
expander_14 = CreateExpander(UIElements=flatten(stack_72), Header="RESULTS PER NL/SFB CLASS", Open=False)
adjust_element_appearance_37 = AdjustElementAppearance(
    ElementsToAdjust=expander_14,
    Foreground=ColourSwatch(SwatchColor=RGB(255, 255, 255)),
    Background=ColourSwatch(SwatchColor=RGB(245, 200, 61)),
    FontSize=18)

# ----
# Tab 2.3: Financial Impact
colour_swatch_58 = ColourSwatch(SwatchColor=RGB(255, 255, 255))
adjust_element_appearance_38 = AdjustElementAppearance(ElementsToAdjust=label_58, Foreground=colour_swatch_58, Background=ColourSwatch(SwatchColor=RGB(245, 200, 61)))
separator_74 = CreateSeparator(Thickness=10, Horizontal=True, Color=RGBA(255, 255, 255, 0))
separator_75 = CreateSeparator(Thickness=10, Horizontal=True, Color=RGBA(255, 255, 255, 0))
merge_39 = Merge(Data1=merge_13, Data2=expander_4, Data3=separator_74, Data4=expander_13, Data5=separator_75, Data6=expander_14)  # -> flatten(FinancialImpactDetailedResults)

# ---- group: Top captions (continued)
tabbed_view = TabbedView(TabNames=panel_74, TabTextSize=15, Tab0=flatten(merge_37), Tab1=flatten(merge_38), Tab2=flatten(merge_39))
merge_40 = Merge(Data1=merge_36, Data2=tabbed_view)  # -> flatten(Tab2DetailedResults)
adjust_element_appearance_39 = AdjustElementAppearance(ElementsToAdjust=tabbed_view, Background=ColourSwatch(SwatchColor=RGBA(255, 255, 255, 0)))

# ---- group: Interface Windows / ReLifeCycle Results window (continued)
tabbed_view_2 = TabbedView(
    TabNames=panel_68,
    TabTextSize=15,
    Tab0=flatten(merge_35),
    Tab1=flatten(merge_40),
    Tab2=flatten(merge_16),
    Tab3=flatten(merge_18))
add_elements = AddElements(Window=launch_transparent_window, Elements=flatten(tabbed_view_2), DoVLChecking=True)  # -> AddedElements, ElementNames
adjust_element_appearance_40 = AdjustElementAppearance(ElementsToAdjust=tabbed_view_2, Background=ColourSwatch(SwatchColor=RGBA(255, 255, 255, 0)))

# ---- group: Text Types / Text types results window (continued)
# Interface design properties
headliner_9 = Data([headliner, headliner_8, headliner_2, headliner_3])
heading_1_3 = Data([label, label_115, label_59, label_78])

# ---- group: Fonts / Aptos Black (continued)
set_element_property_2 = SetElementProperty(
    UIElement=[headliner_9, heading_2, label_3, label_4, label_13, headliner_6, heading_2_2, label_84, label_85, label_87, label_88, label_86, label_52, expander_9, expander_8, expander_10, label_55, expander_5, expander_11, expander_12, expander_4, expander_13, label_58, expander_14],
    PropertyName="FontFamily",
    ValueToSet=create_objects_from_xaml_2)

# ---- group: Fonts / Aptos Extrabold (continued)
set_element_property_3 = SetElementProperty(
    UIElement=[heading_1_3, label_92, heading_3, heading_1, label_66, label_67, label_44, label_51, label_53, label_56],
    PropertyName="FontFamily",
    ValueToSet=create_objects_from_xaml_3)

# ---- group: Text Properties / Texts "ReLifeCycle Results" window (continued)
headliner_10 = AdjustElementAppearance(ElementsToAdjust=headliner_9, Foreground=colour_swatch_5, Background=colour_swatch_8)
heading_1_4 = AdjustElementAppearance(ElementsToAdjust=heading_1_3, Foreground=colour_swatch_5, Background=colour_swatch_9)

# ---- group: Solution selector
# With this script, users will be able to connect the MOO results to the interface
# 
# For this script to work it is necessary to rename the optimisation gene sliders with prefix "wlc_" (wlc_1, wlc_2, etc.)
panel_122 = Panel("Grasshopper.Kernel.Special.GH_NumberSlider")
get_object_by_nickname = GetObjectByNickname(NickName="wlc*")
match_text_2 = MatchText(Text=get_object_by_nickname, Pattern=panel_122, Case=True)
slider_values = Number(tree_branch)
cull_pattern_5 = CullPattern(List=get_object_by_nickname, CullPattern=match_text_2)
flatten_tree = FlattenTree(Tree=slider_values, Path="{0}")
list_length_13 = ListLength(List=slider_values)  # -> flatten(Length)
param_info = ParamInfo(Param=cull_pattern_5)  # -> Name, NickName, DataType, Pivot, Bounds, Sources, Recipients, Kind
list_item_20 = ListItem(List=list_length_13, Index=0, Wrap=True)
partition_list = PartitionList(List=flatten_tree, Size=list_item_20)  # -> simplify(Chunks)
sort_text = SortText(Keys=param_info.NickName, Values=param_info.NickName, Culture=127)  # -> Keys, Values
item_index = ItemIndex(List=param_info.NickName, Item=sort_text.Values)
list_item_21 = ListItem(List=cull_pattern_5, Index=item_index, Wrap=True)
tree_statistics_3 = TreeStatistics(Tree=slider_values)  # -> Paths, Length, Count
subtraction_4 = Subtraction(A=tree_statistics_3.Count, B=1)

# ---- group: Solution selector interface elements / Solution selector slider
# Solution selector slider
number_slider_17 = Slider(0, range=0..10)
label_116 = CreateLabel(LabelText="Solution selector", LabelSize=18, Justification=0)
slider = CreateSlider(Slider=number_slider_17, ShowBounds=False, ShowTicks=False, ShowTooltip=False, ShowValLabel=True, showLabel=True)
set_slider = SetSlider(UISlider=slider, Range=subtraction_4)
create_stack_36 = CreateStack(UIElements=[label_116, slider], Horizontal=False)
values_3 = ValueListener(Elements=slider, SomeProperty=True)  # -> Values, Indices

# ---- group: Save & load function
button = CreateButton(ButtonName="Clear saved variants", ButtonStyle=1)
button_2 = CreateButton(ButtonName="Set as comparison variant", ButtonStyle=1)
textbox = CreateTextBox(Label="Variant name", UpdateButton=invert(True), showLabel=True)
pulldown = CreatePulldownMenu(SelectedIndex=0)  # -> flatten(Pulldown)
parameters_to_be_saved = Data(slider)
button_3 = CreateButton(ButtonName="Save variant", ButtonStyle=1)
separator_76 = CreateSeparator(Thickness=Slider(20, range=0..20), Horizontal=True, Color=RGBA(255, 255, 255, 0))
button_4 = CreateButton(ButtonName="Load variant", ButtonStyle=1)
label_117 = CreateLabel(LabelText="Saved variants", LabelSize=12, Justification=0)
adjustpos_13 = AdjustElementPositioning(ElementsToAdjust=button_3, AbsolutePositioning=False, HorizontalAlignment=0)
adjustpos_14 = AdjustElementPositioning(ElementsToAdjust=textbox, AbsolutePositioning=False, Width="385", HorizontalAlignment=0)
adjustpos_15 = AdjustElementPositioning(ElementsToAdjust=pulldown, AbsolutePositioning=False, Width="300", HorizontalAlignment=0)
value_listener_20 = ValueListener(Elements=button_2, SomeProperty=True)  # -> Values, Indices
stack_73 = CreateStack(UIElements=button, Horizontal=True)
stack_74 = CreateStack(UIElements=[label_117, pulldown], Horizontal=True)
stack_75 = CreateStack(UIElements=[button_4, button_2], Horizontal=True)
values_4 = ValueListener(Elements=button, SomeProperty=True)  # -> Values, Indices
values_5 = ValueListener(Elements=button_3, SomeProperty=True)  # -> Values, Indices
values_6 = ValueListener(Elements=pulldown, SomeProperty=True)  # -> Values, Indices
values_7 = ValueListener(Elements=button_4, SomeProperty=True)  # -> Values, Indices
dispatch = Dispatch(List=textbox, DispatchPattern=values_5.Values)  # -> ListA, ListB
values_8 = ValueListener(Elements=[dispatch.ListA, dispatch.ListB], SomeProperty=True)  # -> Values, Indices
bool = Boolean(values_4.Values)
data = Data(parameters_to_be_saved)
data_2 = Data(values_8.Values)
bool_2 = Boolean(values_5.Values)
data_3 = Data(values_7.Values)
txt = Text(values_6.Values)
data_4 = Data(pulldown)
panel_123 = Panel(data_3)
save_element_states = SaveElementStates(Elements=flatten(data), SaveState=bool_2, StateName=data_2, ClearSavedStates=bool)  # -> SavedStates, SavedStateNames
setlist = SetListContents(ListToModify=data_4, NewListContents=save_element_states.SavedStateNames)
restore = RestoreElementStates(Restore=data_3, SavedStates=save_element_states.SavedStates, StateNameToRestore=txt)

# ---- group: Solution selector interface elements
separator_77 = CreateSeparator(Thickness=50, Horizontal=False, Color=RGBA(255, 255, 255, 0))
panel_124 = Panel("When the solution selector is enabled, no changes can be made to your parameters and material choices. Disable the solution selector to make this possible again.")
create_text_block_2 = CreateTextBlock(Text=panel_124, TextSize=12, Justification=0)
create_stack_37 = CreateStack(UIElements=[create_toggle_6, separator_77, create_stack_36], Horizontal=True)
adjust_element_appearance_41 = AdjustElementAppearance(ElementsToAdjust=create_text_block_2, Foreground=ColourSwatch(SwatchColor=RGB(0, 0, 0)))

# ---- group: Save & load function / Set baseline variant name
# Set baseline variant name
c_script_11 = CSharpScript(x=values_6.Values, y=values_7.Values)  # -> A; inputs x: list of String, y: Boolean
# ---------- c_script_11: C# ----------
// Grasshopper Script Instance
#region Usings
using System;
using System.Linq;
using System.Collections;
using System.Collections.Generic;
using System.Drawing;

using Rhino;
using Rhino.Geometry;

using Grasshopper;
using Grasshopper.Kernel;
using Grasshopper.Kernel.Data;
using Grasshopper.Kernel.Types;
#endregion

public class Script_Instance : GH_ScriptInstance
{
    #region Notes
    /* 
      Members:
        RhinoDoc RhinoDocument
        GH_Document GrasshopperDocument
        IGH_Component Component
        int Iteration

      Methods (Virtual & overridable):
        Print(string text)
        Print(string format, params object[] args)
        Reflect(object obj)
        Reflect(object obj, string method_name)
    */
    #endregion

  private void RunScript(List<string> x, bool y, ref object A)
  {
    if (y)
      storedData = x;

    A = storedData;
  }

  // <Custom additional code> 
  List<string> storedData = new List<string>();
  // </Custom additional code> 
}
# ---------- end c_script_11 ----------
list_length_14 = ListLength(List=c_script_11)
smaller_than_15 = SmallerThan(FirstNumber=list_length_14, SecondNumber=0)  # -> SmallerThan, OrEqualTo
stream_filter_27 = StreamFilter(Gate=smaller_than_15.OrEqualTo, Stream0=c_script_11, Stream1=" ")
panel_125 = Panel(stream_filter_27)

# ---- group: General information (continued)
entwine_6 = Entwine(
    Branch00=explode_tree_8.Branch0,
    Branch01=stream_filter_27,
    Branch02=explode_tree_8.Branch2,
    Branch03=format_3,
    FlattenInputs=True)  # -> flatten(Result)
setlabel_21 = SetLabelContents(LabelToModify=label_91, NewLabelContents=entwine_6)
panel_126 = Panel(entwine_6)

# ---- group: Save & load function / Set comparison variant name
# Set comparison variant name
c_script_12 = CSharpScript(x=values_6.Values, y=value_listener_20.Values)  # -> A; inputs x: list of String, y: Boolean; same code as c_script_11
list_length_15 = ListLength(List=c_script_12)
smaller_than_16 = SmallerThan(FirstNumber=list_length_15, SecondNumber=0)  # -> SmallerThan, OrEqualTo
stream_filter_28 = StreamFilter(Gate=smaller_than_16.OrEqualTo, Stream0=c_script_12, Stream1=" ")
panel_127 = Panel(stream_filter_28)

# ---- group: Solution selector (continued)
tree_branch_13 = TreeBranch(Tree=partition_list, Path=values_3.Values, MaintainPaths=True)
stream_filter_29 = StreamFilter(Gate=values_2.Values, Stream1=tree_branch_13)
set_object_value = SetObjectValue(ObjectToSet=list_item_21, ValueToSet=stream_filter_29)

# ----
# Tab 1: Settings
merge_41 = Merge(
    Data1=merge_21,
    Data2=merge_19,
    Data3=create_stack_37,
    Data4=create_text_block_2,
    Data5=merge_20,
    Data6=textbox,
    Data7=button_3,
    Data8=separator_76,
    Data9=stack_74,
    Data10=stack_75,
    Data11=stack_73)  # -> flatten(Result)

# ---- group: Store total results data
entwine_7 = Entwine(Branch0X=flatten(explode_tree_8.Branch3), Branch1X=building_materials_2, Branch2X=total_results_2, FlattenInputs=False)
c_script_13 = CSharpScript(x=entwine_7, y=value_listener_20.Values)  # -> A; inputs x: tree, y: Boolean
# ---------- c_script_13: C# ----------
#region Usings
using System;
using System.Linq;
using System.Collections;
using System.Collections.Generic;
using System.Drawing;

using Rhino;
using Rhino.Geometry;

using Grasshopper;
using Grasshopper.Kernel;
using Grasshopper.Kernel.Data;
using Grasshopper.Kernel.Types;
#endregion

public class Script_Instance : GH_ScriptInstance
{
    #region Notes
    /* 
      Members:
        RhinoDoc RhinoDocument
        GH_Document GrasshopperDocument
        IGH_Component Component
        int Iteration

      Methods (Virtual & overridable):
        Print(string text)
        Print(string format, params object[] args)
        Reflect(object obj)
        Reflect(object obj, string method_name)
    */
    #endregion

    private void RunScript(DataTree<object> x, bool y, ref object A)
    {
        if (y)
        {
            // Manually duplicate the DataTree
            storedData = new DataTree<object>();
            foreach (var path in x.Paths)
            {
                storedData.AddRange(x.Branch(path), path);
            }
        }

        // Output the stored data
        A = storedData;
    }

    // <Custom additional code> 
    private DataTree<object> storedData = new DataTree<object>();
    // </Custom additional code> 
}
# ---------- end c_script_13 ----------
split_tree_92 = SplitTree(Data=c_script_13, Masks=flatten("{0;?}"))  # -> simplify(Positive), Negative
split_tree_93 = SplitTree(Data=split_tree_92.Negative, Masks=flatten("{1;?}"))  # -> simplify(BuildingMaterials), simplify(TotalResults)

# ---- group: Building materials list
building_materials_3 = Data(split_tree_93.BuildingMaterials)
list_item_22 = ListItem(List=building_materials_3, Index=0, Wrap=True)  # -> Item, Item1, Item2, Item3
panel_128 = Panel("""11 GROUND
13A FLOORS ON THE GROUND - STRUCTURE
13B FLOORS ON THE GROUND - INSULATION
16 FOUNDATION
17 PILE FOUNDATIONS
21A EXTERNAL WALLS - STRUCTURE
21B EXTERNAL WALLS - INSULATION
22A INTERNAL WALLS - STRUCTURE
22B INTERNAL WALLS - INSULATION
23A FLOORS - STRUCTURE
23B FLOORS - INSULATION
24 STAIRS AND RAMPS
27A ROOFS - STRUCTURE
27B ROOFS - INSULATION
28A LOAD-BEARING STRUCTURES - GENERAL
28B LOAD-BEARING STRUCTURES - REINFORCEMENT
31A EXTERNAL WALL OPENINGS - WINDOWS (FRAMES
31B EXTERNAL WALL OPENINGS - WINDOWS (GLAZING
31C EXTERNAL WALL OPENINGS - DOORS
32A INTERNAL WALL OPENINGS - WINDOWS (FRAMES)
32B INTERNAL WALL OPENINGS - WINDOWS (GLAZING)
32C INTERNAL WALL OPENINGS - DOORS
33A FLOOR OPENINGS - WINDOWS (FRAMES)
33B FLOOR OPENINGS - WINDOWS (GLAZING)
34 STAIR BALUSTRADES AND HANDRAILS
37A ROOF OPENINGS - WINDOWS (FRAMES)
37B ROOF OPENINGS - WINDOWS (GLAZING)
41 EXTERNAL WALL FINISHES
42 INTERNAL WALL FINISHES
43 FLOOR FINISHES
44 STAIR AND RAMP FINISHES
45 CEILING FINISHES
47 ROOF FINISHES""")
panel_129 = Panel("""11
13A
13B
16
17
21A
21B
22A
22B
23A
23B
24
27A
27B
28A
28B
31A
31B
31C
32A
32B
32C
33A
33B
34
37A
37B
41
42
43
44
45
47""")
match_text_3 = MatchText(Text=list_item_22.Item, Pattern=panel_129, Case=True)
graft_tree_2 = GraftTree(Tree=panel_128, IncludeEmptyLists=True, IncludeNullItems=True)  # -> simplify(Tree)
label_118 = CreateLabel(LabelText=graft(""), LabelSize=12, Justification=0)  # -> simplify(Label)
label_119 = CreateLabel(LabelText=graft(""), LabelSize=12, Justification=0)  # -> simplify(Material)
concatenate_5 = Concatenate(FragmentA=list_item_22.Item2, FragmentB=":")
flip_matrix_2 = FlipMatrix(Data=match_text_3)
label_120 = CreateLabel(LabelText=graft_tree_2, LabelSize=12, Justification=0)
stack_76 = CreateStack(UIElements=[label_118, label_119], Horizontal=True)
cull_pattern_6 = CullPattern(List=flatten(list_item_22.Item3), CullPattern=flip_matrix_2)
cull_pattern_7 = CullPattern(List=flatten(concatenate_5), CullPattern=flip_matrix_2)
text_join_3 = TextJoin(Text=cull_pattern_7)
text_join_4 = TextJoin(Text=cull_pattern_6)
create_stack_38 = CreateStack(UIElements=[label_120, stack_76], Horizontal=False)  # -> flatten(Stack)
list_length_16 = ListLength(List=cull_pattern_7)
set_label_contents_5 = SetLabelContents(LabelToModify=label_118, NewLabelContents=text_join_3)
set_label_contents_6 = SetLabelContents(LabelToModify=label_119, NewLabelContents=text_join_4)
equality_3 = Equality(FirstNumber=list_length_16, SecondNumber=0)  # -> Equality, flatten(Inequality)
hide_show_element_2 = HideShowElement(ElementToHideShow=create_stack_38, Show=equality_3.Inequality, Collapse=True, Disable=False)
separator_78 = CreateSeparator(Thickness=10, Horizontal=True, Color=RGBA(255, 255, 255, 0))
expander_15 = CreateExpander(UIElements=create_stack_38, Header="Building Materials", Open=False)

# ---- group: Text Types / Text types explore window (continued)
heading_3_3 = Data([label_79, merge_20, label_120])
material_list_names_3 = Data(label_118)

# ---- group: Text Properties / Texts "ReLifeCycle Explore" window (continued)
heading_3_4 = AdjustElementAppearance(ElementsToAdjust=heading_3_3, Foreground=colour_swatch_6, Background=colour_swatch_15)
material_list_names_4 = AdjustElementAppearance(ElementsToAdjust=material_list_names_3, Foreground=colour_swatch_12, Background=RGBA(255, 255, 255, 0))

# ---- group: Environmental Impact Total Results / Total environmental impact results
# Total environmental impact results
total_results_7 = Data(split_tree_93.TotalResults)
split_tree_94 = SplitTree(Data=total_results_7, Masks=flatten(["{0;0}", "{0;1}", "{0;2}"]))  # -> TotalEnvironmentalImpact, Negative
list_item_23 = ListItem(List=split_tree_94.TotalEnvironmentalImpact, Index=1, Wrap=True)
explode_tree_9 = ExplodeTree(Data=list_item_23)  # -> Branch0, Branch1, Branch2
division_36 = Division(A=explode_tree_9.Branch2, B=1000)
expression_19 = Expression(x=explode_tree_9.Branch0, Expression="Format(\"{0:0.000}\",x)")
expression_20 = Expression(x=division_36, Expression="Format(\"{0:0.00}\",x)")
expression_21 = Expression(x=explode_tree_9.Branch1, Expression="Format(\"{0:0.00}\",x)")

# ---- group: Total circularity results
total_results_8 = Data(split_tree_93.TotalResults)
split_tree_95 = SplitTree(Data=total_results_8, Masks=flatten("{1;?}"))  # -> TotalCircularity, Negative
list_item_24 = ListItem(List=split_tree_95.TotalCircularity, Index=1, Wrap=True)
round_55 = Round(Number=list_item_24)  # -> Nearest, Floor, Ceiling
explode_tree_10 = ExplodeTree(Data=round_55.Nearest)  # -> Branch0, Branch1, Branch2, Branch3, Branch4, Branch5, Branch6, Branch7, Branch8, Branch9

# ---- group: General information / GFA
# GFA
round_56 = Round(Number=split_tree_92.Positive)  # -> Nearest, Floor, Ceiling
label_121 = CreateLabel(LabelText="GFA:", LabelSize=24, Justification=0)
label_122 = CreateLabel(LabelText=" ", LabelSize=24, Justification=0)
format_13 = Format(Format="{0} m2", Culture=127, Data0=round_56.Nearest)
create_stack_39 = CreateStack(UIElements=[label_121, label_122], Horizontal=False)
setlabel_22 = SetLabelContents(LabelToModify=label_122, NewLabelContents=format_13)

# ---- group: General information
building_information_3 = Data(building_information)
list_item_25 = ListItem(List=building_information_3, Index=1, Wrap=True)
explode_tree_11 = ExplodeTree(Data=list_item_25)  # -> Branch0, Branch1, Branch2, Branch3
panel_130 = Panel("""Project name:   
Variant name:   
Building function:   
Functional lifespan:   """)
number_slider_18 = Slider(13, range=1..30)
format_14 = Format(Format="{0} years", Culture=127, Data0=explode_tree_11.Branch1)
entwine_8 = Entwine(
    Branch00=explode_tree_11.Branch0,
    Branch01=stream_filter_28,
    Branch02=explode_tree_11.Branch2,
    Branch03=format_14,
    FlattenInputs=True)  # -> flatten(Result)
label_123 = CreateLabel(LabelText=panel_130, LabelSize=number_slider_18, Justification=0)
label_124 = CreateLabel(LabelSize=number_slider_18, Justification=0)
create_stack_40 = CreateStack(UIElements=label_123, Horizontal=False)
create_stack_41 = CreateStack(UIElements=label_124, Horizontal=False)
setlabel_23 = SetLabelContents(LabelToModify=label_124, NewLabelContents=entwine_8)
separator_79 = CreateSeparator(Thickness=20, Horizontal=False, Color=RGBA(255, 255, 255, 0))
create_stack_42 = CreateStack(UIElements=[create_stack_40, create_stack_41, separator_79, create_stack_39], Horizontal=True)

# ---- group: HNN performance indicators
building_function_2 = Data(explode_tree_11.Branch2)
expression_22 = Expression(
    X=building_function_2,
    Expression="If(x=\"Residential function - ground based\", 0.45, If(x =\"Residential function - stacked\", 0.50, 0.70))")
expression_23 = Expression(
    X=building_function_2,
    Expression="If(x=\"Residential function - ground based\", 55, If(x =\"Residential function - stacked\", 50, 55))")
expression_24 = Expression(
    X=building_function_2,
    Expression="If(x=\"Residential function - ground based\", 75, If(x =\"Residential function - stacked\", 80, 75))")
expression_25 = Expression(X=building_function_2, Expression="If(x=\"Residential function - ground based\", 200, 240)")
format_15 = Format(Format="≤{0} (HNN)", Culture=127, Data0=expression_22)
format_16 = Format(Format="≤{0} (HNN)", Culture=127, Data0=expression_25)
format_17 = Format(Format="≥{0}% (HNN)", Culture=127, Data0=expression_23)
format_18 = Format(Format="≤{0}% new (HNN)", Culture=127, Data0=expression_24)

# ---- group: Total circularity results / Material output
# Material output
colour_swatch_59 = ColourSwatch(SwatchColor=RGB(77, 137, 116))
colour_swatch_60 = ColourSwatch(SwatchColor=RGB(127, 127, 127))
colour_swatch_61 = ColourSwatch(SwatchColor=RGB(163, 21, 21))
merge_42 = Merge(
    Data1=explode_tree_10.Branch6,
    Data2=explode_tree_10.Branch7,
    Data3=explode_tree_10.Branch8,
    Data4=explode_tree_10.Branch9)  # -> flatten(MaterialOutput)
panel_131 = Panel("""%Landfill
%Burning
%Recycling
%Reusing""")
label_125 = CreateLabel(LabelText="Material Output", LabelSize=18, Justification=0)
chart_63 = CreateChart(Data=0, Names=" ", Title=" ", ChartType=0)
setchart_63 = SetChartContents(ChartToModify=chart_63, NewChartValues=merge_42, NewChartNames=panel_131)
chart_appearance_9 = ChartAppearance(
    ChartToModify=chart_63,
    Colors=[colour_swatch_59, ColourSwatch(SwatchColor=RGB(141, 191, 174)), ColourSwatch(SwatchColor=RGB(179, 212, 201)), ColourSwatch(SwatchColor=RGB(217, 234, 228))],
    Legend=True,
    Title=False)
adjustelem_25 = AdjustElementAppearance(ElementsToAdjust=chart_63, Background=RGBA(255, 255, 255, 0))
stack_77 = CreateStack(UIElements=[label_125, chart_63], Horizontal=False)
panel_132 = Panel("Material output flows, as percentages of building mass, normalized by MKI.")
adjust_element_positioning_17 = AdjustElementPositioning(
    ElementsToAdjust=chart_63,
    Margin="-7,-45,-10,-10",
    AbsolutePositioning=False,
    Width=Slider(162, range=100..300),
    Height=Slider(205, range=0..1000))
tooltip_20 = AttachTooltipToElement(ElementsToAttachTo=stack_77, TooltipContent=panel_132, ShowDelay=500, Duration=100000)

# ---- group: Environmental Impact Total Results / MPG % deviation
# MPG % deviation
subtraction_5 = Subtraction(A=expression_19, B=baseline_mpg)
absolute = Absolute(Value=baseline_mpg)
division_37 = Division(A=subtraction_5, B=absolute)
multiplication_23 = Multiplication(A=division_37, B=100)
expression_26 = Expression(x=multiplication_23, Expression="Format(\"{0:0.0}\",x)")
label_size_4 = Slider(15, range=0..100)
smaller_than_17 = SmallerThan(FirstNumber=expression_26, SecondNumber=0)  # -> SmallerThan, OrEqualTo
label_126 = CreateLabel(LabelText=" ", LabelSize=label_size_4, Justification=0)
stream_filter_30 = StreamFilter(Gate=smaller_than_17.SmallerThan, Stream0="+{0}%", Stream1="{0}%")
stream_filter_31 = StreamFilter(
    Gate=smaller_than_17.SmallerThan,
    Stream0=ColourSwatch(SwatchColor=RGB(163, 21, 21)),
    Stream1=ColourSwatch(SwatchColor=RGB(0, 118, 21)))
format_19 = Format(Format=stream_filter_30, Culture=127, Data0=expression_26)  # -> simplify(Text)
set_label_contents_7 = SetLabelContents(LabelToModify=label_126, NewLabelContents=format_19)
adjustelem_26 = AdjustElementAppearance(ElementsToAdjust=label_126, Foreground=stream_filter_31)

# ---- group: Environmental Impact Total Results / PP% deviation
# PP% deviation
absolute_2 = Absolute(Value=baseline_pp)
subtraction_6 = Subtraction(A=expression_21, B=baseline_pp)
division_38 = Division(A=subtraction_6, B=absolute_2)
multiplication_24 = Multiplication(A=division_38, B=100)
expression_27 = Expression(x=multiplication_24, Expression="Format(\"{0:0.0}\",x)")
label_size_5 = Slider(15, range=0..100)
smaller_than_18 = SmallerThan(FirstNumber=expression_27, SecondNumber=0)  # -> SmallerThan, OrEqualTo
label_127 = CreateLabel(LabelText=" ", LabelSize=label_size_5, Justification=0)
stream_filter_32 = StreamFilter(Gate=smaller_than_18.SmallerThan, Stream0="+{0}%", Stream1="{0}%")
stream_filter_33 = StreamFilter(
    Gate=smaller_than_18.SmallerThan,
    Stream0=ColourSwatch(SwatchColor=RGB(163, 21, 21)),
    Stream1=ColourSwatch(SwatchColor=RGB(0, 118, 21)))
format_20 = Format(Format=stream_filter_32, Culture=127, Data0=expression_27)  # -> simplify(Text)
set_label_contents_8 = SetLabelContents(LabelToModify=label_127, NewLabelContents=format_20)
adjustelem_27 = AdjustElementAppearance(ElementsToAdjust=label_127, Foreground=stream_filter_33)

# ---- group: Environmental Impact Total Results / CSC % deviation
# CSC % deviation
subtraction_7 = Subtraction(A=expression_20, B=baseline_csc)
absolute_3 = Absolute(Value=baseline_csc)
division_39 = Division(A=subtraction_7, B=absolute_3)
multiplication_25 = Multiplication(A=division_39, B=100)
expression_28 = Expression(x=multiplication_25, Expression="Format(\"{0:0.0}\",x)")
label_size_6 = Slider(15, range=0..100)
smaller_than_19 = SmallerThan(FirstNumber=expression_28, SecondNumber=0)  # -> SmallerThan, OrEqualTo
label_128 = CreateLabel(LabelText=" ", LabelSize=label_size_6, Justification=0)
stream_filter_34 = StreamFilter(Gate=smaller_than_19.SmallerThan, Stream0="+{0}%", Stream1="{0}%")
stream_filter_35 = StreamFilter(
    Gate=smaller_than_19.SmallerThan,
    Stream0=ColourSwatch(SwatchColor=RGB(0, 118, 21)),
    Stream1=ColourSwatch(SwatchColor=RGB(163, 21, 21)))
format_21 = Format(Format=stream_filter_34, Culture=127, Data0=expression_28)  # -> simplify(Text)
set_label_contents_9 = SetLabelContents(LabelToModify=label_128, NewLabelContents=format_21)
adjustelem_28 = AdjustElementAppearance(ElementsToAdjust=label_128, Foreground=stream_filter_35)

# ---- group: Environmental Impact Total Results / CSC
# CSC
number_slider_19 = Slider(29, range=0..100)
label_size_7 = Slider(15, range=0..100)
label_129 = CreateLabel(LabelText="CSC", LabelSize=18, Justification=0)
label_130 = CreateLabel(LabelText=" ", LabelSize=number_slider_19, Justification=0)
label_131 = CreateLabel(LabelText="tonnes CO2", LabelSize=label_size_7, Justification=0)
setlabel_24 = SetLabelContents(LabelToModify=label_130, NewLabelContents=expression_20)
stack_78 = CreateStack(UIElements=[label_129, label_128, label_130, label_131], Horizontal=False)
adjustelem_29 = AdjustElementAppearance(ElementsToAdjust=[label_130, label_131], Foreground=ColourSwatch(SwatchColor=RGB(42, 91, 115)))
tooltip_21 = AttachTooltipToElement(ElementsToAttachTo=stack_78, TooltipContent="Construction Stored Carbon", ShowDelay=500, Duration=100000)

# ---- group: Total financial impact results
total_results_9 = Data(split_tree_93.TotalResults)
split_tree_96 = SplitTree(Data=total_results_9, Masks=flatten("{2;?}"))  # -> TotalFinancialImpact, Negative
list_item_26 = ListItem(List=split_tree_96.TotalFinancialImpact, Index=1, Wrap=True)
explode_tree_12 = ExplodeTree(Data=list_item_26)  # -> Branch0, Branch1, Branch2, Branch3, Branch4
expression_29 = Expression(x=explode_tree_12.Branch0, Expression="Format(\"{0:0}\",x)")
expression_30 = Expression(x=explode_tree_12.Branch1, Expression="Format(\"{0:0}\",x)")
expression_31 = Expression(x=explode_tree_12.Branch2, Expression="Format(\"{0:0}\",x)")
expression_32 = Expression(x=explode_tree_12.Branch3, Expression="Format(\"{0:0}\",x)")
expression_33 = Expression(x=explode_tree_12.Branch4, Expression="Format(\"{0:0}\",x)")
number_6 = Number(expression_29)
number_7 = Number(expression_30)
number_8 = Number(expression_31)
number_9 = Number(expression_32)
number_10 = Number(expression_33)
thousand_point_separator_7 = CSharpScript(x=number_6)  # -> a; same code as thousand_point_separator
thousand_point_separator_8 = CSharpScript(x=number_7)  # -> a; same code as thousand_point_separator
thousand_point_separator_9 = CSharpScript(x=number_8)  # -> a; same code as thousand_point_separator
thousand_point_separator_10 = CSharpScript(x=number_9)  # -> a; same code as thousand_point_separator
thousand_point_separator_11 = CSharpScript(x=number_10)  # -> a; same code as thousand_point_separator
format_22 = Format(
    Format="€{0}.-",
    Culture=127,
    Data0=[thousand_point_separator_7, thousand_point_separator_8, thousand_point_separator_9, thousand_point_separator_10, thousand_point_separator_11])  # -> simplify(Text)
explode_tree_13 = ExplodeTree(Data=format_22)  # -> Branch0, Branch1, Branch2, Branch3, Branch4

# ---- group: Total direct costs % deviation
subtraction_8 = Subtraction(A=expression_29, B=baseline_total_direct_costs)
division_40 = Division(A=subtraction_8, B=baseline_total_direct_costs)
multiplication_26 = Multiplication(A=division_40, B=100)
expression_34 = Expression(x=multiplication_26, Expression="Format(\"{0:0.0}\",x)")
label_size_8 = Slider(15, range=0..100)
smaller_than_20 = SmallerThan(FirstNumber=expression_34, SecondNumber=0)  # -> SmallerThan, OrEqualTo
label_132 = CreateLabel(LabelText=" ", LabelSize=label_size_8, Justification=0)
stream_filter_36 = StreamFilter(Gate=smaller_than_20.SmallerThan, Stream0="+{0}%", Stream1="{0}%")
stream_filter_37 = StreamFilter(
    Gate=smaller_than_20.SmallerThan,
    Stream0=ColourSwatch(SwatchColor=RGB(163, 21, 21)),
    Stream1=ColourSwatch(SwatchColor=RGB(0, 118, 21)))
format_23 = Format(Format=stream_filter_36, Culture=127, Data0=expression_34)  # -> simplify(Text)
set_label_contents_10 = SetLabelContents(LabelToModify=label_132, NewLabelContents=format_23)
adjustelem_30 = AdjustElementAppearance(ElementsToAdjust=label_132, Foreground=stream_filter_37)

# ---- group: Direct costs - total
label_133 = CreateLabel(LabelText="Direct Costs", LabelSize=18, Justification=0)
label_134 = CreateLabel(LabelText=" A", LabelSize=Slider(29, range=0..100), Justification=0)
setlabel_25 = SetLabelContents(LabelToModify=label_134, NewLabelContents=explode_tree_13.Branch0)
adjustelem_31 = AdjustElementAppearance(ElementsToAdjust=label_134, Foreground=ColourSwatch(SwatchColor=RGB(245, 200, 61)))
panel_133 = Panel("Total direct costs of the building, consisting of material and labour costs.")
stack_79 = CreateStack(UIElements=[label_133, label_132, label_134], Horizontal=False)
tooltip_22 = AttachTooltipToElement(ElementsToAttachTo=stack_79, TooltipContent=panel_133, ShowDelay=500, Duration=100000)

# ---- group: Total true price % deviation
subtraction_9 = Subtraction(A=expression_32, B=baseline_total_true_price)
division_41 = Division(A=subtraction_9, B=baseline_total_true_price)
multiplication_27 = Multiplication(A=division_41, B=100)
expression_35 = Expression(x=multiplication_27, Expression="Format(\"{0:0.0}\",x)")
label_size_9 = Slider(15, range=0..100)
smaller_than_21 = SmallerThan(FirstNumber=expression_35, SecondNumber=0)  # -> SmallerThan, OrEqualTo
label_135 = CreateLabel(LabelText=" ", LabelSize=label_size_9, Justification=0)
stream_filter_38 = StreamFilter(Gate=smaller_than_21.SmallerThan, Stream0="+{0}%", Stream1="{0}%")
stream_filter_39 = StreamFilter(
    Gate=smaller_than_21.SmallerThan,
    Stream0=ColourSwatch(SwatchColor=RGB(163, 21, 21)),
    Stream1=ColourSwatch(SwatchColor=RGB(0, 118, 21)))
format_24 = Format(Format=stream_filter_38, Culture=127, Data0=expression_35)  # -> simplify(Text)
set_label_contents_11 = SetLabelContents(LabelToModify=label_135, NewLabelContents=format_24)
adjustelem_32 = AdjustElementAppearance(ElementsToAdjust=label_135, Foreground=stream_filter_39)

# ---- group: Material, labour and shadow costs - total
merge_43 = Merge(Data1=number_7, Data2=number_8, Data3=number_10)  # -> flatten(MaterialLabourCostsTruePrice)
panel_134 = Panel("""Material Costs
Labour Costs
Shadow Costs""")
chart_64 = CreateChart(Data=0, Names=" ", Title=" ", ChartType=1)
setchart_64 = SetChartContents(ChartToModify=chart_64, NewChartValues=merge_43, NewChartNames=panel_134)
chart_appearance_10 = ChartAppearance(
    ChartToModify=chart_64,
    Colors=[ColourSwatch(SwatchColor=RGB(245, 200, 61)), ColourSwatch(SwatchColor=RGB(249, 222, 139)), ColourSwatch(SwatchColor=RGB(251, 233, 177))],
    Legend=True,
    Title=False)
adjustelem_33 = AdjustElementAppearance(ElementsToAdjust=chart_64, Background=RGBA(255, 255, 255, 0))
panel_135 = Panel("Total direct costs of the building, consisting of material and labour costs.")
adjust_element_positioning_18 = AdjustElementPositioning(
    ElementsToAdjust=chart_64,
    Margin="-7,-45,-10,-10",
    AbsolutePositioning=False,
    Width=Slider(257, range=100..300),
    Height=Slider(200, range=0..1000))
tooltip_23 = AttachTooltipToElement(ElementsToAttachTo=chart_64, TooltipContent=panel_135, ShowDelay=500, Duration=100000)

# ---- group: Material and labour costs - per m2 GFA
division_42 = Division(A=number_7, B=explode_tree_11.Branch3)
division_43 = Division(A=number_8, B=explode_tree_11.Branch3)
division_44 = Division(A=number_10, B=explode_tree_11.Branch3)
thousand_point_separator_12 = CSharpScript(x=division_42)  # -> a; same code as thousand_point_separator
thousand_point_separator_13 = CSharpScript(x=division_43)  # -> a; same code as thousand_point_separator
thousand_point_separator_14 = CSharpScript(x=division_44)  # -> a; same code as thousand_point_separator
merge_44 = Merge(Data1=thousand_point_separator_12, Data2=thousand_point_separator_13, Data3=thousand_point_separator_14)  # -> flatten(MaterialLabourCostsTruePrice)
panel_136 = Panel("""Material Costs
Labour Costs
Shadow Costs""")
chart_65 = CreateChart(Data=0, Names=" ", Title=" ", ChartType=1)
setchart_65 = SetChartContents(ChartToModify=chart_65, NewChartValues=merge_44, NewChartNames=panel_136)
chart_appearance_11 = ChartAppearance(
    ChartToModify=chart_65,
    Colors=[ColourSwatch(SwatchColor=RGB(245, 200, 61)), ColourSwatch(SwatchColor=RGB(249, 222, 139)), ColourSwatch(SwatchColor=RGB(251, 233, 177))],
    Legend=True,
    Title=False)
adjustelem_34 = AdjustElementAppearance(ElementsToAdjust=chart_65, Background=RGBA(255, 255, 255, 0))
panel_137 = Panel("Total direct costs of the building, consisting of material and labour costs.")
adjust_element_positioning_19 = AdjustElementPositioning(
    ElementsToAdjust=chart_65,
    Margin="-7,-45,-10,-10",
    AbsolutePositioning=False,
    Width=Slider(257, range=100..300),
    Height=Slider(200, range=0..1000),
    HorizontalAlignment=3)
tooltip_24 = AttachTooltipToElement(ElementsToAttachTo=chart_65, TooltipContent=panel_137, ShowDelay=500, Duration=100000)

# ---- group: Building costs calculation
direct_costs_2 = Data(expression_29)
division_45 = Division(A=direct_costs_2, B=100)
multiplication_28 = Multiplication(A=division_45, B=value_listener_5.Values)
addition_8 = Addition(A=direct_costs_2, B=multiplication_28)
division_46 = Division(A=addition_8, B=100)
multiplication_29 = Multiplication(A=division_46, B=value_listener_6.Values)
addition_9 = Addition(A=multiplication_29, B=multiplication_28, C=direct_costs_2)
division_47 = Division(A=addition_9, B=100)
multiplication_30 = Multiplication(A=division_47, B=value_listener_7.Values)
general_construction_costs_2 = Number(multiplication_28)
general_overhead_costs_2 = Number(multiplication_29)
risk_2 = Number(multiplication_30)
addition_10 = Addition(A=general_construction_costs_2, B=general_overhead_costs_2, C=risk_2)
indirect_costs_2 = Number(addition_10)
addition_11 = Addition(A=indirect_costs_2, B=direct_costs_2)
building_costs_2 = Number(addition_11)

# ---- group: Investment costs calculation
division_48 = Division(BuildingCosts=building_costs_2, B=100)
multiplication_31 = Multiplication(A=division_48, B=value_listener_8.Values)
multiplication_32 = Multiplication(A=division_48, B=value_listener_9.Values)
multiplication_33 = Multiplication(A=division_48, B=value_listener_3.Values)
multiplication_34 = Multiplication(A=division_48, B=value_listener_4.Values)
multiplication_35 = Multiplication(A=division_48, B=value_listener_10.Values)
multiplication_36 = Multiplication(A=division_48, B=value_listener_11.Values)
mass_addition_44 = MassAddition(Input=[multiplication_31, multiplication_32, multiplication_33, multiplication_34, multiplication_35, multiplication_36])  # -> Result, PartialResults
additional_costs_2 = Number(mass_addition_44.Result)
addition_12 = Addition(BuildingCosts=building_costs_2, AdditionalCosts=additional_costs_2)
investment_costs_3 = Number(addition_12)

# ---- group: Total investment costs % deviation
subtraction_10 = Subtraction(A=investment_costs_3, B=baseline_total_investment_costs)
division_49 = Division(A=subtraction_10, B=baseline_total_investment_costs)
multiplication_37 = Multiplication(A=division_49, B=100)
expression_36 = Expression(x=multiplication_37, Expression="Format(\"{0:0.0}\",x)")
label_size_10 = Slider(15, range=0..100)
smaller_than_22 = SmallerThan(FirstNumber=expression_36, SecondNumber=0)  # -> SmallerThan, OrEqualTo
label_136 = CreateLabel(LabelText=" ", LabelSize=label_size_10, Justification=0)
stream_filter_40 = StreamFilter(Gate=smaller_than_22.SmallerThan, Stream0="+{0}%", Stream1="{0}%")
stream_filter_41 = StreamFilter(
    Gate=smaller_than_22.SmallerThan,
    Stream0=ColourSwatch(SwatchColor=RGB(163, 21, 21)),
    Stream1=ColourSwatch(SwatchColor=RGB(0, 118, 21)))
format_25 = Format(Format=stream_filter_40, Culture=127, Data0=expression_36)  # -> simplify(Text)
set_label_contents_12 = SetLabelContents(LabelToModify=label_136, NewLabelContents=format_25)
adjustelem_35 = AdjustElementAppearance(ElementsToAdjust=label_136, Foreground=stream_filter_41)

# ---- group: Investment costs decomposed - per m2 GFA
division_50 = Division(AdditionalCosts=additional_costs_2, B=explode_tree_8.Branch3)
division_51 = Division(IndirectCosts=indirect_costs_2, B=explode_tree_8.Branch3)
division_52 = Division(DirectCosts=direct_costs_2, B=explode_tree_8.Branch3)
round_57 = Round(Number=division_52)  # -> Nearest, Floor, Ceiling
round_58 = Round(Number=division_51)  # -> Nearest, Floor, Ceiling
round_59 = Round(Number=division_50)  # -> Nearest, Floor, Ceiling
merge_45 = Merge(Data1=round_57.Nearest, Data2=round_58.Nearest, Data3=round_59.Nearest)  # -> flatten(MaterialLabourCostsTruePrice)
panel_138 = Panel("""Direct Costs
Indirect Costs
Additional Costs""")
chart_66 = CreateChart(Data=0, Names=" ", Title=" ", ChartType=1)
setchart_66 = SetChartContents(ChartToModify=chart_66, NewChartValues=merge_45, NewChartNames=panel_138)
chart_appearance_12 = ChartAppearance(
    ChartToModify=chart_66,
    Colors=[ColourSwatch(SwatchColor=RGB(245, 200, 61)), ColourSwatch(SwatchColor=RGB(249, 222, 139)), ColourSwatch(SwatchColor=RGB(251, 233, 177))],
    Legend=True,
    Title=False)
adjustelem_36 = AdjustElementAppearance(ElementsToAdjust=chart_66, Background=RGBA(255, 255, 255, 0))
panel_139 = Panel("Costs of the building per m2 GFA, consisting of material, labour and shadow (MKI) costs.")
adjust_element_positioning_20 = AdjustElementPositioning(
    ElementsToAdjust=chart_66,
    Margin="-7,-45,-10,-10",
    AbsolutePositioning=False,
    Width=Slider(257, range=100..300),
    Height=Slider(200, range=0..1000),
    HorizontalAlignment=3)
tooltip_25 = AttachTooltipToElement(ElementsToAttachTo=chart_66, TooltipContent=panel_139, ShowDelay=500, Duration=100000)

# ---- group: True price - total
label_137 = CreateLabel(LabelText="True Price", LabelSize=18, Justification=0)
label_138 = CreateLabel(LabelText=" A", LabelSize=Slider(29, range=0..100), Justification=0)
setlabel_26 = SetLabelContents(LabelToModify=label_138, NewLabelContents=explode_tree_13.Branch3)
adjustelem_37 = AdjustElementAppearance(ElementsToAdjust=label_138, Foreground=ColourSwatch(SwatchColor=RGB(245, 200, 61)))
panel_140 = Panel("True price of the building, consisting of the direct costs and total MKI (environmental shadow costs).")
stack_80 = CreateStack(UIElements=[label_137, label_135, label_138], Horizontal=False)
tooltip_26 = AttachTooltipToElement(ElementsToAttachTo=stack_80, TooltipContent=panel_140, ShowDelay=500, Duration=100000)

# ---- group: Total investment costs
investment_costs_4 = Number(investment_costs_3)
thousand_point_separator_15 = CSharpScript(x=investment_costs_4)  # -> a; same code as thousand_point_separator
format_26 = Format(Format="€{0}.-", Culture=127, Data0=thousand_point_separator_15)  # -> simplify(Text)
label_139 = CreateLabel(LabelText="Total investment costs", LabelSize=18, Justification=0)
label_140 = CreateLabel(LabelText=" A", LabelSize=Slider(29, range=0..100), Justification=0)
setlabel_27 = SetLabelContents(LabelToModify=label_140, NewLabelContents=format_26)
adjustelem_38 = AdjustElementAppearance(ElementsToAdjust=label_140, Foreground=ColourSwatch(SwatchColor=RGB(245, 200, 61)))
panel_141 = Panel("Total investment costs of the building including preparation and risk costs")
stack_81 = CreateStack(UIElements=[label_139, label_136, label_140], Horizontal=False)
tooltip_27 = AttachTooltipToElement(ElementsToAttachTo=stack_81, TooltipContent=panel_141, ShowDelay=500, Duration=100000)

# ---- group: Text Types / Text types results window (continued)
normal_bold = Data([label_62, label_116, label_63])
expander_1 = Data([expander, expander_15, create_expander_6, create_expander_7])

# ---- group: Fonts / Aptos Semibold (continued)
set_element_property_4 = SetElementProperty(
    UIElement=[normal_bold, material_list_names, material_list_names_3],
    PropertyName="FontFamily",
    ValueToSet=create_objects_from_xaml_4)

# ---- group: Text Properties / Texts "ReLifeCycle Results" window (continued)
expander_1_2 = AdjustElementAppearance(ElementsToAdjust=expander_1, Foreground=colour_swatch_6, Background=stream_filter_26)
normal_bold_2 = AdjustElementAppearance(ElementsToAdjust=normal_bold, Foreground=stream_filter_25, Background=transparent_black)
extra_bold_coloured = AdjustElementAppearance(ElementsToAdjust=normal_bold, Foreground=stream_filter_25, Background=transparent_black)

# ---- group: Total circularity results / DP HNN
# DP HNN
larger_than_2 = LargerThan(FirstNumber=explode_tree_10.Branch1, SecondNumber=expression_23)  # -> LargerThan, OrEqualTo
label_141 = CreateLabel(LabelText=" ", LabelSize=12, Justification=0)
setlabel_28 = SetLabelContents(LabelToModify=label_141, NewLabelContents=format_17)
stream_gate_23 = StreamGate(Stream=larger_than_2.OrEqualTo, Gate=value_listener_18.Values)  # -> Target0, Target1
stream_filter_42 = StreamFilter(Gate=value_listener_18.Values, Stream1=label_141)

# ---- group: Total circularity results / Material input HNN
# Material input HNN
smaller_than_23 = SmallerThan(FirstNumber=explode_tree_10.Branch2, SecondNumber=expression_24)  # -> SmallerThan, OrEqualTo
label_142 = CreateLabel(LabelText=" ", LabelSize=12, Justification=0)
stream_gate_24 = StreamGate(Stream=smaller_than_23.OrEqualTo, Gate=value_listener_18.Values)  # -> Target0, Target1
setlabel_29 = SetLabelContents(LabelToModify=label_142, NewLabelContents=format_18)
stream_filter_43 = StreamFilter(Gate=value_listener_18.Values, Stream1=label_142)

# ---- group: Total circularity results / BCI
# BCI
panel_142 = Panel("0")
total_bci_2 = Data(explode_tree_10.Branch0)
label_143 = CreateLabel(LabelText="BCI", LabelSize=18, Justification=0)
chart_67 = CreateChart(Data=panel_142, Title="BCI", ChartType=4)
setchart_67 = SetChartContents(ChartToModify=chart_67, NewChartValues=total_bci_2)
adjustpos_16 = AdjustElementPositioning(ElementsToAdjust=label_143, AbsolutePositioning=False, HorizontalAlignment=0)
chartappearance_13 = ChartAppearance(ChartToModify=chart_67, Colors=ColourSwatch(SwatchColor=RGB(77, 137, 116)), Legend=False, Title=False)
adjustelem_39 = AdjustElementAppearance(ElementsToAdjust=chart_67, Background=RGBA(255, 255, 255, 0))
viewbox_5 = CreateViewBox(UIElements=chart_67, Width=Slider(120, range=0..1000), Height=Slider(219, range=0..1000))
adjust_element_positioning_21 = AdjustElementPositioning(ElementsToAdjust=viewbox_5, Margin="-20,-70,0,-40", AbsolutePositioning=False)
panel_143 = Panel("Building Circularity Indicator from 10% (fully linear) to 100% (fully circular)")

# ---- group: Total circularity results / BCI % deviation
# BCI % deviation
subtraction_11 = Subtraction(A=total_bci_2, B=baseline_bci)
label_size_11 = Slider(15, range=0..100)
smaller_than_24 = SmallerThan(FirstNumber=subtraction_11, SecondNumber=0)  # -> SmallerThan, OrEqualTo
label_144 = CreateLabel(LabelText=" ", LabelSize=label_size_11, Justification=0)
stream_filter_44 = StreamFilter(Gate=smaller_than_24.SmallerThan, Stream0="+{0}%", Stream1="{0}%")
stream_filter_45 = StreamFilter(
    Gate=smaller_than_24.SmallerThan,
    Stream0=ColourSwatch(SwatchColor=RGB(0, 118, 21)),
    Stream1=ColourSwatch(SwatchColor=RGB(163, 21, 21)))
format_27 = Format(Format=stream_filter_44, Culture=127, Data0=subtraction_11)  # -> simplify(Text)
set_label_contents_13 = SetLabelContents(LabelToModify=label_144, NewLabelContents=format_27)
adjustelem_40 = AdjustElementAppearance(ElementsToAdjust=label_144, Foreground=stream_filter_45)

# ---- group: Total circularity results / BCI (continued)
stack_82 = CreateStack(UIElements=[label_143, label_144, viewbox_5], Horizontal=False)
tooltip_28 = AttachTooltipToElement(ElementsToAttachTo=stack_82, TooltipContent=panel_143, ShowDelay=500, Duration=100000)

# ---- group: Total circularity results / DP
# DP
panel_144 = Panel("0")
colour_swatch_62 = ColourSwatch(SwatchColor=RGB(77, 137, 116))
colour_swatch_63 = ColourSwatch(SwatchColor=RGB(127, 127, 127))
colour_swatch_64 = ColourSwatch(SwatchColor=RGB(163, 21, 21))
total_dp_2 = Data(explode_tree_10.Branch1)
label_145 = CreateLabel(LabelText="DP", LabelSize=18, Justification=0)
chart_68 = CreateChart(Data=panel_144, Title="BCI", ChartType=4)
setchart_68 = SetChartContents(ChartToModify=chart_68, NewChartValues=total_dp_2)
adjustelem_41 = AdjustElementAppearance(ElementsToAdjust=chart_68, Background=RGBA(255, 255, 255, 0))
viewbox_6 = CreateViewBox(UIElements=chart_68, Width=Slider(120, range=0..1000), Height=Slider(219, range=0..1000))
adjust_element_positioning_22 = AdjustElementPositioning(ElementsToAdjust=viewbox_6, Margin="-20,-70,-10,-40", AbsolutePositioning=False)
panel_145 = Panel("Disassembly Potential from 10% (most difficult to disassemble) to 100% (least difficult to disassemble)")

# ---- group: Total circularity results / DP % deviation
# DP % deviation
subtraction_12 = Subtraction(A=total_dp_2, B=baseline_dp)
label_size_12 = Slider(15, range=0..100)
smaller_than_25 = SmallerThan(FirstNumber=subtraction_12, SecondNumber=0)  # -> SmallerThan, OrEqualTo
label_146 = CreateLabel(LabelText=" ", LabelSize=label_size_12, Justification=0)
stream_filter_46 = StreamFilter(Gate=smaller_than_25.SmallerThan, Stream0="+{0}%", Stream1="{0}%")
stream_filter_47 = StreamFilter(
    Gate=smaller_than_25.SmallerThan,
    Stream0=ColourSwatch(SwatchColor=RGB(0, 118, 21)),
    Stream1=ColourSwatch(SwatchColor=RGB(163, 21, 21)))
format_28 = Format(Format=stream_filter_46, Culture=127, Data0=subtraction_12)  # -> simplify(Text)
set_label_contents_14 = SetLabelContents(LabelToModify=label_146, NewLabelContents=format_28)
adjustelem_42 = AdjustElementAppearance(ElementsToAdjust=label_146, Foreground=stream_filter_47)

# ---- group: Total circularity results / DP HNN (continued)
stream_filter_48 = StreamFilter(Gate=stream_gate_23.Target1, Stream0=colour_swatch_64, Stream1=colour_swatch_62)
stream_filter_49 = StreamFilter(Gate=stream_gate_23.Target1, Stream0=colour_swatch_64, Stream1=colour_swatch_63)
stream_filter_50 = StreamFilter(Gate=value_listener_18.Values, Stream0=colour_swatch_62, Stream1=stream_filter_48)
adjustelem_43 = AdjustElementAppearance(ElementsToAdjust=label_141, Foreground=stream_filter_49)

# ---- group: Total circularity results / DP (continued)
chartappearance_14 = ChartAppearance(ChartToModify=chart_68, Colors=stream_filter_50, Legend=False, Title=False)
stack_83 = CreateStack(UIElements=[label_145, label_146, viewbox_6, stream_filter_42], Horizontal=False)
tooltip_29 = AttachTooltipToElement(ElementsToAttachTo=stack_83, TooltipContent=panel_145, ShowDelay=500, Duration=100000)

# ---- group: Total circularity results / Material input
# Material input
colour_swatch_65 = ColourSwatch(SwatchColor=RGB(217, 234, 228))
colour_swatch_66 = ColourSwatch(SwatchColor=RGB(127, 127, 127))
colour_swatch_67 = ColourSwatch(SwatchColor=RGB(77, 137, 116))
colour_swatch_68 = ColourSwatch(SwatchColor=RGB(163, 21, 21))
merge_46 = Merge(
    Data1=explode_tree_10.Branch2,
    Data2=explode_tree_10.Branch3,
    Data3=explode_tree_10.Branch4,
    Data4=explode_tree_10.Branch5)  # -> flatten(MaterialInput)
panel_146 = Panel("""%New
%Biobased
%Recycled
%Reused""")
label_147 = CreateLabel(LabelText="Material Input", LabelSize=18, Justification=0)
chart_69 = CreateChart(Data=0, Names=" ", Title=" ", ChartType=0)
setchart_69 = SetChartContents(ChartToModify=chart_69, NewChartValues=merge_46, NewChartNames=panel_146)
adjustelem_44 = AdjustElementAppearance(ElementsToAdjust=chart_69, Background=RGBA(255, 255, 255, 0))
stack_84 = CreateStack(UIElements=[label_147, chart_69, stream_filter_43], Horizontal=False)
panel_147 = Panel("Material input flows, as percentages of building mass, normalized by MKI.")
adjust_element_positioning_23 = AdjustElementPositioning(
    ElementsToAdjust=chart_69,
    Margin="-7,-45,-10,-10",
    AbsolutePositioning=False,
    Width=Slider(162, range=100..300),
    Height=Slider(205, range=0..1000))
tooltip_30 = AttachTooltipToElement(ElementsToAttachTo=stack_84, TooltipContent=panel_147, ShowDelay=500, Duration=100000)

# ---- group: Total circularity results / Material input HNN (continued)
stream_filter_51 = StreamFilter(Gate=stream_gate_24.Target1, Stream0=colour_swatch_68, Stream1=colour_swatch_67)
stream_filter_52 = StreamFilter(Gate=stream_gate_24.Target1, Stream0=colour_swatch_68, Stream1=colour_swatch_66)
stream_filter_53 = StreamFilter(Gate=value_listener_18.Values, Stream0=colour_swatch_67, Stream1=stream_filter_51)
adjustelem_45 = AdjustElementAppearance(ElementsToAdjust=label_142, Foreground=stream_filter_52)

# ---- group: Total circularity results / Material input (continued)
chart_appearance_13 = ChartAppearance(
    ChartToModify=chart_69,
    Colors=[stream_filter_53, ColourSwatch(SwatchColor=RGB(141, 191, 174)), ColourSwatch(SwatchColor=RGB(179, 212, 201)), colour_swatch_65],
    Legend=True,
    Title=False)

# ---- group: Total circularity results
create_stack_43 = CreateStack(UIElements=[stack_82, stack_83, stack_84, stack_77], Horizontal=True)

# ---- group: Text Types / Text types results window (continued)
charts = Data([chart_14, chart_2, chart_69, chart_63])

# ---- group: Text Properties / Texts "ReLifeCycle Results" window (continued)
charts_2 = AdjustElementAppearance(ElementsToAdjust=charts, Foreground=colour_swatch_7, FontSize=9.5)

# ---- group: Environmental Impact Total Results / MPG HNN
# MPG HNN
smaller_than_26 = SmallerThan(FirstNumber=expression_19, SecondNumber=expression_22)  # -> SmallerThan, OrEqualTo
label_148 = CreateLabel(LabelText=" ", LabelSize=12, Justification=0)
stream_gate_25 = StreamGate(Stream=smaller_than_26.OrEqualTo, Gate=value_listener_18.Values)  # -> Target0, Target1
setlabel_30 = SetLabelContents(LabelToModify=label_148, NewLabelContents=format_15)
stream_filter_54 = StreamFilter(Gate=value_listener_18.Values, Stream1=label_148)

# ---- group: Environmental Impact Total Results / PP HNN
# PP HNN
smaller_than_27 = SmallerThan(FirstNumber=expression_21, SecondNumber=expression_25)  # -> SmallerThan, OrEqualTo
stream_gate_26 = StreamGate(Stream=smaller_than_27.OrEqualTo, Gate=value_listener_18.Values)  # -> Target0, Target1
label_149 = CreateLabel(LabelText=" ", LabelSize=12, Justification=0)
setlabel_31 = SetLabelContents(LabelToModify=label_149, NewLabelContents=format_16)
stream_filter_55 = StreamFilter(Gate=value_listener_18.Values, Stream1=label_149)

# ---- group: Environmental Impact Total Results / PP
# PP
colour_swatch_69 = ColourSwatch(SwatchColor=RGB(42, 91, 115))
colour_swatch_70 = ColourSwatch(SwatchColor=RGB(163, 21, 21))
colour_swatch_71 = ColourSwatch(SwatchColor=RGB(127, 127, 127))
label_size_13 = Slider(15, range=0..100)
label_150 = CreateLabel(LabelText="Paris Proof Indicator", LabelSize=18, Justification=0)
label_151 = CreateLabel(LabelText=" ", LabelSize=Slider(29, range=0..100), Justification=0)
label_152 = CreateLabel(LabelText="kg CO2 eq. / m2 GFA", LabelSize=label_size_13, Justification=0)
setlabel_32 = SetLabelContents(LabelToModify=label_151, NewLabelContents=expression_21)
adjustelem_46 = AdjustElementAppearance(ElementsToAdjust=[label_151, label_152], Foreground=colour_swatch_69)
stack_85 = CreateStack(UIElements=[label_150, label_127, label_151, label_152, stream_filter_55], Horizontal=False)
tooltip_31 = AttachTooltipToElement(
    ElementsToAttachTo=stack_85,
    TooltipContent="Paris Proof Indicator for the total building.",
    ShowDelay=500,
    Duration=100000)

# ---- group: Environmental Impact Total Results / PP HNN (continued)
stream_filter_56 = StreamFilter(Gate=stream_gate_26.Target1, Stream0=colour_swatch_70, Stream1=colour_swatch_69)
stream_filter_57 = StreamFilter(Gate=stream_gate_26.Target1, Stream0=colour_swatch_70, Stream1=colour_swatch_71)
stream_filter_58 = StreamFilter(Gate=value_listener_18.Values, Stream0=colour_swatch_69, Stream1=stream_filter_56)
adjustelem_47 = AdjustElementAppearance(ElementsToAdjust=label_149, Foreground=stream_filter_57)

# ---- group: Environmental Impact Total Results / PP (continued)
adjustelem_48 = AdjustElementAppearance(ElementsToAdjust=label_151, Foreground=stream_filter_58)

# ---- group: Environmental Impact Total Results / MPG
# MPG
colour_swatch_72 = ColourSwatch(SwatchColor=RGB(42, 91, 115))
colour_swatch_73 = ColourSwatch(SwatchColor=RGB(163, 21, 21))
colour_swatch_74 = ColourSwatch(SwatchColor=RGB(127, 127, 127))
label_size_14 = Slider(15, range=0..100)
label_153 = CreateLabel(LabelText="MPG", LabelSize=18, Justification=0)
label_154 = CreateLabel(LabelText=" A", LabelSize=Slider(29, range=0..100), Justification=0)
label_155 = CreateLabel(LabelText="MKI / m2 GFA / year", LabelSize=label_size_14, Justification=0)
setlabel_33 = SetLabelContents(LabelToModify=label_154, NewLabelContents=expression_19)
adjustelem_49 = AdjustElementAppearance(ElementsToAdjust=[label_154, label_155], Foreground=colour_swatch_72)
panel_148 = Panel("MilieuPrestatie Gebouw (Environmental Performance Building) for the total building.")
stack_86 = CreateStack(UIElements=[label_153, label_126, label_154, label_155, stream_filter_54], Horizontal=False)
tooltip_32 = AttachTooltipToElement(ElementsToAttachTo=stack_86, TooltipContent=panel_148, ShowDelay=500, Duration=100000)

# ---- group: Environmental Impact Total Results / MPG HNN (continued)
stream_filter_59 = StreamFilter(Gate=stream_gate_25.Target1, Stream0=colour_swatch_73, Stream1=colour_swatch_72)
stream_filter_60 = StreamFilter(Gate=stream_gate_25.Target1, Stream0=colour_swatch_73, Stream1=colour_swatch_74)
stream_filter_61 = StreamFilter(Gate=value_listener_18.Values, Stream0=colour_swatch_72, Stream1=stream_filter_59)
adjustelem_50 = AdjustElementAppearance(ElementsToAdjust=label_148, Foreground=stream_filter_60)

# ---- group: Environmental Impact Total Results / MPG (continued)
adjustelem_51 = AdjustElementAppearance(ElementsToAdjust=label_154, Foreground=stream_filter_61)

# ---- group: Environmental Impact Total Results
separator_80 = CreateSeparator(Thickness=20, Horizontal=False, Color=RGBA(255, 255, 255, 0))
separator_81 = CreateSeparator(Thickness=20, Horizontal=False, Color=RGBA(255, 255, 255, 0))
create_stack_44 = CreateStack(UIElements=[stack_86, separator_80, stack_85, separator_81, stack_78], Horizontal=True)

# ---- group: Direct costs - per m2 GFA
division_53 = Division(A=number_6, B=explode_tree_11.Branch3)
colour_swatch_75 = ColourSwatch(SwatchColor=RGB(245, 200, 61))
thousand_point_separator_16 = CSharpScript(x=division_53)  # -> a; same code as thousand_point_separator
format_29 = Format(Format="€{0}.-", Culture=127, Data0=thousand_point_separator_16)  # -> simplify(Text)
label_156 = CreateLabel(LabelText="/ m2 GFA", LabelSize="15", Justification=0)
label_157 = CreateLabel(LabelText="Direct Costs", LabelSize=18, Justification=0)
label_158 = CreateLabel(LabelText=" A", LabelSize=Slider(29, range=0..100), Justification=0)
create_stack_45 = CreateStack(UIElements=flatten([label_158, label_156]), Horizontal=True)
adjust_element_appearance_42 = AdjustElementAppearance(ElementsToAdjust=label_156, Foreground=colour_swatch_75)
setlabel_34 = SetLabelContents(LabelToModify=label_158, NewLabelContents=format_29)
adjustelem_52 = AdjustElementAppearance(ElementsToAdjust=label_158, Foreground=colour_swatch_75)
adjust_element_positioning_24 = AdjustElementPositioning(ElementsToAdjust=label_156, AbsolutePositioning=False, VerticalAlignment=1)
panel_149 = Panel("Total direct costs of the building, consisting of material and labour costs.")

# ---- group: Direct costs per m2 GFA % deviation
subtraction_13 = Subtraction(A=division_53, B=baseline_direct_costs_per_m2)
division_54 = Division(A=subtraction_13, B=baseline_direct_costs_per_m2)
multiplication_38 = Multiplication(A=division_54, B=100)
expression_37 = Expression(x=multiplication_38, Expression="Format(\"{0:0.0}\",x)")
label_size_15 = Slider(15, range=0..100)
smaller_than_28 = SmallerThan(FirstNumber=expression_37, SecondNumber=0)  # -> SmallerThan, OrEqualTo
label_159 = CreateLabel(LabelText=" ", LabelSize=label_size_15, Justification=0)
stream_filter_62 = StreamFilter(Gate=smaller_than_28.SmallerThan, Stream0="+{0}%", Stream1="{0}%")
stream_filter_63 = StreamFilter(
    Gate=smaller_than_28.SmallerThan,
    Stream0=ColourSwatch(SwatchColor=RGB(163, 21, 21)),
    Stream1=ColourSwatch(SwatchColor=RGB(0, 118, 21)))
format_30 = Format(Format=stream_filter_62, Culture=127, Data0=expression_37)  # -> simplify(Text)
set_label_contents_15 = SetLabelContents(LabelToModify=label_159, NewLabelContents=format_30)
adjustelem_53 = AdjustElementAppearance(ElementsToAdjust=label_159, Foreground=stream_filter_63)

# ---- group: Direct costs - per m2 GFA (continued)
stack_87 = CreateStack(UIElements=[label_157, label_159, create_stack_45], Horizontal=False)
tooltip_33 = AttachTooltipToElement(ElementsToAttachTo=stack_87, TooltipContent=panel_149, ShowDelay=500, Duration=100000)

# ---- group: True price - per m2 GF
division_55 = Division(A=number_9, B=explode_tree_11.Branch3)
colour_swatch_76 = ColourSwatch(SwatchColor=RGB(245, 200, 61))
thousand_point_separator_17 = CSharpScript(x=division_55)  # -> a; same code as thousand_point_separator
format_31 = Format(Format="€{0}.-", Culture=127, Data0=thousand_point_separator_17)  # -> simplify(Text)
label_160 = CreateLabel(LabelText="/ m2 GFA", LabelSize="15", Justification=0)
label_161 = CreateLabel(LabelText="True Price", LabelSize=18, Justification=0)
label_162 = CreateLabel(LabelText=" A", LabelSize=Slider(29, range=0..100), Justification=0)
create_stack_46 = CreateStack(UIElements=flatten([label_162, label_160]), Horizontal=True)
setlabel_35 = SetLabelContents(LabelToModify=label_162, NewLabelContents=format_31)
adjust_element_appearance_43 = AdjustElementAppearance(ElementsToAdjust=label_160, Foreground=colour_swatch_76)
adjustelem_54 = AdjustElementAppearance(ElementsToAdjust=label_162, Foreground=colour_swatch_76)
adjust_element_positioning_25 = AdjustElementPositioning(ElementsToAdjust=label_160, AbsolutePositioning=False, VerticalAlignment=1)
panel_150 = Panel("True price of the building, consisting of the direct costs and total MKI (environmental shadow costs).")

# ---- group: True price per m2 GFA % deviation
subtraction_14 = Subtraction(A=division_55, B=baseline_true_price_per_m2)
division_56 = Division(A=subtraction_14, B=baseline_true_price_per_m2)
multiplication_39 = Multiplication(A=division_56, B=100)
expression_38 = Expression(x=multiplication_39, Expression="Format(\"{0:0.0}\",x)")
label_size_16 = Slider(15, range=0..100)
smaller_than_29 = SmallerThan(FirstNumber=expression_38, SecondNumber=0)  # -> SmallerThan, OrEqualTo
label_163 = CreateLabel(LabelText=" ", LabelSize=label_size_16, Justification=0)
stream_filter_64 = StreamFilter(Gate=smaller_than_29.SmallerThan, Stream0="+{0}%", Stream1="{0}%")
stream_filter_65 = StreamFilter(
    Gate=smaller_than_29.SmallerThan,
    Stream0=ColourSwatch(SwatchColor=RGB(163, 21, 21)),
    Stream1=ColourSwatch(SwatchColor=RGB(0, 118, 21)))
format_32 = Format(Format=stream_filter_64, Culture=127, Data0=expression_38)  # -> simplify(Text)
set_label_contents_16 = SetLabelContents(LabelToModify=label_163, NewLabelContents=format_32)
adjustelem_55 = AdjustElementAppearance(ElementsToAdjust=label_163, Foreground=stream_filter_65)

# ---- group: True price - per m2 GF (continued)
stack_88 = CreateStack(UIElements=[label_161, label_163, create_stack_46], Horizontal=False)
tooltip_34 = AttachTooltipToElement(ElementsToAttachTo=stack_88, TooltipContent=panel_150, ShowDelay=500, Duration=100000)

# ---- group: Investment costs- per m2 GFA
division_57 = Division(A=investment_costs_3, B=explode_tree_8.Branch3)
colour_swatch_77 = ColourSwatch(SwatchColor=RGB(245, 200, 61))
round_60 = Round(Number=division_57)  # -> Nearest, Floor, Ceiling
format_33 = Format(Format="€{0}.-", Culture=127, Data0=round_60.Nearest)  # -> simplify(Text)
label_164 = CreateLabel(LabelText="/ m2 GFA", LabelSize="15", Justification=0)
label_165 = CreateLabel(LabelText="Investment costs GFA", LabelSize=18, Justification=0)
label_166 = CreateLabel(LabelText=" A", LabelSize=Slider(29, range=0..100), Justification=0)
create_stack_47 = CreateStack(UIElements=flatten([label_166, label_164]), Horizontal=True)
adjust_element_appearance_44 = AdjustElementAppearance(ElementsToAdjust=label_164, Foreground=colour_swatch_77)
setlabel_36 = SetLabelContents(LabelToModify=label_166, NewLabelContents=format_33)
adjustelem_56 = AdjustElementAppearance(ElementsToAdjust=label_166, Foreground=colour_swatch_77)
adjust_element_positioning_26 = AdjustElementPositioning(ElementsToAdjust=label_164, AbsolutePositioning=False, VerticalAlignment=1)
panel_151 = Panel("Investment costs of the building per m2 GFA including preparation and risk costs")

# ---- group: Investment costs per m2 GFA % deviation
subtraction_15 = Subtraction(A=round_60.Nearest, B=baseline_investment_costs_per_m2_gfa)
division_58 = Division(A=subtraction_15, B=baseline_investment_costs_per_m2_gfa)
multiplication_40 = Multiplication(A=division_58, B=100)
expression_39 = Expression(x=multiplication_40, Expression="Format(\"{0:0.0}\",x)")
label_size_17 = Slider(15, range=0..100)
smaller_than_30 = SmallerThan(FirstNumber=expression_39, SecondNumber=0)  # -> SmallerThan, OrEqualTo
label_167 = CreateLabel(LabelText=" ", LabelSize=label_size_17, Justification=0)
stream_filter_66 = StreamFilter(Gate=smaller_than_30.SmallerThan, Stream0="+{0}%", Stream1="{0}%")
stream_filter_67 = StreamFilter(
    Gate=smaller_than_30.SmallerThan,
    Stream0=ColourSwatch(SwatchColor=RGB(163, 21, 21)),
    Stream1=ColourSwatch(SwatchColor=RGB(0, 118, 21)))
format_34 = Format(Format=stream_filter_66, Culture=127, Data0=expression_39)  # -> simplify(Text)
set_label_contents_17 = SetLabelContents(LabelToModify=label_167, NewLabelContents=format_34)
adjustelem_57 = AdjustElementAppearance(ElementsToAdjust=label_167, Foreground=stream_filter_67)

# ---- group: Text Types / Text types results window (continued)
normal = Data([label_91, label_104, label_94, label_97, tb_2, label_124, label_71, label_68, create_toggle_4, label_69, toggle_2, label_70, toggle_3, toggle, toggle_4, label_73, toggle_6, label_75, toggle_8, label_76, toggle_9, label_77, toggle_10, label_74, toggle_7, label_72, toggle_5, label_64, label_65, label_45, label_46, label_54, label_57, label_20, label_19, label_21, label_22, label_100, create_data_table, label_23, label_24, label_25, label_26, label_27, label_28, label_15, label_16, label_17, label_18, label_29, label_30, label_31, label_32, label_136, label_167, tb, expander_2, label_41, create_text_block, label_6, label_119, create_label, create_label_2, create_label_3, create_label_5, create_label_4, create_label_6, label_156, label_160, label_164, create_text_block_2])

# ---- group: Fonts / Aptos Regular (continued)
set_element_property_5 = SetElementProperty(
    UIElement=[normal, label_93, label_111, label_12, label_107, label_108, label_114, label_103, charts, label_122, label_155, label_148, label_152, label_131, label_141, label_142, label_149, label_126, label_127, label_128, label_144, label_146, label_132, label_135, label_159, label_163, expander_2_2],
    PropertyName="FontFamily",
    ValueToSet=create_objects_from_xaml_5)

# ---- group: Text Properties / Texts "ReLifeCycle Results" window (continued)
normal_2 = AdjustElementAppearance(ElementsToAdjust=normal, Foreground=stream_filter_25, Background=transparent_black)

# ---- group: Investment costs- per m2 GFA (continued)
stack_89 = CreateStack(UIElements=[label_165, label_167, create_stack_47], Horizontal=False)
tooltip_35 = AttachTooltipToElement(ElementsToAttachTo=stack_89, TooltipContent=panel_151, ShowDelay=500, Duration=100000)

# ----
create_separator_5 = CreateSeparator(Thickness=20, Horizontal=False, Color=RGBA(0, 0, 0, 0))
create_separator_6 = CreateSeparator(Thickness=20, Horizontal=False, Color=RGBA(0, 0, 0, 0))
create_separator_7 = CreateSeparator(Thickness=20, Horizontal=False, Color=RGBA(0, 0, 0, 0))
stack_90 = CreateStack(UIElements=[stack_79, stack_80, data_source_6], Horizontal=False)
stack_91 = CreateStack(UIElements=[stack_87, stack_88], Horizontal=False)
stack_92 = CreateStack(UIElements=[stack_81, stack_89], Horizontal=False)
create_stack_48 = CreateStack(UIElements=[stack_92, create_separator_7, chart_66], Horizontal=True)
create_stack_49 = CreateStack(UIElements=[stack_90, create_separator_5, chart_64], Horizontal=True)
create_stack_50 = CreateStack(UIElements=[stack_91, create_separator_6, chart_65], Horizontal=True)
merge_47 = Merge(Data1=merge_30, Data2=create_stack_48)
create_stack_51 = CreateStack(UIElements=[create_stack_49, merge_29, create_stack_50, merge_47], Horizontal=False)

# ----
# Tab 2: Compare
merge_48 = Merge(
    Data1=merge_22,
    Data2=merge_23,
    Data3=create_stack_42,
    Data4=separator_78,
    Data5=expander_15,
    Data6=merge_24,
    Data7=merge_25,
    Data8=create_stack_44,
    Data9=data_source_5,
    Data10=merge_26,
    Data11=create_stack_43,
    Data12=data_source_4,
    Data13=merge_27,
    Data14=merge_28,
    Data15=create_stack_51)  # -> flatten(Tab1OverviewResults)

# ---- group: Interface Windows / ReLifeCycle Explore Window (continued)
tabbed_view_3 = TabbedView(TabNames=panel_69, TabTextSize=15, Tab0=flatten(merge_41), Tab1=flatten(merge_48))
add_elements_2 = AddElements(Window=launch_transparent_window_2, Elements=flatten(tabbed_view_3), DoVLChecking=True)  # -> AddedElements, ElementNames
adjust_element_appearance_45 = AdjustElementAppearance(ElementsToAdjust=tabbed_view_3, Background=ColourSwatch(SwatchColor=RGBA(255, 255, 255, 0)))

# ==== cluster Cluster
data = ClusterInput()
split_tree = SplitTree(Data=data, Masks=flatten("{?;1}"))  # -> Positive, Negative
tree_statistics = TreeStatistics(Tree=split_tree.Positive)  # -> Paths, Length, Count
list_item = ListItem(List=split_tree.Positive, Index=1, Wrap=True)
nl_sfb_classes = Data(["11", "13A", "13B", "16", "17", "21A", "21B", "22A", "22B", "23A", "23B", "24", "27A", "27B", "28A", "28B", "31A", "31B", "31C", "32A", "32B", "32C", "33A", "33B", "34", "37A", "37B", "41", "42", "43", "44", "45", "47"])
expression = Expression(X=list_item, Y=nl_sfb_classes, Expression="If(x=y, True, False)")  # -> simplify(Result)
flip_matrix = FlipMatrix(Data=expression)
cull_pattern = CullPattern(List=flatten(tree_statistics.Paths), CullPattern=flip_matrix)  # -> simplify(List)
deconstruct_path = DeconstructPath(Branch=cull_pattern)
list_item_2 = ListItem(List=deconstruct_path, Index=0, Wrap=True)
clean_tree = CleanTree(RemoveNulls=True, RemoveInvalid=True, RemoveEmpty=False, Tree=list_item_2)
format = Format(Format="{{{0};?}}", Culture=127, Data0=clean_tree)  # -> simplify(Text)
expression_2 = Expression(X=format, Expression="If(x=\"{;?}\", False, True)")
cull_pattern_2 = CullPattern(List=format, CullPattern=expression_2)
tree_statistics_2 = TreeStatistics(Tree=cull_pattern_2)  # -> Paths, Length, Count
deconstruct_path_2 = DeconstructPath(Branch=tree_statistics_2.Paths)
list_length = ListLength(List=deconstruct_path_2)
list_item_3 = ListItem(List=flatten(list_length), Index=0, Wrap=True)
expression_3 = Expression(X=list_item_3, Expression="If(x>1, True, False)")
stream_gate = StreamGate(Stream=cull_pattern_2, Gate=expression_3)  # -> Target0, Target1
trim_tree = TrimTree(Tree=stream_gate.Target1, Depth=1)
wildcards = Data([trim_tree, stream_gate.Target0])
c_script = CSharpScript(x=wildcards)  # -> A; inputs x: tree
# ---------- c_script: C# ----------
// Grasshopper Script Instance
#region Usings
using System;
using System.Linq;
using System.Collections;
using System.Collections.Generic;
using System.Drawing;

using Rhino;
using Rhino.Geometry;

using Grasshopper;
using Grasshopper.Kernel;
using Grasshopper.Kernel.Data;
using Grasshopper.Kernel.Types;
#endregion

public class Script_Instance : GH_ScriptInstance
{
    #region Notes
    /* 
      Members:
        RhinoDoc RhinoDocument
        GH_Document GrasshopperDocument
        IGH_Component Component
        int Iteration

      Methods (Virtual & overridable):
        Print(string text)
        Print(string format, params object[] args)
        Reflect(object obj)
        Reflect(object obj, string method_name)
    */
    #endregion

private void RunScript(DataTree<object> x, ref object A)
{
foreach(GH_Path p in x.Paths){
if(x.Branch(p).Count == 0){
x.Add(null, p);
}
}
A = x;
}
}
# ---------- end c_script ----------
data_2 = Data(data)
wildcards_2 = Data(c_script)
clean_tree_2 = CleanTree(RemoveNulls=True, RemoveInvalid=True, RemoveEmpty=False, Tree=wildcards_2)
explode_tree = ExplodeTree(Data=clean_tree_2)  # -> Branch0, Branch1, Branch2, Branch3, Branch4, Branch5, Branch6, Branch7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
split_tree_2 = SplitTree(Data=data_2, Masks=flatten(explode_tree.Branch0))  # -> Positive, Negative
split_tree_3 = SplitTree(Data=data_2, Masks=flatten(explode_tree.Branch1))  # -> Positive, Negative
split_tree_4 = SplitTree(Data=data_2, Masks=flatten(explode_tree.Branch2))  # -> Positive, Negative
split_tree_5 = SplitTree(Data=data_2, Masks=flatten(explode_tree.Branch3))  # -> Positive, Negative
split_tree_6 = SplitTree(Data=data_2, Masks=flatten(explode_tree.Branch4))  # -> Positive, Negative
split_tree_7 = SplitTree(Data=data_2, Masks=flatten(explode_tree.Branch5))  # -> Positive, Negative
split_tree_8 = SplitTree(Data=data_2, Masks=flatten(explode_tree.Branch6))  # -> Positive, Negative
split_tree_9 = SplitTree(Data=data_2, Masks=flatten(explode_tree.Branch7))  # -> Positive, Negative
split_tree_10 = SplitTree(Data=data_2, Masks=flatten(explode_tree.Branch8))  # -> Positive, Negative
split_tree_11 = SplitTree(Data=data_2, Masks=flatten(explode_tree.Branch9))  # -> Positive, Negative
split_tree_12 = SplitTree(Data=data_2, Masks=flatten(explode_tree.Branch10))  # -> Positive, Negative
split_tree_13 = SplitTree(Data=data_2, Masks=flatten(explode_tree.Branch11))  # -> Positive, Negative
split_tree_14 = SplitTree(Data=data_2, Masks=flatten(explode_tree.Branch12))  # -> Positive, Negative
split_tree_15 = SplitTree(Data=data_2, Masks=flatten(explode_tree.Branch13))  # -> Positive, Negative
split_tree_16 = SplitTree(Data=data_2, Masks=flatten(explode_tree.Branch14))  # -> Positive, Negative
split_tree_17 = SplitTree(Data=data_2, Masks=flatten(explode_tree.Branch15))  # -> Positive, Negative
split_tree_18 = SplitTree(Data=data_2, Masks=flatten(explode_tree.Branch16))  # -> Positive, Negative
split_tree_19 = SplitTree(Data=data_2, Masks=flatten(explode_tree.Branch17))  # -> Positive, Negative
split_tree_20 = SplitTree(Data=data_2, Masks=flatten(explode_tree.Branch18))  # -> Positive, Negative
split_tree_21 = SplitTree(Data=data_2, Masks=flatten(explode_tree.Branch19))  # -> Positive, Negative
split_tree_22 = SplitTree(Data=data_2, Masks=flatten(explode_tree.Branch20))  # -> Positive, Negative
split_tree_23 = SplitTree(Data=data_2, Masks=flatten(explode_tree.Branch21))  # -> Positive, Negative
split_tree_24 = SplitTree(Data=data_2, Masks=flatten(explode_tree.Branch22))  # -> Positive, Negative
split_tree_25 = SplitTree(Data=data_2, Masks=flatten(explode_tree.Branch23))  # -> Positive, Negative
split_tree_26 = SplitTree(Data=data_2, Masks=flatten(explode_tree.Branch24))  # -> Positive, Negative
split_tree_27 = SplitTree(Data=data_2, Masks=flatten(explode_tree.Branch25))  # -> Positive, Negative
split_tree_28 = SplitTree(Data=data_2, Masks=flatten(explode_tree.Branch26))  # -> Positive, Negative
split_tree_29 = SplitTree(Data=data_2, Masks=flatten(explode_tree.Branch27))  # -> Positive, Negative
split_tree_30 = SplitTree(Data=data_2, Masks=flatten(explode_tree.Branch28))  # -> Positive, Negative
split_tree_31 = SplitTree(Data=data_2, Masks=flatten(explode_tree.Branch29))  # -> Positive, Negative
split_tree_32 = SplitTree(Data=data_2, Masks=flatten(explode_tree.Branch30))  # -> Positive, Negative
split_tree_33 = SplitTree(Data=data_2, Masks=flatten(explode_tree.Branch31))  # -> Positive, Negative
split_tree_34 = SplitTree(Data=data_2, Masks=flatten(explode_tree.Branch32))  # -> Positive, Negative
entwine = Entwine(
    Branch0X=split_tree_2.Positive,
    Branch1X=split_tree_3.Positive,
    Branch2X=split_tree_4.Positive,
    Branch3X=split_tree_5.Positive,
    Branch4X=split_tree_6.Positive,
    Branch5X=split_tree_7.Positive,
    Branch6X=split_tree_8.Positive,
    Branch7X=split_tree_9.Positive,
    Branch8X=split_tree_10.Positive,
    Branch9X=split_tree_11.Positive,
    Branch10X=split_tree_12.Positive,
    Branch11X=split_tree_13.Positive,
    Branch12X=split_tree_14.Positive,
    Branch13X=split_tree_15.Positive,
    Branch14X=split_tree_16.Positive,
    Branch15X=split_tree_17.Positive,
    Branch16X=split_tree_18.Positive,
    Branch17X=split_tree_19.Positive,
    Branch18X=split_tree_20.Positive,
    Branch19X=split_tree_21.Positive,
    Branch20X=split_tree_22.Positive,
    Branch21X=split_tree_23.Positive,
    Branch22X=split_tree_24.Positive,
    Branch23X=split_tree_25.Positive,
    Branch24X=split_tree_26.Positive,
    Branch25X=split_tree_27.Positive,
    Branch26X=split_tree_28.Positive,
    Branch27X=split_tree_29.Positive,
    Branch28X=split_tree_30.Positive,
    Branch29X=split_tree_31.Positive,
    Branch30X=split_tree_32.Positive,
    Branch31X=split_tree_33.Positive,
    Branch32X=split_tree_34.Positive,
    FlattenInputs=False)
list_length_2 = ListLength(List=clean_tree_2)
series = Series(Start=0, Step=1, Count=list_length_2)  # -> graft(Series)
sift_pattern = SiftPattern(List=series, SiftPattern=[0, 0, 1, 1])  # -> Output0, Output1
clean_tree_3 = CleanTree(RemoveNulls=True, RemoveInvalid=True, RemoveEmpty=False, Tree=sift_pattern.Output1)
merge = Merge(Data1=entwine, Data2=clean_tree_3)
result = ClusterOutput(merge)

# ==== cluster Cluster_2
tree = ClusterInput()
clean_tree = CleanTree(RemoveNulls=True, RemoveInvalid=True, RemoveEmpty=False, Tree=tree)

# ---- group: From NL/SfB to generic class
explode_tree = ExplodeTree(Data=clean_tree)  # -> Branch0, Branch1, Branch2, Branch3, Branch4, Branch5, Branch6, Branch7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
merge = Merge(Data1=explode_tree.Branch14)
merge_2 = Merge(Data1=explode_tree.Branch11, Data2=explode_tree.Branch24, Data3=explode_tree.Branch30)
merge_3 = Merge(Data1=explode_tree.Branch5, Data2=explode_tree.Branch6, Data3=explode_tree.Branch27)
merge_4 = Merge(Data1=explode_tree.Branch7, Data2=explode_tree.Branch8, Data3=explode_tree.Branch28)
merge_5 = Merge(Data1=explode_tree.Branch3, Data2=explode_tree.Branch4)
merge_6 = Merge(Data1=explode_tree.Branch0)
merge_7 = Merge(
    Data1=explode_tree.Branch16,
    Data2=explode_tree.Branch17,
    Data3=explode_tree.Branch19,
    Data4=explode_tree.Branch20,
    Data5=explode_tree.Branch22,
    Data6=explode_tree.Branch23,
    Data7=explode_tree.Branch25,
    Data8=explode_tree.Branch26)
merge_8 = Merge(
    Data1=explode_tree.Branch9,
    Data2=explode_tree.Branch1,
    Data3=explode_tree.Branch10,
    Data4=explode_tree.Branch2,
    Data5=explode_tree.Branch29,
    Data6=explode_tree.Branch31)
merge_9 = Merge(Data1=explode_tree.Branch12, Data2=explode_tree.Branch13, Data3=explode_tree.Branch32)
merge_10 = Merge(Data1=explode_tree.Branch18, Data2=explode_tree.Branch21)
entwine = Entwine(
    Branch00=merge_6,
    Branch01=merge_5,
    Branch02=merge_3,
    Branch03=merge_4,
    Branch04=merge_8,
    Branch05=merge_2,
    Branch06=merge_9,
    Branch07=merge,
    Branch08=merge_7,
    Branch09=merge_10,
    FlattenInputs=True)  # -> simplify(CombinedModel)

# ----
combined_model = ClusterOutput(entwine)
